# Dynamo graph Carnet_Menuiserie_script.dyn (Dynamo 2.18.1.5096)
# packages: LunchBox for Dynamo 2018.7.7, Clockwork for Dynamo 2.x 2.3.0, Genius Loci 2021.7.30, spring nodes 204.1.0, Data-Shapes 2022.2.100, archi-lab.net 2022.212.2722, bimorphNodes 4.2.1, Rhythm 2022.1.5, bimorphNodes 4.2.4

# group: Input
file_path = Filename("..\..\..\..\..\BPA.png")
fromPath = FileObject(path=file_path)  # "File.FromPath"
readFromFile = Image.ReadFromFile(file=fromPath)
code_block = CodeBlock { "Carnet_Menuiserie"; "Terminer"; }
code_block_2 = CodeBlock { "Categorie de la Menuiserie"; "Distance Verticale"; "Distance Horizontale"; }
code_block_3 = CodeBlock { min = 50; max = 600; 400; 75; 10; }
slider = Custom[Slider](InputName=code_block_2.out2, Minimum=code_block_3.min, Maximum=code_block_3.max, Default_Value=code_block_3.out2, Step=code_block_3.out4)  # package Data-Shapes; Creates slider input for UI.MultipleInputForm ++ . Set the step to decimal value if you want a double slider, or to a integer value if you want an integer slider.
slider_2 = Custom[Slider](InputName=code_block_2.out1, Minimum=code_block_3.min, Maximum=code_block_3.max, Default_Value=code_block_3.out3, Step=code_block_3.out4)
code_block_4 = CodeBlock { ["PVC","ALU","SER","MIN","BOIS"]; }
radiobuttons_data = Custom[RadioButtons Data](Keys=code_block_4, Values=code_block_4)  # package Data-Shapes; Create radio buttons input for UI.MultipleInputForm ++ .
code_block_5 = CodeBlock { "Type de Fichier"; ["Lien","Normal"]; }
dropdown_data = Custom[DropDown Data](InputName=code_block_5.out0, Keys=code_block_5.out1, Values=code_block_5.out1)  # package Data-Shapes; Create data for DropDown input in UI.MultiInputForm ++ . Check out www.data-shapes.net for more infos.
list_create = List.Create(item0=slider, item1=slider_2, item2=radiobuttons_data, item3=dropdown_data)
inputgroup_data = Custom[InputGroup Data](GroupTitle=code_block.out0, Inputs=list_create)  # package Data-Shapes; Creates a group of inputs for UI.MultipleInputForm ++ . Check out www.data-shapes.net for more infos !
boolean = BoolSelector(true)
multipleinputform = Custom[MultipleInputForm ++](Logo_optional=readFromFile, ButtonText_optional=code_block.out1, Inputs=inputgroup_data, Toggle=boolean)  # package Data-Shapes; Create a form with multiple inputs. see www.data-shapes.net for tutorials and infos!
code_block_6 = CodeBlock(x=multipleinputform.User_Inputs) { x[0]; x[1]; x[2]; x[3]; }
python_script = Python()  # IronPython2; unwired: IN[0]
# ---------- python_script.python (36 lines) ----------
# Made by Gavin Crump
# Free for use
# BIM Guru, www.bimguru.com.au

# Boilerplate text
import clr

clr.AddReference("RevitServices")
import RevitServices
from RevitServices.Persistence import DocumentManager 

clr.AddReference("RevitAPI")
import Autodesk 
from Autodesk.Revit.DB import *

#Inputdoc by Andreas Dieckmann
if isinstance(IN[0], list):
	inputdoc = UnwrapElement(IN[0])
else:
	inputdoc = [UnwrapElement(IN[0])]

if inputdoc[0] == None:
	doc = DocumentManager.Instance.CurrentDBDocument
	test = "No input detected"
elif inputdoc[0].GetType().ToString() == "Autodesk.Revit.DB.Document":
	doc = inputdoc[0]
	test = "A document was provided."
elif inputdoc[0].GetType().ToString() == "Autodesk.Revit.DB.RevitLinkInstance":
	doc = inputdoc[0].GetLinkDocument()
	test = "From linked instance."
else:
	doc = DocumentManager.Instance.CurrentDBDocument
	test = "Invalid input, current document used."

# Preparing output to Dynamo
OUT = doc,test
# ----------------------------------------
code_block_7 = CodeBlock(x=python_script) { x[0]; x[1]; }
python_script_2 = Python(IN[0]=code_block_7.out0)  # IronPython2
# ---------- python_script_2.python (28 lines) ----------
# Made by Gavin Crump
# Free for use
# BIM Guru, www.bimguru.com.au

# Boilerplate text
import clr

# Import RevitAPI
clr.AddReference("RevitAPI")
import Autodesk
from Autodesk.Revit.DB import *

# Get the project document.
doc = IN[0]

# Get all views
Views_doc = FilteredElementCollector(doc).OfClass(View).ToElements()

# Create empty lists
Legend_list = []

# Find views that aren't legends, then non-template
for view in Views_doc:
	if view.ViewType == ViewType.Legend:
		Legend_list.append(view)

# Output cleaned view lists
OUT = Legend_list
# ----------------------------------------
code_block_8 = CodeBlock(n=python_script_2) { a=	DSCore.String.Contains(n.Name,"NE PAS SUPRIMER"); b=	DSCore.List.FilterByBoolMask(n,a)["in"]; }

code_block_9 = CodeBlock(x=code_block_6.out3) { x =="Lien" ? true:false; }
getDocuments = archilab.Revit.Selection.Select.GetDocuments()
code_block_10 = CodeBlock(x=getDocuments.Link_Doc, c=getDocuments.Link_Instance) { a=	x==null ? true:false; b=	DSCore.List.FilterByBoolMask(c,a)["out"]; }
categories = Categories("OST_Windows")
code_block_11 = CodeBlock { "Portes"; }
byName = Category.ByName(name=code_block_11)
join = List.Join(list0=categories, list1=byName)
ofCategory = Revit.LinkElement.OfCategory(linkInstance=code_block_10.b, category=join, lacing=Longest)
flatten = List.Flatten(list=ofCategory)
all_elements_of_category = ElementsOfCategory(Category=join)
flatten_2 = List.Flatten(list=all_elements_of_category)
IF = Python(IN[0]=code_block_9, IN[1]=flatten, IN[2]=flatten_2)  # IronPython2
# ---------- IF.python (19 lines) ----------
import clr
clr.AddReference('ProtoGeometry')
from Autodesk.DesignScript.Geometry import *
#The inputs to this node will be stored as a list in the IN variables.

OUT = []

def tolist(obj):
	if hasattr(obj,"__iter__"):
		return obj
	else:
		return [obj]

if IN[0] == True:
	for x in tolist(IN[1]):
		OUT.append(x)
else:
	for x in tolist(IN[2]):
		OUT.append(x)
# ----------------------------------------
element = Revit.LinkElement.Element(linkElement=ofCategory)
flatten_3 = List.Flatten(list=element)
IF_2 = Python(IN[0]=code_block_9, IN[1]=flatten_3, IN[2]=flatten_2)  # IronPython2; same code as IF
code_block_12 = CodeBlock(e=IF_2, type=code_block_6.out2) { a=	Revit.FamilyInstance.GetFamily(e); b=	DSCore.String.Contains(a.Name,type); }
filterByBoolMask = List.FilterByBoolMask(list=IF, mask=code_block_12.b)
elementType = Custom[Element.ElementType+](element=filterByBoolMask.in)  # package Clockwork for Dynamo 2.x; Gets the family type of a given element (if applicable). Unlike the OOTB node, it also works for elements in linked models.
groupByKey = List.GroupByKey(list=filterByBoolMask.in, keys=elementType)

# group: Active Type
code_block_13 = CodeBlock(x=groupByKey.uniqueKeys) { x; }

passthrough = Custom[Passthrough](passThrough=code_block_8.b, waitFor=elementType)  # package Clockwork for Dynamo 2.x; Forces a sequential order of execution. The node wired into the output of the Passthrough node will be executed *after* the node wired into the waitFor input (e.g. important for some Revit operations). The value of the passThrough input will be passed on to the node wired into the output port of the Passthrough node.
firstItem = List.FirstItem(list=groupByKey.groups@L2)
code_block_14 = CodeBlock(x=code_block_9, a=firstItem) { x==true ? a:null; }
document = Revit.LinkElement.Document(linkElement=code_block_14)
element_2 = Revit.LinkElement.Element(linkElement=code_block_14)
ʳʰʸᵗʰᵐ_documents = Rhythm.Revit.Application.Documents.CopyElementsFromDocument(sourceDocument=document, elements=element_2, lacing=Longest)
end = Revit.Transaction.Transaction.End(input=ʳʰʸᵗʰᵐ_documents)
passthrough_2 = Custom[Passthrough](passThrough=join, waitFor=end)
boolean_2 = BoolSelector(true)
current = Document.Current()
all_family_types_of_category = Custom[All Family Types Of Category](category=passthrough_2, toggle=boolean_2, docOrRevitLinkInstance=current)  # package Clockwork for Dynamo 2.x; Gets all family types/symbols of a given category in the model.
flatten_4 = List.Flatten(list=all_family_types_of_category)
groupByKey_2 = List.GroupByKey(list=flatten_4, keys=flatten_4)
firstItem_2 = List.FirstItem(list=groupByKey_2.groups@L2)
code_block_15 = CodeBlock(n=firstItem_2) { n.Family; }
code_block_16 = CodeBlock(a=code_block_15, type=code_block_6.out2, e=firstItem_2) { b=	DSCore.String.Contains(a.Name,type); c=	DSCore.List.FilterByBoolMask(e,b)["in"]; }
code_block_17 = CodeBlock(x=code_block_6.out2)
# ---------- code_block_17.designscript (5 lines) ----------
x=="PVC" ? 	"ME":
x=="ALU" ? 	"EME":
x=="SER" ?	"PE":
x=="MIN" ?	"MI":
x=="BOIS" ?	"PI":"MX";
# ----------------------------------------
firstItem_3 = List.FirstItem(list=groupByKey.groups@L2)
passthrough_3 = Custom[Passthrough](passThrough=code_block_17, waitFor=firstItem_3)
code_block_18 = CodeBlock(e=code_block_16.c, tm=passthrough_3)
# ---------- code_block_18.designscript (7 lines) ----------
d=	Revit.Elements.Element.GetParameterValueByName(e,"Hauteur brute");
dd= d=="" ? 0 : d;
g=	DSCore.List.SortIndexByValue(dd);
//Classer_Elements
gg=	DSCore.List.GetItemAtIndex(e,g);

b=	Revit.Elements.Element.SetParameterByName(gg,"Modèle",tm+(1..DSCore.List.Count(gg)@L2<1>));
# ----------------------------------------
code_block_19 = CodeBlock(e=firstItem_3, tm=passthrough_3)
# ---------- code_block_19.designscript (9 lines) ----------
a=	Revit.Elements.Element.GetParameterValueByName(e,"Famille et type");
c=	DSCore.List.Flatten(a);
d=	Revit.Elements.Element.GetParameterValueByName(c,"Hauteur");
dd= d=="" ? 0 : d;
g=	DSCore.List.SortIndexByValue(dd);
//Classer_Elements
gg=	DSCore.List.GetItemAtIndex(c,g);

b=	Revit.Elements.Element.SetParameterByName(gg,"Modèle",tm+(1..DSCore.List.Count(gg)@L2<1>));
# ----------------------------------------
IF_3 = Python(IN[0]=code_block_9, IN[1]=code_block_18.gg, IN[2]=code_block_19.gg)  # IronPython2; same code as IF
code_block_20 = CodeBlock(x=code_block_6.out0, a=IF_3) { b=	x*DSCore.List.Count(a); }
code_block_21 = CodeBlock(x=code_block_20, t=IF_3) { a=	x/1600; b=	DSCore.Math.Floor(DSCore.List.Count(t)/a); }
chop = List.Chop(list=IF_3, lengths=code_block_21.b)
code_block_22 = CodeBlock(x=chop) { a=	DSCore.List.IsEmpty(x@L2<1>); b=	DSCore.List.FilterByBoolMask(x,a)["out"]; }
code_block_23 = CodeBlock(x=code_block_22.b, nm=code_block_6.out2) { a=	DSCore.List.Count(x); b=nm+" "+(1..a); }
duplicateWithDetailing = Custom[View.DuplicateWithDetailing](view=passthrough, name=code_block_23.b, lacing=Longest)  # package Clockwork for Dynamo 2.x; Duplicates a given view with detailing
code_block_24 = CodeBlock { 1; }
chop_2 = List.Chop(list=duplicateWithDetailing, lengths=code_block_24)
code_block_25 = CodeBlock(x=code_block_6.out0, a=code_block_22.b) { b=	x*DSCore.List.Count(a@L2<1>); }

# group: Processing - Plan
origin = Point.Origin()
XAxis = Vector.XAxis()
byStartPointDirectionLength = Line.ByStartPointDirectionLength(startPoint=origin, direction=XAxis, length=code_block_25)
divideCurveByDistance = Geometry.Curves.DivideCurveByDistance(curve=byStartPointDirectionLength, Distance=code_block_6.out0)
code_block_26 = CodeBlock { 1; }
dropItems = List.DropItems(list=divideCurveByDistance.Points@L2, amount=code_block_26)
code_block_27 = CodeBlock(x=code_block_6.out1) { x*5; }
translate = Geometry.Translate(geometry=dropItems, yTranslation=code_block_27)
list_create_2 = List.Create(item0=dropItems, item1=translate)
transpose = List.Transpose(lists=list_create_2)
flatten_5 = List.Flatten()  # unwired: list
map = List.Map(list=transpose, function=flatten_5)

# group: Modèle
code_block_28 = CodeBlock { -100; }
translate_2 = Geometry.Translate(geometry=dropItems, yTranslation=code_block_28)

# group: ETQ-Modèle
code_block_29 = CodeBlock(a=code_block_22.b)
# ---------- code_block_29.designscript (4 lines) ----------
h=	Revit.Elements.Element.GetParameterValueByName(a,"Hauteur brute");
l=	Revit.Elements.Element.GetParameterValueByName(a,"Largeur brute");
d=	Revit.Elements.Element.GetParameterValueByName(a,"Description");
m=	Revit.Elements.Element.GetParameterValueByName(a,"Modèle");
# ----------------------------------------
code_block_30 = CodeBlock(modele=code_block_29.m, largeur=code_block_29.l, hauteur=code_block_29.h, description=code_block_29.d) { mod=	modele + " - "+DSCore.String.FromObject(largeur)+"x" +DSCore.String.FromObject(hauteur); des=	description; }
code_block_31 = CodeBlock(x=code_block_30.mod, d=code_block_30.des) { x +"\n" +"\n" + "Description" + "\n"+"¯¯¯¯¯¯¯¯¯¯¯"+"\n" + d + "\n"+"\n" + "Localisation :"+"\n"+"¯¯¯¯¯¯¯¯¯¯¯¯¯¯"+"\n"+"Niveau Courants"; }
default = TextNoteType.Default()

# group: to_RVT
ꟿ_textnote_bypoint = Custom[ꟿ TextNote.ByPoint](view=chop_2, point=translate_2, content=code_block_31, textType=default)  # package spring nodes; Places a text note at a given point in the view. View, text type and content can either be a single item for all points or the same length as the number of points. Set track to false if you'd like to place notes on every run.

code_block_32 = CodeBlock(x=code_block_22.b) { DSCore.List.Cycle(x@L2<1>,2); }

# group: Porte
create_legend_component = Custom[Create Legend Component](view=chop_2, familyType=code_block_32, location=map, lacing=Longest)  # package Genius Loci; Inserts a new legend component by duplicating an existing in the given legend view. Please note : At least one legend component must be placed in the legend view.

code_block_33 = CodeBlock(p=map, l=create_legend_component) { a=	DSCore.List.Flatten(p.Y); b=	DSCore.List.Flatten(l); c=	DSCore.List.GroupByKey(b,a)["groups"]; pl=	c[0]; elv=c[1]; }

# group: Position des Legendes
code_block_34 = CodeBlock()
# ---------- code_block_34.designscript (6 lines) ----------
/* Plan d'étage : -8
Elévation avant : -7
Elévation arri	: -6
*/
plan	 = -8;
elévation= -6;
# ----------------------------------------

# group: to_RVT
code_block_35 = CodeBlock(x=code_block_33.c, pl=code_block_34.plan, elv=code_block_34.elévation)
# ---------- code_block_35.designscript (2 lines) ----------
plan	 =	Revit.Elements.Element.SetParameterByName(x[0],"Direction des vues",pl);
elévation=	Revit.Elements.Element.SetParameterByName(x[1],"Direction des vues",elv);
# ----------------------------------------

code_block_36 = CodeBlock(a=code_block_35.plan) { X=	Revit.Elements.Element.SetParameterByName(a,"Longueur de l'hôte",300); }
