# Dynamo graph MurRiedau-Page_script.dyn (Dynamo 2.12.0.5650)
# packages: Genius Loci 2021.7.30, archi-lab.net 2022.210.2522, spring nodes 204.1.0, archi-lab.net 2022.212.2722, Miscellany 1.2.0, Clockwork for Dynamo 2.x 2.3.0, Data-Shapes 2022.2.100

# group: Input
view_type = ViewTypesUi("Elevation")
view_type_2 = ViewTypesUi("Detail")
categories = Categories("OST_Walls")

view_bytype = Custom[View ByType](viewType=view_type)  # package Genius Loci; Gets all views by type. For the View Template Type, the 3D View Templates will not be retrieved.
code_block = CodeBlock(n=view_bytype) { a=	DSCore.String.Contains(n.Name,"Carnet"); b=	DSCore.List.FilterByBoolMask(n,a)["in"]; }
cropBox = archilab.Revit.Views.Views.CropBox(view=code_block.b)
ꟿ_boundingbox_2drectangle = Custom[ꟿ BoundingBox.2dRectangle](boundingBox=cropBox)  # package spring nodes; Returns a 2d rectangle from a bounding box
view_bytype_2 = Custom[View ByType](viewType=view_type_2)
code_block_2 = CodeBlock(n=view_bytype_2) { a=	DSCore.String.Contains(n.Name,"Carnet"); b=	DSCore.List.FilterByBoolMask(n,a)["in"]; }

# group: Mur-Rideau-Filters
all_elements_of_category = ElementsOfCategory(Category=categories)
ꟿ_wall_iscurtainwall = Custom[ꟿ Wall.IsCurtainWall](wall=all_elements_of_category)  # package spring nodes; Returns true if the wall is a curtain wall.
filterByBoolMask = List.FilterByBoolMask(list=all_elements_of_category, mask=ꟿ_wall_iscurtainwall)
type = archilab.Revit.Elements.Elements.Type(element=filterByBoolMask.in)
groupByKey = List.GroupByKey(list=filterByBoolMask.in, keys=type)

flatten = List.Flatten(list=groupByKey.groups)

# group: Optimisation du Paquet
code_block_3 = CodeBlock(c=ꟿ_boundingbox_2drectangle) { DSCore.Math.Ceiling(c.Width); }
sum = Math.Sum(values=code_block_3)
code_block_4 = CodeBlock(x=code_block_3) { DSCore.List.Count(x)*100; }
code_block_5 = CodeBlock(a=sum, b=code_block_4) { DSCore.Math.Ceiling((a+b)/800); }
code_block_6 = CodeBlock(x=code_block_5) { 1..x-1; }
code_block_7 = CodeBlock { 2100; 800; }
code_block_8 = CodeBlock { 10; }
container = Miscellany.ContainerPacking.Entities.Container.Container(id=code_block_6, length=code_block_7.out0, width=code_block_7.out1, height=code_block_8)
id = Element.Id(element=code_block.b)
code_block_9 = CodeBlock(c=ꟿ_boundingbox_2drectangle) { DSCore.Math.Ceiling(c.Width)+200; DSCore.Math.Ceiling(c.Height); }
item = Miscellany.ContainerPacking.Entities.Item.Item(id=id, dim1=code_block_9.out1, dim2=code_block_9.out0, dim3=code_block_8)
packContainers = Miscellany.ContainerPacking.PackingService.PackContainers(containers=container, itemsToPack=item)
code_block_10 = CodeBlock(a=packContainers.packedItems) { a; }
code_block_11 = CodeBlock(i=code_block_10, elev=code_block.b, pln=code_block_2.b, mrs=flatten)
# ---------- code_block_11.designscript (14 lines) ----------
a=	Item.ID(i);
al=	DSCore.List.Flatten(a,1);
alem=	Select.ByElementId(a);

c=	DSCore.List.IndexOf(elev.Name,pln.Name);
c1=	DSCore.List.Count(a@L2<1>);
//elev
e=	DSCore.List.Chop(DSCore.List.GetItemAtIndex(elev,c),c1);

//pln
p=DSCore.List.Chop(pln,c1);

//mur
m=	DSCore.List.Chop(DSCore.List.GetItemAtIndex(mrs,c),c1);
# ----------------------------------------
code_block_12 = CodeBlock(x=code_block.b) { DSCore.List.Count(x); }

code_block_13 = CodeBlock(x=code_block_11.p) { num=	"Carnet "+(1..DSCore.List.Count(x)); nam=	DSCore.List.Cycle(" ",DSCore.List.Count(num)); }
code_block_14 = CodeBlock { 600; }

# group: Input
file_path = Filename("..\..\..\..\..\BPA.png")
fromPath = FileObject(path=file_path)  # "File.FromPath"
readFromFile = Image.ReadFromFile(file=fromPath)
code_block_15 = CodeBlock { "Terminer"; }
code_block_16 = CodeBlock { "Type de Cartouche"; }
categories_2 = Categories("OST_TitleBlocks")
all_family_types_of_category = Custom[All Family Types Of Category](category=categories_2)  # package Clockwork for Dynamo 2.x; Gets all family types/symbols of a given category in the model.
code_block_17 = CodeBlock(x=all_family_types_of_category) { a=	DSCore.String.Replace(DSCore.String.FromObject(x),"Family Type:",""); b=	DSCore.String.Replace(a,"Family: ",""); }
dropdown_data = Custom[DropDown Data](InputName=code_block_16, Keys=code_block_17.b, Values=all_family_types_of_category)  # package Data-Shapes; Create data for DropDown input in UI.MultiInputForm ++ . Check out www.data-shapes.net for more infos.
boolean = BoolSelector(true)
multipleinputform = Custom[MultipleInputForm ++](Logo_optional=readFromFile, ButtonText_optional=code_block_15, Inputs=dropdown_data, Toggle=boolean, Width_optional=code_block_14)  # package Data-Shapes; Create a form with multiple inputs. see www.data-shapes.net for tutorials and infos!
code_block_18 = CodeBlock(x=multipleinputform.User_Inputs) { x[0]; }

# group: Create_Sheet
python_script = Python(IN[0]=code_block_13.nam, IN[1]=code_block_13.num, IN[2]=code_block_18)  # IronPython2
# ---------- python_script.python (43 lines) ----------
#From Dynamo Forum
import clr
clr.AddReference('RevitAPI')
from Autodesk.Revit.DB import ViewSheet

clr.AddReference("RevitNodes")
import Revit
clr.ImportExtensions(Revit.Elements)

clr.AddReference("RevitServices")
import RevitServices
from RevitServices.Persistence import DocumentManager
from RevitServices.Transactions import TransactionManager
doc = DocumentManager.Instance.CurrentDBDocument

def tolist(obj1):
	if hasattr(obj1,"__iter__"): return obj1
	else: return [obj1]

sheetnames = tolist(IN[0])
sheetnumbers = tolist(IN[1])
titleblock = tolist(UnwrapElement(IN[2]))
sheetList,notCreated = [], []

TransactionManager.Instance.EnsureInTransaction(doc) 
for number in range(len(sheetnumbers)):
	if len(titleblock) > 1:
		newsheet = ViewSheet.Create(doc,titleblock[number].Id)
		#new sheets with different titleblocks
	else:
		newsheet = ViewSheet.Create(doc,titleblock[0].Id) 
		#new sheets whith identical titleblock
	newsheet.Name = sheetnames[number]
	try:
		newsheet.SheetNumber = sheetnumbers[number]
		sheetList.append(newsheet.ToDSType(True))
	except:
		notCreated.append(number)
		doc.Delete(newsheet.Id)

TransactionManager.Instance.TransactionTaskDone()

OUT = sheetList
# ----------------------------------------

# group: Center_Box
sheet_size = Custom[Sheet Size](sheet=python_script)  # package Genius Loci; Returns the width and the height of the given sheet.
code_block_19 = CodeBlock { 0; -0.02; }
add = _ + code_block_19.out0  # unwired: x
code_block_20 = CodeBlock(x=code_block_11.p) { 0..DSCore.List.Count(x@L2<1>)-1; }
function_apply = ApplyFunction(func=add, arg1=code_block_20)
add_2 = _ + code_block_19.out1  # unwired: x
function_apply_2 = ApplyFunction(func=add_2, arg1=code_block_20)
code_block_21 = CodeBlock(i=sheet_size.Width, u=sheet_size.Height, yte=function_apply, ytp=function_apply_2)
# ---------- code_block_21.designscript (12 lines) ----------
w= 	DSCore.String.Split(i," cm");
y=	DSCore.String.ToNumber(w);
h=	DSCore.String.Split(u," cm");
g=	DSCore.String.ToNumber(h);
//Cornier Points
a=	Rectangle.ByWidthLength(y,g);
b=	Autodesk.Surface.ByPatch(a);
//Center
c=	Autodesk.Surface.PointAtParameter(b,yte@L1<1>,1.3);

//PDV_ LOC
d=	Autodesk.Surface.PointAtParameter(b,ytp@L1<1>,1.1);
# ----------------------------------------

flatten_2 = List.Flatten(list=code_block_21.c)
chop = List.Chop(list=flatten_2, lengths=code_block_11.c1)

# group: Localisation_Elevation
bySheetViewLocation = Viewport.BySheetViewLocation(sheet=python_script, view=code_block_11.e, location=chop, lacing=Longest)

count = List.Count(list=bySheetViewLocation)
progressDynamoı = Custom[ProgressDynamoı](Processing=count)
code_block_22 = CodeBlock(e=bySheetViewLocation)
# ---------- code_block_22.designscript (2 lines) ----------
a=	Revit.Elements.Element.GetParameterValueByName(e,"Famille et type");
b=	Revit.Elements.Element.SetParameterByName(a,"Affiche le titre",0);
# ----------------------------------------
flatten_3 = List.Flatten(list=code_block_21.d)
chop_2 = List.Chop(list=flatten_3, lengths=code_block_11.c1)

# group: Localisation_Plan
bySheetViewLocation_2 = Viewport.BySheetViewLocation(sheet=python_script, view=code_block_11.p, location=chop_2, lacing=Longest)

code_block_23 = CodeBlock(e=bySheetViewLocation_2)  # same code as code_block_22

# group: Localisation_TXT
code_block_24 = CodeBlock { -1; }
translate = Geometry.Translate(geometry=chop_2, yTranslation=code_block_24)

code_block_25 = CodeBlock(e=bySheetViewLocation, elv=code_block.b)
# ---------- code_block_25.designscript (3 lines) ----------
a=	DSCore.List.Flatten(e);
b=	Rhythm.Viewport.GetView(a);
c=	Revit.Elements.Element.SetParameterByName(DSCore.List.SetDifference(elv,b),"Nom de la vue","Ne pas placer"+(1..DSCore.List.Count(a)));
# ----------------------------------------
passthrough = Custom[Passthrough](passThrough=bySheetViewLocation, waitFor=code_block_25.c)  # package Clockwork for Dynamo 2.x; Forces a sequential order of execution. The node wired into the output of the Passthrough node will be executed *after* the node wired into the waitFor input (e.g. important for some Revit operations). The value of the passThrough input will be passed on to the node wired into the output port of the Passthrough node.
code_block_26 = CodeBlock(e=passthrough)
# ---------- code_block_26.designscript (2 lines) ----------
a=	DSCore.List.Flatten(Revit.Elements.Element.GetParameterValueByName(e,"Nom de la vue"));
b=	Revit.Elements.Element.SetParameterByName(DSCore.List.Flatten(e),"Nom de la vue","Mur-Rideau_"+(1..DSCore.List.Count(a)));
# ----------------------------------------
code_block_27 = CodeBlock(a=code_block_26.a) { "EM - "+(1..DSCore.List.Count(a)); }
chop_3 = List.Chop(list=code_block_27, lengths=code_block_11.c1)
default = TextNoteType.Default()
passthrough_2 = Custom[Passthrough](passThrough=code_block_11.m, waitFor=chop_3)
code_block_28 = CodeBlock(e=passthrough_2, d=passthrough_2, x=chop_3)
# ---------- code_block_28.designscript (2 lines) ----------
a=	Revit.Elements.Element.GetParameterValueByName(e,"Famille et type");
c=	Revit.Elements.Element.SetParameterByName(d,"Identifiant",x);
# ----------------------------------------

# group: ETQ-Modèle
code_block_29 = CodeBlock(modèle=chop_3) { modèle +"\n" +"\n" + "Description:" + "\n"; }
code_block_30 = CodeBlock(a=code_block_28.c)
# ---------- code_block_30.designscript (2 lines) ----------
b=	Revit.Elements.Element.GetParameterValueByName(a,"Description");
c=	Revit.Elements.Element.GetParameterValueByName(a,"Identifiant");
# ----------------------------------------
code_block_31 = CodeBlock(modele=code_block_30.c, description=code_block_30.b) { mod=	modele; des=	description; }

# group: to_RVT
ꟿ_textnote_bypoint = Custom[ꟿ TextNote.ByPoint](view=python_script, point=translate, content=code_block_29, textType=default, lacing=Longest)  # package spring nodes; Places a text note at a given point in the view. View, text type and content can either be a single item for all points or the same length as the number of points. Set track to false if you'd like to place notes on every run.

code_block_32 = CodeBlock(e=bySheetViewLocation_2, pln=code_block_2.b)
# ---------- code_block_32.designscript (3 lines) ----------
a=	DSCore.List.Flatten(e);
b=	Rhythm.Viewport.GetView(a);
c=	Revit.Elements.Element.SetParameterByName(DSCore.List.SetDifference(pln,b),"Nom de la vue","Ne pas placer"+(1..DSCore.List.Count(a)));
# ----------------------------------------
passthrough_3 = Custom[Passthrough](passThrough=bySheetViewLocation_2, waitFor=code_block_32.c)
code_block_33 = CodeBlock(e=passthrough_3)  # same code as code_block_26
