# Dynamo graph Export_script.dyn (Dynamo 2.18.1.5096)
# packages: Data-Shapes 2022.2.96, bimorphNodes 4.0.13, Clockwork for Dynamo 2.x 2.3.0, BumbleBee 2021.25.3

# group: Input
file_path = Filename("..\..\..\..\..\BPA.png")
fromPath = FileObject(path=file_path)  # "File.FromPath"
readFromFile = Image.ReadFromFile(file=fromPath)
code_block = CodeBlock { "BPA ARCHITECTURE"; "Suivant"; }
code_block_2 = CodeBlock { exc=	"Nomenclature"; elem=	"Choisir Fichier Excel"; }
categories = Categories("OST_Schedules")
all_elements_of_category = ElementsOfCategory(Category=categories)
code_block_3 = CodeBlock(x=all_elements_of_category) { a=	DSCore.String.Contains(x.Name,"Nomenclature des révisions"); b=	DSCore.List.FilterByBoolMask(x,a)["out"]; }
code_block_4 = CodeBlock(e=code_block_3.b) { e.Name; }
code_block_5 = CodeBlock { 200; 600; }
code_block_6 = CodeBlock { false; }
listview_data = Custom[Listview Data](InputName=code_block_2.exc, Keys=code_block_4, Values=code_block_3.b, Height_optionnal=code_block_5.out1, ShowId_optionnal=code_block_6)  # package Data-Shapes; Create data for ListView input in UI.MultiInputForm ++ . Check out www.data-shapes.net for more infos.
code_block_7 = CodeBlock { "Excel"; }
filepath_data = Custom[FilePath Data](InputName=code_block_7, ButtonText=code_block_2.elem)  # package Data-Shapes; Create filepath input for UI.MultipleInputForm ++ . Check out www.data-shapes.net for more infos !
list_create = List.Create(item0=listview_data, item1=filepath_data)
boolean = BoolSelector(true)
multipleinputform = Custom[MultipleInputForm ++](Logo_optional=readFromFile, ButtonText_optional=code_block.out1, Inputs=list_create, Toggle=boolean, Width_optional=code_block_5.out1, LabelWidth_optional=code_block_5.out0)  # package Data-Shapes; Create a form with multiple inputs. see www.data-shapes.net for tutorials and infos!

code_block_8 = CodeBlock(x=multipleinputform.User_Inputs) { x[0]; x[1]; }
getData = Revit.Schedule.GetData(scheduleView=code_block_8.out0)
passthrough = Custom[Passthrough](passThrough=boolean, waitFor=getData)  # package Clockwork for Dynamo 2.x; Forces a sequential order of execution. The node wired into the output of the Passthrough node will be executed *after* the node wired into the waitFor input (e.g. important for some Revit operations). The value of the passThrough input will be passed on to the node wired into the output port of the Passthrough node.
code_block_9 = CodeBlock(n=code_block_8.out0) { n.Name; }
code_block_10 = CodeBlock { "A1"; }
get_worksheet_names = Custom[Get Worksheet Names](filePath=code_block_8.out1, runIt=boolean)  # package BumbleBee; This node will query an Excel file and return a list of sheet names that it contains.
code_block_11 = CodeBlock(x=get_worksheet_names) { x[0]; }
copyWorksheet = Custom[CopyWorksheet](filePath=code_block_8.out1, RunIt=boolean, from=code_block_11, to=code_block_9)  # package BumbleBee; This node creates a copy of the existing Excel Worksheet.
passthrough_2 = Custom[Passthrough](passThrough=getData, waitFor=copyWorksheet)
bb_data = Custom[BB Data](sheetName=code_block_9, origin=code_block_10, data=passthrough_2)  # package BumbleBee; This node is a building block for different modes of writing to Excel files. You can combines this node into a list to write to multiple sheets or use just one to write to a single sheet.
write_excel = Custom[Write Excel](filePath=code_block_8.out1, runIt=passthrough, BBData=bb_data)  # package BumbleBee; This node will write data to Excel file and based on how your BBData nodes are structured it will either override the exsting file, create a new one and write a single worksheet or write multiple worksheets.
