# Dynamo graph Choisir_script.dyn (Dynamo 2.10.1.3976)
# packages: archi-lab.net 2022.212.2722, Data-Shapes 2022.2.96, Clockwork for Dynamo 2.x 2.3.0, spring nodes 204.1.0, LunchBox for Dynamo 2018.7.7

file_path = Filename("..\..\..\..\..\BPA.png")
fromPath = FileObject(path=file_path)  # "File.FromPath"
readFromFile = Image.ReadFromFile(file=fromPath)
code_block = CodeBlock { mod=	"Model Categorie"; ant=	"Annotation Categorie"; but=	"Choisir Elements"; ter=	"Terminer"; suv=	"Suivant"; }
getAll = archilab.Revit.Elements.Categories.GetAll()
string_from_object = FromObject(object=getAll.Model)
dropdown_data = Custom[DropDown Data](InputName=code_block.mod, Keys=string_from_object, Values=getAll.Model)  # package Data-Shapes; Create data for DropDown input in UI.MultiInputForm ++ . Check out www.data-shapes.net for more infos.
string_from_object_2 = FromObject(object=getAll.Annotation)
dropdown_data_2 = Custom[DropDown Data](InputName=code_block.ant, Keys=string_from_object_2, Values=getAll.Annotation)
list_create = List.Create(item0=dropdown_data, item1=dropdown_data_2)
boolean = BoolSelector(true)
code_block_2 = CodeBlock { 500; }
code_block_3 = CodeBlock { 200; }
multipleinputform = Custom[MultipleInputForm ++](Logo_optional=readFromFile, ButtonText_optional=code_block.suv, Inputs=list_create, Toggle=boolean, Width_optional=code_block_2, LabelWidth_optional=code_block_3)  # package Data-Shapes; Create a form with multiple inputs. see www.data-shapes.net for tutorials and infos!
removeNulls = Lists.Manage.RemoveNulls(Data=multipleinputform.User_Inputs)
selectmodelelements_data = Custom[SelectModelElements Data](ButtonText=code_block.but, CategoryFilter=removeNulls.Cleaned)  # package Data-Shapes; Creates a Revit element selection input for UI.MultipleInputForm++ . Check out www.data-shapes.net for more infos!
passthrough = Custom[Passthrough](passThrough=selectmodelelements_data, waitFor=multipleinputform.User_Inputs)  # package Clockwork for Dynamo 2.x; Forces a sequential order of execution. The node wired into the output of the Passthrough node will be executed *after* the node wired into the waitFor input (e.g. important for some Revit operations). The value of the passThrough input will be passed on to the node wired into the output port of the Passthrough node.
multipleinputform_2 = Custom[MultipleInputForm ++](Logo_optional=readFromFile, ButtonText_optional=code_block.ter, Inputs=passthrough, Toggle=boolean, Width_optional=code_block_2, LabelWidth_optional=code_block_3)
ꟿ_selectinrevit = Custom[ꟿ SelectInRevit](element=multipleinputform_2.User_Inputs)  # package spring nodes; Selects the input elements inside the Revit UI.
