# Dynamo graph 0NGF_script.dyn (Dynamo 2.18.1.5096)
# packages: Data-Shapes 2022.2.96

element_types = ElementTypes("BasePoint")
all_elements_of_type = ElementsOfType(element_type=element_types)
code_block = CodeBlock(e=all_elements_of_type) { DSCore.List.FilterByBoolMask(e,DSCore.String.Contains(Revit.Elements.Element.GetParameterValueByName(e,"Catégorie").Name,"Point de base du projet",true))["in"]; }

# group: Input
file_path = Filename("..\..\..\..\..\BPA.png")
fromPath = FileObject(path=file_path)  # "File.FromPath"
readFromFile = Image.ReadFromFile(file=fromPath)
code_block_2 = CodeBlock { "Point Base du Projet"; "Terminer"; }
code_block_3 = CodeBlock { "Niveau 0,00 NGF"; }
textbox_data = Custom[TextBox Data](InputName=code_block_3)  # package Data-Shapes; Create Data for TextBox input in UI.MultipleInputForm ++ . Check out www.data-shapes.net for more informations
inputgroup_data = Custom[InputGroup Data](GroupTitle=code_block_2.out0, Inputs=textbox_data)  # package Data-Shapes; Creates a group of inputs for UI.MultipleInputForm ++ . Check out www.data-shapes.net for more infos !
boolean = BoolSelector(true)
multipleinputform = Custom[MultipleInputForm ++](Logo_optional=readFromFile, ButtonText_optional=code_block_2.out1, Inputs=inputgroup_data, Toggle=boolean)  # package Data-Shapes; Create a form with multiple inputs. see www.data-shapes.net for tutorials and infos!
code_block_4 = CodeBlock(x=multipleinputform.User_Inputs) { x[0]; }

code_block_5 = CodeBlock(x=code_block_4)
# ---------- code_block_5.designscript (4 lines) ----------
nv=	DSCore.String.ToNumber(x);

//niveau
b=	nv*100;
# ----------------------------------------
code_block_6 = CodeBlock(e=code_block, nv=code_block_5.b) { Revit.Elements.Element.SetParameterByName(e,"Elév.",nv); }
element_types_2 = ElementTypes("Level")
all_elements_of_type_2 = ElementsOfType(element_type=element_types_2)
code_block_7 = CodeBlock(x=all_elements_of_type_2) { DSCore.List.FilterByBoolMask(x,x.Name=="TOPOGRAPHIE" ? true:false); }
code_block_8 = CodeBlock(x=code_block_7) { x["out"]; }
code_block_9 = CodeBlock(e=code_block_8) { Revit.Elements.Element.GetParameterValueByName(e,"Elévation"); }
code_block_10 = CodeBlock(e=code_block_8, nv=code_block_5.b, elv=code_block_9) { Revit.Elements.Element.SetParameterByName(e,"Elévation",nv+elv); }
code_block_11 = CodeBlock(x=code_block_7) { x["in"]; }
code_block_12 = CodeBlock(e=code_block_11) { Revit.Elements.Element.GetParameterValueByName(e,"Elévation"); }
code_block_13 = CodeBlock(e=all_elements_of_type_2, nv=code_block_5.nv) { Revit.Elements.Element.SetParameterByName(e,"POINT BASE",nv); }
code_block_14 = CodeBlock(e=all_elements_of_type_2) { Revit.Elements.Element.SetParameterByName(Revit.Elements.Element.GetParameterValueByName(e,"Famille et type"),"Référence de l'élévation",0); }
