# Dynamo graph Porte Palière_script.dyn (Dynamo 2.10.1.3976)
# packages: Clockwork for Dynamo 2.x 2.3.0

python_script = Python()  # IronPython2
# ---------- python_script.python (69 lines) ----------
import sys
import clr
import System
clr.AddReference('Microsoft.VisualBasic')
import Microsoft.VisualBasic
clr.AddReference('ProtoGeometry')
from Autodesk.DesignScript.Geometry import *
import Autodesk.DesignScript.Geometry as adg

clr.AddReference('RevitAPI')
import Autodesk
from Autodesk.Revit.DB import *
import Autodesk.Revit.DB as DB

#import Revit APIUI namespace
clr.AddReference('RevitAPIUI')
from Autodesk.Revit.UI import *
from Autodesk.Revit.UI.Selection import *


clr.AddReference('RevitServices')
import RevitServices
from RevitServices.Persistence import DocumentManager
from RevitServices.Transactions import TransactionManager
doc = DocumentManager.Instance.CurrentDBDocument
uiapp = DocumentManager.Instance.CurrentUIApplication
uidoc = uiapp.ActiveUIDocument

clr.AddReference('RevitNodes')
import Revit
clr.ImportExtensions(Revit.GeometryConversion)
clr.ImportExtensions(Revit.Elements)

TransactionManager.Instance.EnsureInTransaction(doc)
out = []

dialog = TaskDialog("BPA ARCHITECTURE")

dialog.MainInstruction = 'N° Local Pour Porte Palière'

verticale = dialog.AddCommandLink(TaskDialogCommandLinkId.CommandLink1, "Vieux Gabarit")
horizontale = dialog.AddCommandLink(TaskDialogCommandLinkId.CommandLink2, "Nouveau Gabarit")

dialog.CommonButtons = TaskDialogCommonButtons.Close;
dialog.DefaultButton = TaskDialogResult.Close;
dialog.MainIcon = TaskDialogIcon.TaskDialogIconWarning;
dialog.EnableMarqueeProgressBar = True;
dialog.FooterText = "Si vous avez une probléme, vous pouvez parler avec 'Durmus', tout simpelement"


a = dialog.Show()
b = a.ToString()


if b == "CommandLink1" :
	locPt = True
		
	out.append(locPt)
		
elif b == "CommandLink2"  :
	locPt = False
		
	out.append(locPt)
	

doc.Regenerate()
TransactionManager.Instance.TransactionTaskDone()

OUT = out
# ----------------------------------------
python_script_2 = Python()  # IronPython2
# ---------- python_script_2.python (38 lines) ----------
import clr
clr.AddReference('ProtoGeometry')
from Autodesk.DesignScript.Geometry import *

# Import ToDSType(bool) extension method
clr.AddReference("RevitNodes")
import Revit
clr.ImportExtensions(Revit.Elements)

# Import DocumentManager and TransactionManager
clr.AddReference("RevitServices")
import RevitServices
from RevitServices.Persistence import DocumentManager
from RevitServices.Transactions import TransactionManager

from System.Collections.Generic import *

# Import RevitAPI
clr.AddReference("RevitAPI")
import Autodesk
from Autodesk.Revit.DB import *

doc = DocumentManager.Instance.CurrentDBDocument
uiapp = DocumentManager.Instance.CurrentUIApplication
app = uiapp.Application

family = FilteredElementCollector(doc).OfClass(Family).ToElements()
famn = []
d = []
for i in family:
	famn.append(i.Name.ToString())
	
	for f in famn :
		if f == "ARC_PO_MIN_1O-Palière" :
			d.append(i)		
			

OUT = d
# ----------------------------------------
types = Family.Types(family=python_script_2)
byFamilyType = FamilyInstance.ByFamilyType(familyType=types)
code_block = CodeBlock(x=byFamilyType) { x[0]; }
code_block_2 = CodeBlock(x=code_block) { a = DSCore.List.IsEmpty(x@L2<1>); b=	DSCore.List.FilterByBoolMask(x,a)["out"]; }
python_script_3 = Python()  # IronPython2
# ---------- python_script_3.python (26 lines) ----------
import clr

clr.AddReference("RevitNodes")
import Revit
clr.ImportExtensions(Revit.Elements)
clr.ImportExtensions(Revit.GeometryConversion)

clr.AddReference("RevitServices")
import RevitServices
from RevitServices.Persistence import DocumentManager 

clr.AddReference("RevitAPI")
import Autodesk 
from Autodesk.Revit.DB import *

doc = DocumentManager.Instance.CurrentDBDocument
uiapp = DocumentManager.Instance.CurrentUIApplication
app = uiapp.Application

phaselist, namelist = [],[]

for phase in doc.Phases:
	phaselist.append(phase.ToDSType(True))
	namelist.append(phase.Name)
	
OUT = [phaselist, namelist]
# ----------------------------------------
code_block_3 = CodeBlock(x=python_script_3) { x[0][1]; }
rooms = Custom[Door.Rooms](door=code_block_2.b, phase=code_block_3, lacing=Longest)  # package Clockwork for Dynamo 2.x; Gets the rooms that are connected by a given door
code_block_4 = CodeBlock(a=python_script, e=rooms.toRoom, p=code_block_2.b)
# ---------- code_block_4.designscript (2 lines) ----------
c= a== true ? Revit.Elements.Element.GetParameterValueByName(e,"N° Logement / N° Local"):Revit.Elements.Element.GetParameterValueByName(e,"N° Local");
b= Revit.Elements.Element.SetParameterByName(p,"N° Logement",c);
# ----------------------------------------
