# Dynamo graph Placer_Porte_script.dyn (Dynamo 2.10.1.3976)
# packages: spring nodes 204.1.0, Genius Loci 2021.7.30, Clockwork for Dynamo 2.x 2.3.0, Rhythm 2021.7.3, Data-Shapes 2022.2.96

code_block = CodeBlock { "BPA ARCHITECTURE"; "Suivant"; }
categories = Categories("OST_Doors")
code_block_2 = CodeBlock { 150; 500; }
boolean = BoolSelector(false)
categories_2 = Categories("OST_Walls")

# group: Input
file_path = Filename("..\..\..\..\..\BPA.png")
code_block_3 = CodeBlock { cat=	"Categorie"; elem=	"Famille"; }
all_family_types_of_category = Custom[All Family Types Of Category](category=categories)  # package Clockwork for Dynamo 2.x; Gets all family types/symbols of a given category in the model.
code_block_4 = CodeBlock(e=all_family_types_of_category) { e.Name; }
listview_data = Custom[Listview Data](InputName=code_block_3.elem, Keys=code_block_4, Values=all_family_types_of_category, Height_optionnal=code_block_2.out1, ShowId_optionnal=boolean)  # package Data-Shapes; Create data for ListView input in UI.MultiInputForm ++ . Check out www.data-shapes.net for more infos.
passthrough = Custom[Passthrough](passThrough=listview_data, waitFor=code_block_4)  # package Clockwork for Dynamo 2.x; Forces a sequential order of execution. The node wired into the output of the Passthrough node will be executed *after* the node wired into the waitFor input (e.g. important for some Revit operations). The value of the passThrough input will be passed on to the node wired into the output port of the Passthrough node.
code_block_5 = CodeBlock { "Choisir Mur"; "Mur"; }
boolean_2 = BoolSelector(true)
selectmodelelements_data = Custom[SelectModelElements Data](InputName=code_block_5.out1, ButtonText=code_block_5.out0, CategoryFilter=categories_2, SelectSingleElement=boolean_2)  # package Data-Shapes; Creates a Revit element selection input for UI.MultipleInputForm++ . Check out www.data-shapes.net for more infos!
passthrough_2 = Custom[Passthrough](passThrough=selectmodelelements_data, waitFor=passthrough)
list_create = List.Create(item0=passthrough, item1=passthrough_2)

fromPath = FileObject(path=file_path)  # "File.FromPath"
readFromFile = Image.ReadFromFile(file=fromPath)

# group (continued): Input
multipleinputform = Custom[MultipleInputForm ++](Logo_optional=readFromFile, ButtonText_optional=code_block.out1, Inputs=list_create, Toggle=boolean_2, Width_optional=code_block_2.out1, LabelWidth_optional=code_block_2.out0)  # package Data-Shapes; Create a form with multiple inputs. see www.data-shapes.net for tutorials and infos!

code_block_6 = CodeBlock(x=multipleinputform.User_Inputs) { x[1]; }
code_block_7 = CodeBlock(x=multipleinputform.User_Inputs) { x[0]; }
element_locationcurve = Custom[Element LocationCurve](element=code_block_6)  # package Genius Loci; Gets the curve geometry from the element.
length = Curve.Length(curve=element_locationcurve)
code_block_8 = CodeBlock(x=length) { (x-10.5); }
ꟿ_number_tostring = Custom[ꟿ Number.ToString](num=code_block_8)  # package spring nodes; Converts the input number(s) to string. You can optionally limit the number of digits.
code_block_9 = CodeBlock(v=ꟿ_number_tostring) { "PO_" + v + "x204"; }
duplicate = Custom[FamilyType.Duplicate](elementType=code_block_7, name=code_block_9)  # package Clockwork for Dynamo 2.x; Duplicates a family type
code_block_10 = CodeBlock { "Largeur"; }
code_block_11 = CodeBlock(x=length) { (x-10.5); }
ʳʰʸᵗʰᵐ_elements = Rhythm.Revit.Elements.Elements.SetParameterByNameTypeOrInstance(element=duplicate, parameterName=code_block_10, value=code_block_11)
code_block_12 = CodeBlock { 0.5; }
pointAtParameter = Curve.PointAtParameter(curve=element_locationcurve, param=code_block_12)
ꟿ_familyinstance_byhostandpoint = Custom[ꟿ FamilyInstance.ByHostAndPoint](host=code_block_6, type=ʳʰʸᵗʰᵐ_elements, point=pointAtParameter)  # package spring nodes; Creates hosted family instances(doors/windows) at the specified points. You can feed either a single family type or a unique type for each instance.
