# Dynamo graph PDV-Mise en Page_script.dyn (Dynamo 2.18.1.5096)
# packages: archi-lab.net 2022.210.2522, Genius Loci 2021.7.30, Data-Shapes 2022.2.100, archi-lab.net 2022.212.2722, Rhythm 2022.1.5, Genius Loci 2022.3.9, Rhythm 2021.12.1, Crumple 2021.9.24, Data-Shapes 2023.2.111

code_block = CodeBlock { " "; }
view_type = ViewTypesUi("FloorPlan")
view_bytype = Custom[View ByType](viewType=view_type)  # package Genius Loci; Gets all views by type. For the View Template Type, the 3D View Templates will not be retrieved.

# group: Input
file_path = Filename("..\..\..\..\..\BPA.png")
fromPath = FileObject(path=file_path)  # "File.FromPath"
readFromFile = Image.ReadFromFile(file=fromPath)
code_block_2 = CodeBlock { "PDV-Mise En Page"; "Terminer"; }
code_block_3 = CodeBlock { "Gabarit de vue"; "Choisir une feuille"; }
viewtemplates = Custom[© ViewTemplates]()  # package Crumple; Returns all view templates in a document. Due to API/Dynamo limitations, 3D view templates are excluded from the list.
code_block_4 = CodeBlock(n=viewtemplates) { n.Name; }
dropdown_data = Custom[DropDown Data](InputName=code_block_3.out0, Keys=code_block_4, Values=viewtemplates)  # package Data-Shapes; Create data for DropDown input in UI.MultiInputForm ++ . Check out www.data-shapes.net for more infos.
categories = Categories("OST_Sheets")
all_elements_of_category = ElementsOfCategory(Category=categories)
code_block_5 = CodeBlock(n=all_elements_of_category)
# ---------- code_block_5.designscript (5 lines) ----------
a=	DSCore.List.GroupByKey(n,Revit.Elements.Element.GetParameterValueByName(n,"DOSSIER"));
b=	DSCore.String.Contains(a["unique keys"],"PDV",true);
c=	a["groups"];
d=	DSCore.List.FilterByBoolMask(c,b)["in"];
e=	Revit.Elements.Element.GetParameterValueByName(d,"Numéro de la feuille");
# ----------------------------------------
dropdown_data_2 = Custom[DropDown Data](InputName=code_block_3.out1, Keys=code_block_5.e, Values=code_block_5.d)
list_create = List.Create(item0=dropdown_data, item1=dropdown_data_2)
flatten = List.Flatten(list=list_create)
inputgroup_data = Custom[InputGroup Data](GroupTitle=code_block_2.out0, Inputs=flatten)  # package Data-Shapes; Creates a group of inputs for UI.MultipleInputForm ++ . Check out www.data-shapes.net for more infos !
boolean = BoolSelector(true)
multipleinputform = Custom[MultipleInputForm ++](Logo_optional=readFromFile, ButtonText_optional=code_block_2.out1, Inputs=inputgroup_data, Toggle=boolean)  # package Data-Shapes; Create a form with multiple inputs. see www.data-shapes.net for tutorials and infos!

code_block_6 = CodeBlock(x=multipleinputform.User_Inputs) { x[0]; x[1]; }
passThrough = Custom[PassThrough](passThrough=view_bytype, waitFor=code_block_6.out0)  # package archi-lab.net; Ripped this off from Clockwork. Sorry Andy.
code_block_7 = CodeBlock(x=passThrough)
# ---------- code_block_7.designscript (11 lines) ----------
a=		DSCore.List.FilterByBoolMask(x,DSCore.String.Contains(DSCore.String.FromObject(x),"PDV"))["in"];

//Prépare des plans
ploc= 	DSCore.String.Contains(a.Name,"PDV-Localisation");
pdv= 	DSCore.String.Contains(a.Name,"PDV_");
psyn= 	DSCore.String.Contains(a.Name,"PDV-SYN");

//Reorganise
loc=	DSCore.List.FilterByBoolMask(a,ploc)["in"];
dv=		DSCore.List.FilterByBoolMask(a,pdv)["in"];
syn=	DSCore.List.FilterByBoolMask(a,psyn)["in"];
# ----------------------------------------
view_type_2 = ViewTypesUi("Schedule")
view_bytype_2 = Custom[View ByType](viewType=view_type_2)
passThrough_2 = Custom[PassThrough](passThrough=view_bytype_2, waitFor=code_block_6.out0)
code_block_8 = CodeBlock(x=passThrough_2) { a=		DSCore.List.FilterByBoolMask(x,DSCore.String.Contains(Revit.Elements.Element.GetParameterValueByName(x,"Classement"),"PDV-Logement"))["in"]; }
code_block_9 = CodeBlock(n=code_block_7.dv, l=code_block_7.loc, nm=code_block_8)
# ---------- code_block_9.designscript (6 lines) ----------
pdv=	DSCore.List.Flatten(DSCore.String.Split(DSCore.String.Remove(n.Name,0,8),"_"));
pdvl=	DSCore.List.Flatten(DSCore.String.Remove(l.Name,0,21));

//classer
cpdv=	DSCore.List.GetItemAtIndex(n,DSCore.List.IndexOf(pdv,pdvl));
cnm=	DSCore.List.GetItemAtIndex(nm,DSCore.List.IndexOf(nm.Name,pdvl));
# ----------------------------------------
sheetTitleblock = Custom[SheetTitleblock](sheet=code_block_6.out1)  # package Data-Shapes; Get the TitleBlock family type from a sheet
create_Sheet = Custom[Create_Sheet](SheetName=code_block, SheetNumbers=code_block_9.pdv, TitleBlock=sheetTitleblock, lacing=Longest)
code_block_10 = CodeBlock(x=create_Sheet) { Revit.Elements.Element.SetParameterByName(x,"DOSSIER","PDV"); }
removeViewTemplate = archilab.Revit.Views.Views.RemoveViewTemplate(view=code_block_7.loc)
code_block_11 = CodeBlock(x=code_block_9.pdv) { DSCore.List.Count(x); }
cycle = List.Cycle(list=code_block_6.out1, amount=code_block_11)
ʳʰʸᵗʰᵐ_sheet = Rhythm.Revit.Elements.Sheet.GetViewportsAndViews(sheet=cycle)
ʳʰʸᵗʰᵐ_viewport_locationdata = Rhythm.Revit.Elements.Viewport.LocationData(viewport=ʳʰʸᵗʰᵐ_sheet.viewports)
lastItem = List.LastItem(list=ʳʰʸᵗʰᵐ_viewport_locationdata.boxCenter@L2)

# group: Localisation_PDV_Loc
bySheetViewLocation = Viewport.BySheetViewLocation(sheet=code_block_10, view=removeViewTemplate, location=lastItem)

outline = archilab.Revit.Views.Views.Outline(view=code_block_10)
setViewTemplate = archilab.Revit.Views.Views.SetViewTemplate(view=code_block_9.cpdv, viewTemplate=code_block_6.out0)
code_block_12 = CodeBlock(n=setViewTemplate)
# ---------- code_block_12.designscript (7 lines) ----------
// Filter Vue
a=		DSCore.String.Contains(n.Name,"PDV_",true);
PDV=	DSCore.List.FilterByBoolMask(n,a)["in"];

//Processing sheets
number= "PDV_" + (1..DSCore.List.Count(name));
name=	DSCore.String.Replace(PDV.Name,"PDV_","");
# ----------------------------------------
firstItem = List.FirstItem(list=ʳʰʸᵗʰᵐ_viewport_locationdata.boxCenter@L2)

# group: Localisation_PDV
bySheetViewLocation_2 = Viewport.BySheetViewLocation(sheet=code_block_10, view=code_block_12.PDV, location=firstItem)

passThrough_3 = Custom[PassThrough](passThrough=outline, waitFor=bySheetViewLocation_2)
passThrough_4 = Custom[PassThrough](passThrough=code_block_10, waitFor=bySheetViewLocation_2)
sheet_size = Custom[Sheet Size](sheet=passThrough_4)  # package Genius Loci; Returns the width and the height of the given sheet.
code_block_13 = CodeBlock(a=passThrough_3, w=sheet_size.Width, h=sheet_size.Height)
# ---------- code_block_13.designscript (6 lines) ----------
b=	Autodesk.Surface.ByPatch(a);
//Center
c=	Autodesk.CoordinateSystem.ByOriginVectors(Autodesk.Surface.PointAtParameter(b,0.4,0.55),Vector.XAxis(),Vector.YAxis(),Vector.ZAxis());

//rectangle
rec=	Rectangle.ByWidthLength(c,DSCore.String.ToNumber(w)/1.3,DSCore.String.ToNumber(h)/1);
# ----------------------------------------
code_block_14 = CodeBlock(x=code_block_13.rec) { x; }
code_block_15 = CodeBlock(rec=code_block_14)
# ---------- code_block_15.designscript (10 lines) ----------
a=	Autodesk.Geometry.Explode(rec);
b=	DSCore.List.FilterByBoolMask(a,Vector.IsParallel(Line.Direction(a),Vector.XAxis()));

//Verticale
v1=	DSCore.List.FirstItem(b["out"]@L2<1>);
v2=	Autodesk.Curve.Length(v1);

//horizontale
h1=	DSCore.List.FirstItem(b["in"]@L2<1>);
h2=	Autodesk.Curve.Length(h1);
# ----------------------------------------
code_block_16 = CodeBlock(x=code_block_15.v2) { x; }
ʳʰʸᵗʰᵐ_sheet_2 = Rhythm.Revit.Elements.Sheet.GetViewportsAndViews(sheet=passThrough_4)
code_block_17 = CodeBlock(vue=ʳʰʸᵗʰᵐ_sheet_2.views, vipo=ʳʰʸᵗʰᵐ_sheet_2.viewports)
# ---------- code_block_17.designscript (6 lines) ----------
//Vue
a=	DSCore.String.Contains(vue.Name,"PDV_");
af=	DSCore.List.FilterByBoolMask(vue,a)["in"];
//Viewport

b=	PolyCurve.ByJoinedCurves(Rhythm.Viewport.LocationData(DSCore.List.FilterByBoolMask(vipo,a)["in"])["boxOutline"]);
# ----------------------------------------
code_block_18 = CodeBlock(x=code_block_17.b) { x; }
code_block_19 = CodeBlock(rec=code_block_18)
# ---------- code_block_19.designscript (11 lines) ----------
a=	Autodesk.Geometry.Explode(rec);
b=	DSCore.List.FilterByBoolMask(a,Vector.IsParallel(Line.Direction(a),Vector.XAxis()));

//Verticale
v1=	DSCore.List.FirstItem(b["out"]@L2<1>);
v2=	Autodesk.Curve.Length(v1);


//horizontale
h1=	DSCore.List.FirstItem(b["in"]@L2<1>);
h2=	Autodesk.Curve.Length(h1);
# ----------------------------------------
code_block_20 = CodeBlock(x=code_block_19.v2) { x; }
div = code_block_16 / code_block_20
div_2 = code_block_15.h2 / code_block_19.h2
list_create_2 = List.Create(item0=div, item1=div_2)
transpose = List.Transpose(lists=list_create_2)
minimumItem = List.MinimumItem()  # unwired: list
minimumItemByKey = List.MinimumItemByKey(list=transpose@L2, keyFunction=minimumItem)
code_block_21 = CodeBlock(x=minimumItemByKey) { (100/x); }
floor = Math.Floor(number=code_block_21)
count = List.Count(list=floor)
progressDynamoı = Custom[ProgressDynamoı](Processing=count)
code_block_22 = CodeBlock(x=minimumItemByKey) { 1-x; }
code_block_23 = CodeBlock(vie=setViewTemplate) { Revit.Elements.Element.SetParameterByName(vie,"Echelle de la vue",50); }
code_block_24 = CodeBlock(vie=removeViewTemplate) { Revit.Elements.Element.SetParameterByName(vie,"Echelle de la vue",1000); }
code_block_25 = CodeBlock(ech=floor, vie=code_block_17.af)
# ---------- code_block_25.designscript (5 lines) ----------
a=	ech >=40 && ech<=93 ?50:
	ech >=94 && ech<=110 ?75:100;

//Contrôle
con= Revit.Elements.Element.SetParameterByName(vie,"Echelle de la vue",a);
# ----------------------------------------
flatten_2 = List.Flatten(list=code_block_25.con)
end = Revit.Transaction.Transaction.End(input=flatten_2)
ʳʰʸᵗʰᵐ_view_viewport = Rhythm.Revit.Views.View.Viewport(view=end)
passThrough_5 = Custom[PassThrough](passThrough=firstItem, waitFor=end)
code_block_26 = CodeBlock { 1; }
chop = List.Chop(list=passThrough_5, lengths=code_block_26)
setBoxCenter = Rhythm.Revit.Elements.Viewport.SetBoxCenter(viewport=ʳʰʸᵗʰᵐ_view_viewport, point=chop)
code_block_27 = CodeBlock(x=ʳʰʸᵗʰᵐ_sheet.schedules) { x; }
flatten_3 = List.Flatten(list=code_block_27)
viewportLocation = Custom[ViewportLocation++](Viewport_Or_ScheduleSheetIndtance=flatten_3)  # package Data-Shapes; Gets the location point of a viewport or a ScheduleSheetInstance
bySheetScheduleLocation = ScheduleOnSheet.BySheetScheduleLocation(sheet=code_block_10, scheduleView=code_block_9.cnm, location=viewportLocation, lacing=Longest)
