# Dynamo graph Carnet-MurRiedau-Prépare_script.dyn (Dynamo 2.18.1.5096)
# packages: spring nodes 204.1.0, archi-lab.net 2022.210.2522, Clockwork for Dynamo 2.x 2.3.0, archi-lab.net 2022.212.2821, Data-Shapes 2022.2.100, Rhythm 2021.7.3, Genius Loci 2021.11.10, archi-lab.net 2022.212.2722, Genius Loci 2022.3.9, Orchid 2.18.1.6034

file_path = Filename("..\..\..\..\..\BPA.png")
fromPath = FileObject(path=file_path)  # "File.FromPath"
readFromFile = Image.ReadFromFile(file=fromPath)
code_block = CodeBlock { "Suivant"; "Terminer"; }
code_block_2 = CodeBlock { "Fichier Liens"; ["OUI","NON"]; }
radiobuttons_data = Custom[RadioButtons Data](InputName=code_block_2.out0, Keys=code_block_2.out1, Values=code_block_2.out1)  # package Data-Shapes; Create radio buttons input for UI.MultipleInputForm ++ .
boolean = BoolSelector(true)
multipleinputform = Custom[MultipleInputForm ++](Logo_optional=readFromFile, ButtonText_optional=code_block.out0, Inputs=radiobuttons_data, Toggle=boolean)  # package Data-Shapes; Create a form with multiple inputs. see www.data-shapes.net for tutorials and infos!
code_block_3 = CodeBlock(x=multipleinputform.User_Inputs) { x[0]; }
code_block_4 = CodeBlock(x=code_block_3) { x=="OUI" ? true:false; }

# group: Input
categories = Categories("OST_Walls")
getDocuments = archilab.Revit.Selection.Select.GetDocuments()
prefix = StringInput("Carnet Mur-Rideau")  # graph input
décaler = StringInput("3")
distance = StringInput("100")  # graph input
reflesh = BoolSelector(true)  # graph input

code_block_5 = CodeBlock { "Choisir de Fichier"; "Choisir de Niveau"; }
dropdown_data = Custom[DropDown Data](InputName=code_block_5.out0, Keys=getDocuments.Link_Name, Values=getDocuments.Link_Instance)  # package Data-Shapes; Create data for DropDown input in UI.MultiInputForm ++ . Check out www.data-shapes.net for more infos.
element_types = ElementTypes("Level")
all_elements_of_type = ElementsOfType(element_type=element_types)
name = Level.Name(level=all_elements_of_type)
dropdown_data_2 = Custom[DropDown Data](InputName=code_block_5.out1, Keys=name, Values=all_elements_of_type)
list_create = List.Create(item0=dropdown_data, item1=dropdown_data_2)
multipleinputform_2 = Custom[MultipleInputForm ++](Logo_optional=readFromFile, ButtonText_optional=code_block.out1, Inputs=list_create, Toggle=code_block_4)
code_block_6 = CodeBlock(x=multipleinputform_2.User_Inputs) { x[0]; x[1]; }
not_ = Not(x=code_block_4)
multipleinputform_3 = Custom[MultipleInputForm ++](Logo_optional=readFromFile, ButtonText_optional=code_block.out1, Inputs=dropdown_data_2, Toggle=not_)
code_block_7 = CodeBlock(x=multipleinputform_3.User_Inputs) { x[0]; }
IF = Python(IN[0]=code_block_4, IN[1]=code_block_6.out1, IN[2]=code_block_7)  # IronPython2
# ---------- IF.python (19 lines) ----------
import clr
clr.AddReference('ProtoGeometry')
from Autodesk.DesignScript.Geometry import *
#The inputs to this node will be stored as a list in the IN variables.

OUT = []

def tolist(obj):
	if hasattr(obj,"__iter__"):
		return obj
	else:
		return [obj]

if IN[0] == True:
	for x in tolist(IN[1]):
		OUT.append(x)
else:
	for x in tolist(IN[2]):
		OUT.append(x)
# ----------------------------------------

# group: Mur-Rideau-Filters
all_elements_of_category = Custom[All Elements Of Category+](category=categories, toggle=boolean, docOrRevitLinkInstance=code_block_6.out0)  # package Clockwork for Dynamo 2.x; Gets all placed elements of a given category in the model. Unlike the OOTB node it also supports linked models and a few more special categories (e.g. Legend Components).
all_elements_of_category_2 = ElementsOfCategory(Category=categories)
IF_2 = Python(IN[0]=code_block_4, IN[1]=all_elements_of_category, IN[2]=all_elements_of_category_2)  # IronPython2; same code as IF
flatten = List.Flatten(list=IF_2)
ꟿ_wall_iscurtainwall = Custom[ꟿ Wall.IsCurtainWall](wall=flatten)  # package spring nodes; Returns true if the wall is a curtain wall.
filterByBoolMask = List.FilterByBoolMask(list=flatten, mask=ꟿ_wall_iscurtainwall)
type = archilab.Revit.Elements.Elements.Type(element=filterByBoolMask.in)
groupByKey = List.GroupByKey(list=filterByBoolMask.in, keys=type)
flatten_2 = List.Flatten(list=groupByKey.groups)
element_level = Custom[Element Level](element=flatten_2)  # package Genius Loci; Gets an element's level. Based on a Clockwork's node
groupByKey_2 = List.GroupByKey(list=flatten_2, keys=element_level)
code_block_8 = CodeBlock(x=groupByKey_2.uniqueKeys, a=IF, e=groupByKey_2.groups) { niv=	DSCore.String.Contains(x.Name,a.Name,true); nive=	DSCore.List.Flatten(DSCore.List.FilterByBoolMask(e,niv)["in"]); }
ꟿ_document_activeview = Custom[ꟿ Document.ActiveView](refresh=boolean)  # package spring nodes; Selects the current document's active view. Supports more view types than the built-in option. Will be depreciated once the bult in node works with all plan types.
categories_2 = Categories("OST_Views")
all_elements_of_category_3 = ElementsOfCategory(Category=categories_2)
code_block_9 = CodeBlock(x=all_elements_of_category_3, a=prefix)
# ---------- code_block_9.designscript (4 lines) ----------
niv=	DSCore.String.Contains(x.Name,a,true);
ni=		niv ==null ? false: niv;
nive=	DSCore.List.Flatten(DSCore.List.FilterByBoolMask(x,ni)["in"]);
cc=		DSCore.List.Count(nive)/2;
# ----------------------------------------
toNumber = String.ToNumber(string=décaler)
toNumber_2 = String.ToNumber(string=distance)

# group: Elevation - Processing
code_block_10 = CodeBlock(n=code_block_8.nive) { n.Name; }
getLocation = Element.GetLocation(element=code_block_8.nive)
code_block_11 = CodeBlock { 0; }
offset = Curve.Offset(curve=getLocation, distance=code_block_11)
startPoint = Curve.StartPoint(curve=offset)
code_block_12 = CodeBlock { -10; }
offset_2 = Curve.Offset(curve=offset, distance=code_block_12)
startPoint_2 = Curve.StartPoint(curve=offset_2)
endPoint = Curve.EndPoint(curve=offset_2)
endPoint_2 = Curve.EndPoint(curve=offset)
list_create_2 = List.Create(item0=startPoint, item1=startPoint_2, item2=endPoint, item3=endPoint_2)
transpose = List.Transpose(lists=list_create_2)
passthrough = Custom[Passthrough](passThrough=code_block_9.cc, waitFor=code_block_8.nive)  # package Clockwork for Dynamo 2.x; Forces a sequential order of execution. The node wired into the output of the Passthrough node will be executed *after* the node wired into the waitFor input (e.g. important for some Revit operations). The value of the passThrough input will be passed on to the node wired into the output port of the Passthrough node.
code_block_13 = CodeBlock(x=code_block_8.nive) { DSCore.List.Count(x); }
code_block_14 = CodeBlock(n=prefix, x=passthrough, a=code_block_13) { n+" "+DSCore.String.FromObject(x+1..x+a); }
boolean_2 = BoolSelector(true)  # graph input
byPoints = PolyCurve.ByPoints(points=transpose, connectLastToFirst=boolean_2)
offset_3 = Curve.Offset(curve=byPoints, distance=toNumber)
explode = Geometry.Explode(geometry=offset_3)
startPoint_3 = Curve.StartPoint(curve=getLocation)
endPoint_3 = Curve.EndPoint(curve=getLocation)
create = List.Create(item0=startPoint_3, item1=endPoint_3)
transpose_2 = List.Transpose(lists=create)
code_block_15 = CodeBlock { 0.5; }
coordinateSystemAtParameter = Curve.CoordinateSystemAtParameter(curve=getLocation, param=code_block_15)
XAxis = CoordinateSystem.XAxis(coordinateSystem=coordinateSystemAtParameter)
translate = Geometry.Translate(geometry=transpose_2, direction=XAxis, distance=toNumber_2)
transpose_3 = List.Transpose(lists=translate)
firstItem = List.FirstItem(list=transpose_3)
lastItem = List.LastItem(list=transpose_3)
byStartPointEndPoint = Line.ByStartPointEndPoint(startPoint=firstItem, endPoint=lastItem)
code_block_16 = CodeBlock { 0; }
extendEnd = Curve.ExtendEnd(curve=byStartPointEndPoint, distance=code_block_16)
extendStart = Curve.ExtendStart(curve=extendEnd, distance=code_block_16)
startPoint_4 = Curve.StartPoint(curve=extendStart)
endPoint_4 = Curve.EndPoint(curve=extendStart)
create_2 = List.Create(item0=startPoint_4, item1=endPoint_4)
transpose_4 = List.Transpose(lists=create_2)
ZAxis = Vector.ZAxis()
code_block_17 = CodeBlock(e=code_block_8.nive) { Revit.Elements.Element.GetParameterValueByName(e,"Décalage inférieur"); }
translate_2 = Geometry.Translate(geometry=transpose_4, direction=ZAxis, distance=code_block_17)
transpose_5 = List.Transpose(lists=translate_2)
lastItem_2 = List.LastItem(list=transpose_5)
code_block_18 = CodeBlock(e=code_block_8.nive) { Revit.Elements.Element.GetParameterValueByName(e,"Hauteur non contrainte"); }
translate_3 = Geometry.Translate(geometry=transpose_4, direction=ZAxis, distance=code_block_18)
transpose_6 = List.Transpose(lists=translate_3)
lastItem_3 = List.LastItem(list=transpose_6)
firstItem_2 = List.FirstItem(list=transpose_6)
firstItem_3 = List.FirstItem(list=transpose_5)
create_3 = List.Create(item0=lastItem_2, item1=lastItem_3, item2=firstItem_2, item3=firstItem_3)
transpose_7 = List.Transpose(lists=create_3)
byPoints_2 = PolyCurve.ByPoints(points=transpose_7, connectLastToFirst=boolean_2)
offset_4 = Curve.Offset(curve=byPoints_2, distance=toNumber)
explode_2 = Geometry.Explode(geometry=offset_4)
byCartesianCoordinates = Point.ByCartesianCoordinates(coordinateSystem=coordinateSystemAtParameter)
orientation = Custom[Wall.Orientation](wall=code_block_8.nive)  # package Clockwork for Dynamo 2.x; Gets the orientation of a given wall instance (normal of the exterior face of the wall). Will *not* work for walls hosted on mass faces or in-place walls.
translate_4 = Geometry.Translate(geometry=byCartesianCoordinates, direction=orientation, distance=toNumber_2)

# group: Plan_toRVT
view_family_types = ViewFamilyType("Plan Etage")
byCornerPoints = Rectangle.ByCornerPoints(points=transpose)
createCallout = archilab.Revit.Views.Views.CreateCallout(view=ꟿ_document_activeview, viewFamilyType=view_family_types, extents=byCornerPoints)
code_block_19 = CodeBlock(x=code_block_14) { x; }
code_block_20 = CodeBlock(e=createCallout, n=code_block_19)
# ---------- code_block_20.designscript (2 lines) ----------
a=	DSCore.List.Flatten(Revit.Elements.Element.SetParameterByName(e,"Zone cadrée visible",0));
b=	Revit.Elements.Element.SetParameterByName(a,"Nom de la vue",n);
# ----------------------------------------
ʳʰʸᵗʰᵐ_view_getcropregionelement = Rhythm.Revit.Views.View.GetCropRegionElement(view=code_block_20.b)
end = Revit.Transaction.Transaction.End(input=ʳʰʸᵗʰᵐ_view_getcropregionelement)
element_getrotation = Custom[Element GetRotation](element=code_block_8.nive)  # package Genius Loci; Calculates the rotation angle between the given element and the X axis. Works for point/ line/ sketch based elements and link instances.
element_setrotation = Custom[Element SetRotation](element=end, degree=element_getrotation)  # package Genius Loci; Set the angle of the element around its local Z-axis. (Same as the Rotate command in Revit)
passThrough = Custom[PassThrough](passThrough=createCallout, waitFor=element_setrotation)  # package archi-lab.net; Ripped this off from Clockwork. Sorry Andy.
setCropRegion = Custom[SetCropRegion](view=passThrough, CurvesAsList=explode)  # package Data-Shapes; Sets the crop region of a view to a closed polycurve.

# group: Elevation_toRVT
createElevationPoints = Custom[CreateElevationPoints](cropcurves=explode_2@L2, locations=translate_4, modelpoints=byCartesianCoordinates, bool=reflesh, lacing=Longest)
code_block_21 = CodeBlock(e=createElevationPoints, v=code_block_14)
# ---------- code_block_21.designscript (2 lines) ----------
a=	Revit.Elements.Element.SetParameterByName(e,"Nom de la vue",DSCore.List.Flatten(v));
b=	Revit.Elements.Element.SetParameterByName(a,"Zone cadrée visible",0);
# ----------------------------------------

code_block_22 = CodeBlock(e=code_block_21.b)
# ---------- code_block_22.designscript (2 lines) ----------
a=	Revit.Elements.Element.SetParameterByName(e,"Classement","Carnet_MEX");
b=	Revit.Elements.Element.SetParameterByName(e,"Classement Mise en Page","Mur-Rideaux");
# ----------------------------------------
code_block_23 = CodeBlock(e=createCallout)  # same code as code_block_22
code_block_24 = CodeBlock(a=createCallout) { b=	Revit.Elements.Element.SetParameterByName(a,"Echelle de la vue",50); }
code_block_25 = CodeBlock(a=createElevationPoints) { b=	Revit.Elements.Element.SetParameterByName(a,"Echelle de la vue",50); }
