# Dynamo graph Pièces Programme_script.dyn (Dynamo 2.19.3.6394)
# packages: Clockwork for Dynamo 2.x 2.3.0, spring nodes 204.1.0, LunchBox for Dynamo 2018.7.7, Data-Shapes 2024.2.113, BumbleBee 2021.25.3, spring nodes 210.1.1, archi-lab.net 2024.217.1024, Genius Loci 2023.7.13, Clockwork for Dynamo 2.x 2.6.0

# group: Interface
file_path = Filename("..\..\..\..\..\BPA.png")
fromPath = FileObject(path=file_path)  # "File.FromPath"
readFromFile = Image.ReadFromFile(file=fromPath)
code_block = CodeBlock { "BPA Architecture"; "Pièces de Fichier Excel"; "Choisir Fichier Excel"; "Suivant"; "Terminer"; }
boolean = BoolSelector(true)
filepath_data = Custom[FilePath Data](ButtonText=code_block.out2)  # package Data-Shapes; Create filepath input for UI.MultipleInputForm ++ . Check out www.data-shapes.net for more infos !
inputgroup_data = Custom[InputGroup Data](GroupTitle=code_block.out1, Inputs=filepath_data)  # package Data-Shapes; Creates a group of inputs for UI.MultipleInputForm ++ . Check out www.data-shapes.net for more infos !
multipleinputform = Custom[MultipleInputForm ++](Logo_optional=readFromFile, ButtonText_optional=code_block.out3, Inputs=inputgroup_data, Toggle=boolean)  # package Data-Shapes; Create a form with multiple inputs. see www.data-shapes.net for tutorials and infos!

code_block_2 = CodeBlock(x=multipleinputform.User_Inputs) { x[0]; }

# group: Workset
boolean_2 = BoolSelector(false)
fileName = FileSystem.FileName(path=code_block_2, withExtension=boolean_2)
code_block_3 = CodeBlock { "Choisir de Nom de la Feuille"; }
python_script = Python(IN[0]=code_block_2)  # IronPython2
# ---------- python_script.python (19 lines) ----------
import clr
clr.AddReference('DynamoRevitDS')
import Dynamo
import sys
pyt_path = r'C:\Program Files (x86)\IronPython 2.7\Lib'
sys.path.append(pyt_path)
clr.AddReference('System')
from System import Guid
clr.AddReferenceByName('Microsoft.Office.Interop.Excel, Version=11.0.0.0, Culture=neutral, PublicKeyToken=71e9bce111e9429c')
from Microsoft.Office.Interop import Excel
ex = Excel.ApplicationClass()
ex.Visible = False
ex.DisplayAlerts = False
workbk = ex.Workbooks.Open(IN[0])
worksheets = workbk.Worksheets
wsnms = [w.Name for w in worksheets]
workbk.Close()
ex.Quit()
OUT = wsnms
# ----------------------------------------
dropdown_data = Custom[DropDown Data](InputName=code_block_3, Keys=python_script, Values=python_script)  # package Data-Shapes; Create data for DropDown input in UI.MultiInputForm ++ . Check out www.data-shapes.net for more infos.
inputgroup_data_2 = Custom[InputGroup Data](GroupTitle=fileName, Inputs=dropdown_data)

code_block_4 = CodeBlock(a=boolean, b=inputgroup_data_2) { [a,b][0]; }

# group (continued): Workset
multipleinputform_2 = Custom[MultipleInputForm ++](Logo_optional=readFromFile, ButtonText_optional=code_block.out4, Inputs=inputgroup_data_2, Toggle=code_block_4)

code_block_5 = CodeBlock(x=multipleinputform_2.User_Inputs) { x[0]; }

# group: DataTable
read_excel = Custom[Read Excel](filePath=code_block_2, runIt=boolean, sheetName=code_block_5)  # package BumbleBee; This node will read an excel file. You can read an entore sheet contents, read from specific origin cell, read only specific range, or do all of the former for multiple sheets at the same time.
code_block_6 = CodeBlock(x=read_excel) { x; }

code_block_7 = CodeBlock(a=boolean, b=code_block_6) { [a,b][0]; }

# group: Ligne
code_block_8 = CodeBlock { "Choisir une ligne pour positionner des pièces"; "Choisir de Ligne"; }
categories = Categories("OST_Lines")
code_block_9 = CodeBlock { true; }
selectmodelelements_data = Custom[SelectModelElements Data](InputName=code_block_8.out0, ButtonText=code_block_8.out1, CategoryFilter=categories, SelectSingleElement=code_block_9)  # package Data-Shapes; Creates a Revit element selection input for UI.MultipleInputForm++ . Check out www.data-shapes.net for more infos!
multipleinputform_3 = Custom[MultipleInputForm ++](Logo_optional=readFromFile, ButtonText_optional=code_block.out4, Inputs=selectmodelelements_data, Toggle=code_block_7)
code_block_10 = CodeBlock(x=multipleinputform_3.User_Inputs) { x[0]; }

# group: Liste de Parametre
deconstruct = List.Deconstruct(list=code_block_6)
transpose = List.Transpose(lists=deconstruct.rest)

# group: Liste de Parametre > List de Parametre
LIST = CodeBlock(x=deconstruct.first, v=transpose)
# ---------- LIST.designscript (4 lines) ----------
k =	x=="Surface Extérieure" ||x=="Nombre de Pièces" || x=="Surface" || x=="Nom" || x=="Dimension en metre" || x=="Service" ? true:false;
//ParamList
param = DSCore.List.FilterByBoolMask(v,k)["out"];
key = DSCore.List.FilterByBoolMask(x,k)["out"];
# ----------------------------------------
ꟿ_dictionary_bykeysvalues = Custom[ꟿ Dictionary.ByKeysValues](keys=LIST.key, values=LIST.param, searchKeys=LIST.key)  # package spring nodes; Dictionaries are an incredibly powerful tool for making associative sets between two equal length lists. The first list must be of unique strings (or numbers) and will be the key and the second list will be the matching values (it can be made up of geometry, elements, even other lists) The search keys list will provide the corresponding value to the input key.
removeNulls = Lists.Manage.RemoveNulls(Data=ꟿ_dictionary_bykeysvalues)

# group: Liste de Parametre > Reserve
LIST_2 = CodeBlock(v=transpose, k=LIST.k, x=deconstruct.first)
# ---------- LIST_2.designscript (3 lines) ----------
//List du Résérve
param = DSCore.List.FilterByBoolMask(v,k)["in"];
key = DSCore.List.FilterByBoolMask(x,k)["in"];
# ----------------------------------------
ꟿ_dictionary_bykeysvalues_2 = Custom[ꟿ Dictionary.ByKeysValues](keys=LIST_2.key, values=LIST_2.param, searchKeys=LIST_2.key)
removeNulls_2 = Lists.Manage.RemoveNulls(Data=ꟿ_dictionary_bykeysvalues_2)
code_block_11 = CodeBlock(x=removeNulls_2.Cleaned) { x[0]; x[1]; x[2]; x[3]; x[4]; x[5]; }

# group: Surface
code_block_12 = CodeBlock(num=code_block_11.out3, ser=code_block_11.out0) { gr = DSCore.List.GroupByKey(num,ser)["groups"]; }

# group: Localitation des Pièces > Distance
ꟿ_list_maxindex = Custom[ꟿ List.MaxIndex](list=code_block_12)  # package spring nodes; Gets the maximum index of a list. Good for use with floating point values
code_block_13 = CodeBlock(s=ꟿ_list_maxindex.val) { distance	=	[s*30]; dec 		= DSCore.List.Deconstruct(distance[0])["rest"]; add 		= [DSCore.List.AddItemToFront(0,dec)]; }

# group: Service
code_block_14 = CodeBlock(num=code_block_11.out0, ser=code_block_11.out0) { g = DSCore.List.GroupByKey(num,ser); gr = g["groups"]; ky = g["unique keys"]; }

# group: Num
code_block_15 = CodeBlock(num=code_block_11.out2, ser=code_block_11.out0) { gr = DSCore.List.GroupByKey(num,ser)["groups"]; }

# group: Dimension
code_block_16 = CodeBlock(num=code_block_11.out5, ser=code_block_11.out0) { gr = DSCore.List.GroupByKey(num,ser)["groups"]; }

# group: Nom
code_block_17 = CodeBlock(num=code_block_11.out1, ser=code_block_11.out0) { gr = DSCore.List.GroupByKey(num,ser)["groups"]; }

# group: Surface Extérieur
code_block_18 = CodeBlock(num=code_block_11.out4, ser=code_block_11.out0) { gr = DSCore.List.GroupByKey(num,ser)["groups"]; }

code_block_19 = CodeBlock(x=code_block_18) { x=="non" || "Non" ? false:true; }
code_block_20 = CodeBlock { 255; }

# group (continued): Liste de Parametre > List de Parametre
code_block_21 = CodeBlock(num=removeNulls.Cleaned, ser=code_block_11.out0) { gr = DSCore.List.GroupByKey(num@L2<1>,ser)["groups"]; }

# group: Cycle de Parametre
flatten = List.Flatten()  # unwired: list
map = List.Map(list=code_block_21, function=flatten)
code_block_22 = CodeBlock(num=code_block_15, lis=map, surr=map)
# ---------- code_block_22.designscript (4 lines) ----------
numm = DSCore.List.Flatten(num);
cont = DSCore.List.Cycle([numm],DSCore.List.Count(lis));
cycle = DSCore.List.Cycle(surr@L1<1>,cont@L1<1>);
clean = DSCore.List.Chop(DSCore.List.Flatten(cycle),Math.Sum(numm));
# ----------------------------------------

file_path_2 = Filename("Z:\0-AGENCE\08-AUTOCADREVIT\00-BIBLIO\03- PARAMETRES PARTAGES\GABARIT BPA Architecture 2024-Concours.txt")

# group: Controle_Parametre
categories_2 = Categories("OST_Rooms")  # frozen
fromInput = Custom[Category.FromInput](category=categories_2)  # package Clockwork for Dynamo 2.x; Returns a category from a category, a Dynamo-wrapped category, a BuiltInCategory or a string representing a BuiltInCategory.
turnIntoList = Custom[TurnIntoList](unknownItem=fromInput)  # package Clockwork for Dynamo 2.x; Turns an element (or a nested list) into a flat list
code_block_23 = CodeBlock { true; }
python_script_2 = Python(IN[0]=turnIntoList, IN[1]=code_block_23)  # IronPython2
# ---------- python_script_2.python (30 lines) ----------
import clr
clr.AddReference('RevitAPI')
from Autodesk.Revit.DB import *
import Autodesk

clr.AddReference("RevitServices")
import RevitServices
from RevitServices.Persistence import DocumentManager

search_cats = UnwrapElement(IN[0])
search_ids = []
names = []

for search_cat in search_cats:
	search_ids.append(search_cat.Id.IntegerValue)
	names.append(list())
	

doc = DocumentManager.Instance.CurrentDBDocument


iterator = doc.ParameterBindings.ForwardIterator()
while iterator.MoveNext():
	for cat in iterator.Current.Categories:
		i = 0
		for search_id in search_ids:
			if cat.Id.IntegerValue == search_id:
				names[i].append(iterator.Key.Name)
			i += 1
OUT = names
# ----------------------------------------
code_block_24 = CodeBlock(x=python_script_2) { x[0]; }
code_block_25 = CodeBlock(x=code_block_24)
# ---------- code_block_25.designscript (3 lines) ----------
x=="Surface déduite" ? String.Replace(x,"Surface déduite","Surface"):
x=="ELEC" ? String.Replace(x,"ELEC","CFO"):
x;
# ----------------------------------------
code_block_26 = CodeBlock { ["Nom","Service","Commentaires","Finition du Sol","Finition du Mur","Finition du Plafond"]; }
code_block_27 = CodeBlock(x=deconstruct.first)
# ---------- code_block_27.designscript (2 lines) ----------
a =	x=="Nombre de Pièces" || x=="Niveau" || x=="Dimension en metre" ? true:false;
b = DSCore.List.FilterByBoolMask(x,a)["out"];
# ----------------------------------------
code_block_28 = CodeBlock(i=code_block_25, l=code_block_26, e=code_block_27.b) { a =	DSCore.List.Flatten(DSCore.List.AddItemToFront(i,l)); b =	DSCore.List.GetItemAtIndex(a,DSCore.List.IndexOf(a,e)); }
code_block_29 = CodeBlock(x=code_block_28.b, e=code_block_27.b) { a = x==null ? true:false; b = DSCore.List.FilterByBoolMask(e,a)["in"]; }
python_script_3 = Python(IN[0]=code_block_2, IN[1]=code_block_5, IN[2]=code_block_29.b)  # IronPython2
# ---------- python_script_3.python (42 lines) ----------
import clr
clr.AddReference('DynamoRevitDS')
import Dynamo
import sys
pyt_path = r'C:\Program Files (x86)\IronPython 2.7\Lib'
sys.path.append(pyt_path)
clr.AddReference('System.Drawing')
from System.Drawing import Color, ColorTranslator
clr.AddReference('System')
from System import Guid
clr.AddReferenceByName('Microsoft.Office.Interop.Excel, Version=11.0.0.0, Culture=neutral, PublicKeyToken=71e9bce111e9429c')
from Microsoft.Office.Interop import Excel

ex = Excel.ApplicationClass()
ex.Visible = False
ex.DisplayAlerts = False
workbk = ex.Workbooks.Open(IN[0])
sheet = workbk.Sheets(IN[1])

used_range = sheet.UsedRange

temp_header = []
service_column_values = []

header_row = used_range.Rows(1)
for cell in header_row.Cells:
    temp_header.append(cell.Value2)

if isinstance(IN[2], list):
    service_column_index = [temp_header.index(ad) + 1 for ad in IN[2]]
else:
    service_column_index = [temp_header.index(IN[2]) + 1]

column_values = [[] for _ in range(len(service_column_index))]

for row in used_range.Rows:
    for i, index in enumerate(service_column_index):
        cell = row.Cells(index)
        column_values[i].append(cell.Value2)

ex.Quit()
OUT = column_values
# ----------------------------------------
deconstruct_2 = List.Deconstruct(list=python_script_3@L2)
code_block_30 = CodeBlock(nomparam=deconstruct_2.first, values=deconstruct_2.rest) { nomparam; values; }

code_block_31 = CodeBlock { "Pièces"; }
code_block_32 = CodeBlock(x=code_block_30.values) { DSCore.Object.Type(DSCore.List.FirstItem(x@L2<1>))=="System.String" ? "TEXTE":"LONGUEUR"; }
boolean_3 = BoolSelector(false)
categories_3 = Categories("OST_Rooms")
parameter_groups = ParameterGroupUi("PG_FORCES")
boolean_4 = BoolSelector(true)
add_shared_parameter_to_project = Custom[Add Shared Parameter to Project](parameterName=code_block_30.nomparam, sharedParameterGroupName=code_block_31, paramerterType=code_block_32, visible=boolean_3, elementCategory=categories_3, paramterGroup=parameter_groups, instance=boolean_4)  # package archi-lab.net; This node will add a parameter to shared parameter file and then add it to the project.
code_block_33 = CodeBlock { _parameterName: var[]..[]; }  # unwired: parameterName
code_block_34 = CodeBlock { _sharedParameterGroupName: var[]..[]; }  # unwired: sharedParameterGroup
code_block_35 = CodeBlock { _paramerterType: var[]..[]; }  # unwired: paramerterType
code_block_36 = CodeBlock { _visible: var[]..[]; }  # unwired: visible
code_block_37 = CodeBlock { _elementCategory: var[]..[]; }  # unwired: elementCategory
code_block_38 = CodeBlock { _paramterGroup: var[]..[]; }  # unwired: paramterGroup
code_block_39 = CodeBlock { _instance: var[]..[]; }  # unwired: instance
python_script_4 = Python(IN[0]=code_block_33, IN[1]=code_block_34, IN[2]=code_block_35, IN[3]=code_block_36, IN[4]=code_block_37, IN[5]=code_block_38, IN[6]=code_block_39)  # IronPython2; frozen
# ---------- python_script_4.python (117 lines) ----------
#Copyright(c) 2015, Konrad Sobon
# @arch_laboratory, http://archi-lab.net

import clr
clr.AddReference('ProtoGeometry')
from Autodesk.DesignScript.Geometry import *

# Import DocumentManager and TransactionManager
clr.AddReference("RevitServices")
import RevitServices
from RevitServices.Persistence import DocumentManager
from RevitServices.Transactions import TransactionManager

# Import RevitAPI
clr.AddReference("RevitAPI")
import Autodesk
from Autodesk.Revit.DB import *

doc = DocumentManager.Instance.CurrentDBDocument
uiapp = DocumentManager.Instance.CurrentUIApplication
app = uiapp.Application

from System.Collections.Generic import *

# Import ToDSType(bool) extension method
clr.AddReference("RevitNodes")
import Revit
clr.ImportExtensions(Revit.Elements)
import System
#The inputs to this node will be stored as a list in the IN variable.
dataEnteringNode = IN

_paramName = IN[0]
_groupName = IN[1]
_paramType = IN[2]
_visible = IN[3]
_category = IN[4]
_paramGroup = IN[5]
_instance = IN[6]

def ParamBindingExists(_doc, _paramName, _paramType):
	map = doc.ParameterBindings
	iterator = map.ForwardIterator()
	iterator.Reset()
	while iterator.MoveNext():
		if iterator.Key != None and iterator.Key.Name == _paramName and iterator.Key.ParameterType == _paramType:
			paramExists = True
			break
		else:
			paramExists = False
	return paramExists

def RemoveParamBinding(_doc, _paramName, _paramType):
	map = doc.ParameterBindings
	iterator = map.ForwardIterator()
	iterator.Reset()
	while iterator.MoveNext():
		if iterator.Key != None and iterator.Key.Name == _paramName and iterator.Key.ParameterType == _paramType:
			definition = iterator.Key
			break
	message = None
	if definition != None:
		map.Remove(definition)
		message = "Success"
	return message

def addParam(doc, _paramName, _visible, _instance, _groupName, _paramGroup):
	message = None
	if ParamBindingExists(doc, _paramName, _paramType):
		if not RemoveParamBinding(doc, _paramName, _paramType) == "Success":
			message = "Param Binding Not Removed Successfully"
		else:
			message = None
			
	group = file.Groups.get_Item(_groupName)
	if group == None:
		group = file.Groups.Create(_groupName)
	if group.Definitions.Contains(group.Definitions.Item[_paramName]):
		_def = group.Definitions.Item[_paramName]
	else:
		_def = group.Definitions.Create(_paramName, _paramType, _visible)
	
	param = doc.ParameterBindings.Insert(_def, bind, _paramGroup)
	return message
#"Start" the transaction
TransactionManager.Instance.EnsureInTransaction(doc)

try:
	file = app.OpenSharedParameterFile()
except:
	message = "No Shared Parameter file found."
	pass

builtInCategory = System.Enum.ToObject(BuiltInCategory, _category.Id)
cats = app.Create.NewCategorySet()
cats.Insert(doc.Settings.Categories.get_Item(builtInCategory))
if _instance:
	bind = app.Create.NewInstanceBinding(cats)
else:
	bind = app.Create.NewTypeBinding(cats)


if isinstance(_paramName, list):
	for i, j, k in zip(_paramName, _visible, _instance):
		message = addParam(doc, i, j, k, _groupName, _paramGroup)
else:
	message = addParam(doc, _paramName, _visible, _instance, _groupName, _paramGroup)


# "End" the transaction
TransactionManager.Instance.TransactionTaskDone()

#Assign your output to the OUT variable
if message == None:
	OUT = "Success"
else:
	OUT = message
# ----------------------------------------
code_block_40 = CodeBlock { ElementsFromLinks: bool = null; }
code_block_41 = CodeBlock { 5; }
code_block_42 = CodeBlock()
# ---------- code_block_42.designscript (3 lines) ----------
/*Only unused values ​​can be updated.
A value can not be duplicated*/
value: var[]..[] = null;
# ----------------------------------------

# group: TEXT
boolean_5 = BoolSelector(true)
ꟿ_document_activeview = Custom[ꟿ Document.ActiveView](refresh=boolean_5)  # package spring nodes; Selects the current document's active view. Supports more view types than the built-in option. Will be depreciated once the bult in node works with all plan types.
code_block_43 = CodeBlock { 250; 300; }

# group: Localitation des Pièces > Verticale
curve = CurveElement.Curve(curveElement=code_block_10)
endPoint = Curve.EndPoint(curve=curve)

# group: Localitation des Pièces
python_script_5 = Python(IN[0]=code_block_13.add)  # IronPython2
# ---------- python_script_5.python (15 lines) ----------
def tolist(x):
    if hasattr(x, '__iter__'):
        return list(x)
    return [x]

n = [tolist(lst) for lst in IN[0]]

OUT = []
for lst in n:
    cumulative_sum = 0
    temp_lst = []
    for num in lst:
        cumulative_sum += num+200
        temp_lst.append(cumulative_sum)
    OUT.append(temp_lst)
# ----------------------------------------
code_block_44 = CodeBlock(x=python_script_5) { x[0]; }
code_block_45 = CodeBlock { l = 4; h = 3; }

# group (continued): Localitation des Pièces > Verticale
translate = Geometry.Translate(geometry=endPoint, yTranslation=code_block_44)

# group (continued): TEXT
translate_2 = Geometry.Translate(geometry=translate, yTranslation=code_block_43.out0)

# group: Localitation des Pièces > Count Pièces
sum = Math.Sum(values=code_block_15)
code_block_46 = CodeBlock(sur=code_block_12, num=code_block_15, grp=sum)
# ---------- code_block_46.designscript (4 lines) ----------
surr = DSCore.List.Flatten(sur);
numm = DSCore.List.Flatten(num);

cycle = DSCore.List.Chop(DSCore.List.Flatten(DSCore.List.Cycle(surr<1L>,numm<1L>)),grp);
# ----------------------------------------
code_block_47 = CodeBlock(po=translate, x=code_block_46.cycle) { DSCore.List.Cycle(po<1>,DSCore.List.Count(x@L2<1>)<1>); }
flatten_2 = List.Flatten()  # unwired: list

# group (continued): TEXT
sum_2 = Math.Sum(values=code_block_46.cycle)
ꟿ_number_tostring = Custom[ꟿ Number.ToString](num=sum_2)  # package spring nodes; Converts the input number(s) to string. You can optionally limit the number of digits.
code_block_48 = CodeBlock(service=code_block_14.ky, surface=ꟿ_number_tostring) { service + "\n" + surface+"m²"; }
ꟿ_textnote_bypoint = Custom[ꟿ TextNote.ByPoint](view=ꟿ_document_activeview, point=translate_2, content=code_block_48)  # package spring nodes; Places a text note at a given point in the view. View, text type and content can either be a single item for all points or the same length as the number of points. Set track to false if you'd like to place notes on every run.

# group: Cycle de Pièces
code_block_49 = CodeBlock(sur=code_block_16, num=code_block_15, grp=sum)  # same code as code_block_46
map_2 = List.Map(list=code_block_49.cycle, function=flatten_2)
code_block_50 = CodeBlock(sur=code_block_17, num=code_block_15, grp=sum)  # same code as code_block_46
code_block_51 = CodeBlock(sur=code_block_14.gr, num=code_block_15, grp=sum)  # same code as code_block_46
code_block_52 = CodeBlock(sur=code_block_12, num=code_block_15, grp=sum)  # same code as code_block_46
code_block_53 = CodeBlock(sur=code_block_19, num=code_block_15, grp=sum)  # same code as code_block_46

# group (continued): Localitation des Pièces
code_block_54 = CodeBlock(lar=map_2) { lar; }
code_block_55 = CodeBlock(x=code_block_54) { x=="-" ? 3:x; }

# group: Localitation des Pièces > Range _ Verticale
code_block_56 = CodeBlock(x=code_block_46.cycle, l=code_block_55, h=code_block_45.l) { x/(l*h); }
sqrt = Math.Sqrt(number=code_block_56)
code_block_57 = CodeBlock(x=sqrt, l=code_block_55) { (x*l)*100; }
sqrt_2 = Math.Sqrt(number=code_block_57)
code_block_58 = CodeBlock(x=sqrt_2) { (x*5)*10; }
python_script_6 = Python(IN[0]=code_block_58)  # IronPython2
# ---------- python_script_6.python (15 lines) ----------
def tolist(x):
    if hasattr(x, '__iter__'):
        return list(x)
    return [x]

n = [tolist(lst) for lst in IN[0]]

OUT = []
for lst in n:
    cumulative_sum = 0
    temp_lst = []
    for num in lst:
        cumulative_sum += num
        temp_lst.append(cumulative_sum)
    OUT.append(temp_lst)
# ----------------------------------------
code_block_59 = CodeBlock(x=sqrt, h=code_block_45.l) { (x*h)*100; }

# group: Localitation des Pièces > Localitation des pièces
translate_3 = Geometry.Translate(geometry=code_block_47, xTranslation=python_script_6)
byOriginVectors = CoordinateSystem.ByOriginVectors(origin=translate_3)
byWidthLength = Rectangle.ByWidthLength(coordinateSystem=byOriginVectors, width=code_block_57, length=code_block_59)
byPatch = Surface.ByPatch(closedCurve=byWidthLength)
code_block_60 = CodeBlock { 0.5; }
pointAtParameter = Surface.PointAtParameter(surface=byPatch, u=code_block_60, v=code_block_60)

# group: Piéces
levels = Levels("RDC")

# group: Limites de Piéces
removeNulls_3 = Lists.Manage.RemoveNulls(Data=byWidthLength)
explode = Geometry.Explode(geometry=removeNulls_3.Cleaned)
sketchPlane = View.SketchPlane(view=ꟿ_document_activeview)
fromCurve = Custom[RoomSeparator.FromCurve](curve=explode, sketchPlane=sketchPlane, view=ꟿ_document_activeview)  # package Clockwork for Dynamo 2.x; Creates room separation lines from geometry curves.

end = Revit.Transaction.Transaction.End(input=fromCurve)
code_block_61 = CodeBlock(a=levels, b=end) { [a,b][0]; }

# group (continued): Piéces
byLocation = Room.ByLocation(level=code_block_61, location=pointAtParameter, name=code_block_50.cycle)

# group: Etiquette
family_types = FamilyTypes("ARC_Etiquette de Pièce - 200ème - SU_SP:NOM + SURFACE + Diff SP-SU")
create_annotation_tag = Custom[Create Annotation Tag](tagLocations=pointAtParameter, tagType=family_types, elements=byLocation@L2, views=ꟿ_document_activeview, runIt=boolean_5, lacing=Longest)  # package archi-lab.net; This node will create an annotation tag at a given location, of given type and in a supplied view. If only single view is supplied then all tags will be created in that view.

code_block_62 = CodeBlock(e=byLocation, service=code_block_51.cycle, surface=code_block_52.cycle, sex=code_block_53.cycle)
# ---------- code_block_62.designscript (3 lines) ----------
Service		=	Revit.Elements.Element.SetParameterByName(e,"Service",service);
SurfaceUn	=	Revit.Elements.Element.SetParameterByName(e,"Surface déduite",surface);
SurExtéri 	= 	Revit.Elements.Element.SetParameterByName(e,"Surface Extérieure",sex);
# ----------------------------------------

# group: Color
end_2 = Revit.Transaction.Transaction.End(input=code_block_62.Service)
code_block_63 = CodeBlock(a=ꟿ_document_activeview, b=end_2) { [a,b][0]; }
categories_4 = Categories("OST_Rooms")
view_get_colorfill_scheme = Custom[View Get ColorFill Scheme](view=code_block_63, category=categories_4)  # package Genius Loci; Works only in Revit 2022 and later. Returns the color fill scheme element applied to the view.
code_block_64 = CodeBlock { "Service"; }
code_block_65 = CodeBlock(n=view_get_colorfill_scheme, x=code_block_64) { a =	n.Name == x ? true:false; b =	DSCore.List.FilterByBoolMask(n,a)["in"]; }
python_script_7 = Python(IN[0]=code_block_2, IN[1]=code_block_5)  # IronPython2
# ---------- python_script_7.python (45 lines) ----------
import clr
clr.AddReference('DynamoRevitDS')
import Dynamo
import sys
pyt_path = r'C:\Program Files (x86)\IronPython 2.7\Lib'
sys.path.append(pyt_path)
clr.AddReference('System.Drawing')
from System.Drawing import Color, ColorTranslator
clr.AddReference('System')
from System import Guid
clr.AddReferenceByName('Microsoft.Office.Interop.Excel, Version=11.0.0.0, Culture=neutral, PublicKeyToken=71e9bce111e9429c')
from Microsoft.Office.Interop import Excel

ex = Excel.ApplicationClass()
ex.Visible = False
ex.DisplayAlerts = False
workbk = ex.Workbooks.Open(IN[0])
sheet = workbk.Sheets(IN[1])

def getRGBfromIntColor(intColor):
    colorGDI = ColorTranslator.FromOle(intColor)
    return colorGDI.R, colorGDI.G, colorGDI.B

rgbColor = []

used_range = sheet.UsedRange

temp_header = []
service_column_values = []
rgbColor = []

header_row = used_range.Rows(1)
for cell in header_row.Cells:
    temp_header.append(cell.Value2)

service_column_index = temp_header.index("Service") + 1

for row in used_range.Rows:
    cell = row.Cells(service_column_index)
    service_column_values.append(cell.Value2)
    r, g, b = getRGBfromIntColor(cell.Interior.Color)
    rgbColor.append([r, g, b])

ex.Quit()
OUT = [rgbColor, service_column_values]
# ----------------------------------------
code_block_66 = CodeBlock(x=python_script_7) { drop = DSCore.List.Deconstruct(x[1])["rest"]; }
code_block_67 = CodeBlock(x=python_script_7)
# ---------- code_block_67.designscript (4 lines) ----------
drop = DSCore.List.Deconstruct(x[0])["rest"];
r	 = DSCore.List.GetItemAtIndex(drop@L2<1>,0);
g	 = DSCore.List.GetItemAtIndex(drop@L2<1>,1);
b	 = DSCore.List.GetItemAtIndex(drop@L2<1>,2);
# ----------------------------------------
byARGB = Color.ByARGB(alpha=code_block_20, red=code_block_67.r, green=code_block_67.g, blue=code_block_67.b)
groupByKey = List.GroupByKey(list=code_block_66, keys=byARGB)
sort = List.Sort(list=groupByKey.uniqueKeys)
fill_patterns = FillPatterns("<Remplissage de solide>")
set_colorfill_scheme_properties = Custom[Set ColorFill Scheme Properties](colorFillScheme=code_block_65.b, Name=code_block_64, ParameterName=code_block_64, Title=code_block_64, color=sort, fillPatternElement=fill_patterns, IsVisible=boolean_5)  # package Genius Loci; Works only in Revit 2022 and later. Sets the name, values, colors and fill patterns of the given Color Scheme. (All inputs are optional)

code_block_68 = CodeBlock(x=byLocation) { [DSCore.List.Flatten(x)]; }
setParameterByName = Element.SetParameterByName(element=code_block_68, parameterName=LIST.key, value=code_block_22.clean@L2, lacing=Longest)
code_block_69 = CodeBlock(x=groupByKey.groups) { DSCore.List.Flatten(DSCore.List.UniqueItems(x@L2<1>)); }
code_block_70 = CodeBlock(x=code_block_69) { x[1]; }
cycle = List.Cycle(list=fill_patterns, amount=code_block_41)
python_script_8 = Python(IN[0]=code_block_65.b, IN[1]=code_block_64, IN[2]=code_block_64, IN[3]=code_block_64, IN[4]=code_block_40, IN[5]=code_block_70, IN[6]=sort, IN[7]=cycle, IN[8]=boolean_5)  # IronPython2; frozen
# ---------- python_script_8.python (102 lines) ----------
#Alban de Chasteigner 2021
#twitter : @geniusloci_bim
#geniusloci.bim@gmail.com
#https://github.com/albandechasteigner/GeniusLociForDynamo
 
import clr
clr.AddReference('RevitAPI')
import Autodesk
from Autodesk.Revit.DB import *
clr.AddReference('RevitNodes')
import Revit
clr.AddReference('RevitServices')
import RevitServices
from RevitServices.Persistence import DocumentManager
from RevitServices.Transactions import TransactionManager
doc = DocumentManager.Instance.CurrentDBDocument

def tolist(obj1):
    if hasattr(obj1,"__iter__"): return obj1
    else: return [obj1]

def ToRevitColor(dynamoColor):
    return Color(dynamoColor.Red, dynamoColor.Green, dynamoColor.Blue)

def getParam(scheme):
    catId = scheme.CategoryId
    category = Revit.Elements.Category.ById(catId.IntegerValue)
    fec = FilteredElementCollector(doc).OfCategoryId(catId).ToElements()
    try:
        #BuiltinParameter by Id
        BIP = (BuiltInParameter)(scheme.ParameterDefinition.IntegerValue)   
    except:
        #Parameter by Guid
        paramElem = doc.GetElement(scheme.ParameterDefinition)
        BIP = paramElem.GuidValue
    return fec[0].get_Parameter(BIP)

element = tolist(UnwrapElement(IN[0]))[0]
name = tolist(IN[1])[0] if len(tolist(IN[1])) > 0 else None
paramName = tolist(IN[2])[0] if len(tolist(IN[2])) > 0 else None
title = tolist(IN[3])[0] if len(tolist(IN[3])) > 0 else None
linked = tolist(IN[4])[0] if len(tolist(IN[4])) > 0 else None
values = tolist(IN[5])
colors = tolist(IN[6])
fillPatt = tolist(IN[7])
visibles = tolist(IN[8])

unused = []

if isinstance(element, Autodesk.Revit.DB.ColorFillScheme):
    scheme = element
elif isinstance(element, basestring):
    scheme = FilteredElementCollector(doc).OfCategory(BuiltInCategory.OST_ColorFillSchema).ToElements().Find(lambda x : x.Name == element)

entries = scheme.GetEntries()
    
TransactionManager.Instance.EnsureInTransaction(doc)

if name is not None:
    scheme.Name = name
if paramName is not None:
    catId = scheme.CategoryId
    category = Revit.Elements.Category.ById(catId.IntegerValue)
    fec = FilteredElementCollector(doc).OfCategoryId(catId).ToElements()
    params = fec[0].Parameters
    scheme.ParameterDefinition = [param.Id for param in sorted(params, key = lambda x : x.Id) if param.Definition.Name == paramName][0]
if title is not None:
    scheme.Title = title
if linked is not None:
    scheme.IsLinkedFilesIncluded = linked

for number in xrange(len(entries)):
    if values:
        if entries[number].IsInUse == False:
            unused.append(entries[number])
            try:
                for unus,value in zip(unused, values):
                    if unus.StorageType == StorageType.ElementId:
                        unus.SetElementIdValue(value)
                    elif unus.StorageType == StorageType.Double:
                        unus.SetDoubleValue(UnitUtils.ConvertToInternalUnits(value,getParam(scheme).GetUnitTypeId()))
                    elif unus.StorageType == StorageType.Integer:
                        unus.SetIntegerValue(UnitUtils.ConvertToInternalUnits(value,getParam(scheme).GetUnitTypeId()))
                    elif unus.StorageType == StorageType.String:
                        unus.SetStringValue(value)
            except:
                pass
    if colors:
        c = 0 if len(colors) == 1 else number
        entries[number].Color = ToRevitColor(colors[c])
	if IN[7] != None:
		f = 0 if fillPatt_len else number
		entries[number].FillPatternId = fillPatt[f].Id
	else: pass
    if visibles:
        v = 0 if len(visibles) == 1 else number
        entries[number].IsVisible = visibles[v]

scheme.SetEntries(entries)
TransactionManager.Instance.TransactionTaskDone()

OUT = scheme
# ----------------------------------------
code_block_71 = CodeBlock(x=sort) { x[1]; }
