# Dynamo graph Côte_Interieur_script.dyn (Dynamo 2.18.1.5096)
# packages: archi-lab.net 2022.212.2722, spring nodes 204.1.0, Data-Shapes 2023.2.111, Genius Loci 2023.7.13, archi-lab.net 2024.217.1024, bimorphNodes 5.1.3

python_script = Python()  # IronPython2; frozen; unwired: IN[0]
# ---------- python_script.python (95 lines) ----------
import sys
import clr
import System
clr.AddReference('Microsoft.VisualBasic')
import Microsoft.VisualBasic
clr.AddReference('ProtoGeometry')
from Autodesk.DesignScript.Geometry import *
import Autodesk.DesignScript.Geometry as adg

clr.AddReference('RevitAPI')
import Autodesk
from Autodesk.Revit.DB import *
import Autodesk.Revit.DB as DB

#import Revit APIUI namespace
clr.AddReference('RevitAPIUI')
from Autodesk.Revit.UI import *
from Autodesk.Revit.UI.Selection import *


clr.AddReference('RevitServices')
import RevitServices
from RevitServices.Persistence import DocumentManager
from RevitServices.Transactions import TransactionManager
doc = DocumentManager.Instance.CurrentDBDocument
uiapp = DocumentManager.Instance.CurrentUIApplication
uidoc = uiapp.ActiveUIDocument

clr.AddReference('RevitNodes')
import Revit
clr.ImportExtensions(Revit.GeometryConversion)
clr.ImportExtensions(Revit.Elements)

TransactionManager.Instance.EnsureInTransaction(doc)
out = []

i = 0

dialog = TaskDialog("BPA ARCHITECTURE")
dialog.VerificationText = "Cocher uniqement si votre fichier est en liens "
dialog.MainContent = "Vous devez desinner de ligne pour indiquer de localisation de la cotation. Nous pouvons metter des cotations automatiquement sans desinner les lignes grace à cette façon"

dialog.MainInstruction = 'Cotation Intérieur'
dialog.TitleAutoPrefix = False

verticale = dialog.AddCommandLink(TaskDialogCommandLinkId.CommandLink1, "Verticale Ligne")
horizontale = dialog.AddCommandLink(TaskDialogCommandLinkId.CommandLink2, "Horizontale Ligne")

dialog.CommonButtons = TaskDialogCommonButtons.Close;
dialog.DefaultButton = TaskDialogResult.Close;
dialog.MainIcon = TaskDialogIcon.TaskDialogIconWarning;
dialog.EnableMarqueeProgressBar = True;
dialog.FooterText = "Si vous avez une probléme, vous pouvez parler avec 'Durmus', tout simpelement"


a = dialog.Show()
b = a.ToString()

vrf = dialog.WasVerificationChecked()

if vrf == True:
	ve = "Liens"
	        
else:
	ve = "Normale"        
	        
while i < 100:
	i += 1

	try:
		str = uidoc.Selection.PickPoint("Choisir d'un point pour indiquer de debut de ligne, press ECS key to quit")
		end = uidoc.Selection.PickPoint("Choisir d'un point pour indiquer de la fin de ligne, press ECS key to quit")
	except Exception :
		break
		
	if b == "CommandLink1" :
	
		sp = adg.Point.ByCoordinates(str.X*30.4,str.Y*30.4,str.Z)
		ep = adg.Point.ByCoordinates(str.X*30.4,end.Y*30.4,str.Z)
		locPt = adg.Line.ByStartPointEndPoint(sp,ep)
		
		out.append(locPt)
		
	elif b == "CommandLink2"  :
		sp = adg.Point.ByCoordinates(str.X*30.4,str.Y*30.4,str.Z)
		ep = adg.Point.ByCoordinates(end.X*30.4,str.Y*30.4,str.Z)
		locPt = adg.Line.ByStartPointEndPoint(sp,ep)
		
		out.append(locPt)
	

	doc.Regenerate()
TransactionManager.Instance.TransactionTaskDone()

OUT = out,ve
# ----------------------------------------

# group: Input
boolean = BoolSelector(false)  # graph input
ꟿ_document_activeview = Custom[ꟿ Document.ActiveView](refresh=boolean)  # package spring nodes; Selects the current document's active view. Supports more view types than the built-in option. Will be depreciated once the bult in node works with all plan types.
categories = Categories("OST_Walls")
code_block = CodeBlock { 15; }

# group: Input
file_path = Filename("..\..\..\..\..\BPA.png")
fromPath = FileObject(path=file_path)  # "File.FromPath"
readFromFile = Image.ReadFromFile(file=fromPath)
code_block_2 = CodeBlock { "Côte Intérieur"; "Suivant"; }
code_block_3 = CodeBlock { "Type de Fichier"; "Liens"; "Normal"; }
list_create = List.Create(item0=code_block_3.out1, item1=code_block_3.out2)
radiobuttons_data = Custom[RadioButtons Data](InputName=code_block_3.out0, Keys=list_create, Values=list_create)  # package Data-Shapes; Create radio buttons input for UI.MultipleInputForm ++ .
inputgroup_data = Custom[InputGroup Data](GroupTitle=code_block_2.out0, Inputs=radiobuttons_data)  # package Data-Shapes; Creates a group of inputs for UI.MultipleInputForm ++ . Check out www.data-shapes.net for more infos !
boolean_2 = BoolSelector(true)
multipleinputform = Custom[MultipleInputForm ++](Logo_optional=readFromFile, ButtonText_optional=code_block_2.out1, Inputs=inputgroup_data, Toggle=boolean_2)  # package Data-Shapes; Create a form with multiple inputs. see www.data-shapes.net for tutorials and infos!

code_block_4 = CodeBlock(x=multipleinputform.User_Inputs) { x[0]; }
code_block_5 = CodeBlock(x=code_block_4) { x =="Liens" ? true:false; }

# group: Input
code_block_6 = CodeBlock { "Côte Intérieur"; "Suivant"; }
code_block_7 = CodeBlock { "Choisir Fichier"; }
getDocuments = archilab.Revit.Selection.Select.GetDocuments()
dropdown_data = Custom[DropDown Data](InputName=code_block_7, Keys=getDocuments.Link_Name, Values=getDocuments.Link_Instance)  # package Data-Shapes; Create data for DropDown input in UI.MultiInputForm ++ . Check out www.data-shapes.net for more infos.
inputgroup_data_2 = Custom[InputGroup Data](GroupTitle=code_block_6.out0, Inputs=dropdown_data)
multipleinputform_2 = Custom[MultipleInputForm ++](Logo_optional=readFromFile, ButtonText_optional=code_block_6.out1, Inputs=inputgroup_data_2, Toggle=code_block_5)

code_block_8 = CodeBlock(x=multipleinputform_2.User_Inputs) { x[0]; }

# group: Processing
planview_toboundingbox = Custom[PlanView ToBoundingBox](PlanView=ꟿ_document_activeview)  # package Genius Loci; Create boundingBox from plan view based on the view range settings. (Z is calculed from ProjectElevation)
ofCategory = Revit.LinkElement.OfCategory(linkInstance=code_block_8, category=categories)
getElementsIntersect = Revit.BoundingBox.GetElementsIntersect(boundingBox=planview_toboundingbox, elements=ofCategory)
byCategoryAndView = archilab.Revit.Selection.Select.ByCategoryAndView(category=categories, view=ꟿ_document_activeview)
flatten = List.Flatten(list=byCategoryAndView)
IF = Python(IN[0]=code_block_5, IN[1]=getElementsIntersect, IN[2]=flatten)  # IronPython2
# ---------- IF.python (19 lines) ----------
import clr
clr.AddReference('ProtoGeometry')
from Autodesk.DesignScript.Geometry import *
#The inputs to this node will be stored as a list in the IN variables.

OUT = []

def tolist(obj):
	if hasattr(obj,"__iter__"):
		return obj
	else:
		return [obj]

if IN[0] == True:
	for x in tolist(IN[1]):
		OUT.append(x)
else:
	for x in tolist(IN[2]):
		OUT.append(x)
# ----------------------------------------
python_script_2 = Python(IN[0]=code_block_8)  # IronPython2
# ---------- python_script_2.python (42 lines) ----------
import clr
clr.AddReference('RevitAPI')
from Autodesk.Revit.DB import *
clr.AddReference('RevitServices')
from RevitServices.Persistence import DocumentManager
doc = DocumentManager.Instance.CurrentDBDocument
import System
from System.Collections.Generic import List

clr.AddReference('RevitNodes')
import Revit
clr.ImportExtensions(Revit.GeometryConversion)

clr.AddReference('ProtoGeometry')
from Autodesk.DesignScript.Geometry import *

def tolist(x):
    if hasattr(x, '__iter__'): return x
    else: return [x]

inputdocs = tolist(UnwrapElement(IN[0]))

transforms = []

for inputdoc in inputdocs:
    if inputdoc is None:
        doclnk = doc
    elif isinstance(inputdoc, Document):
        doclnk = inputdoc
    elif isinstance(inputdoc, RevitLinkInstance):
        doclnk = inputdoc.GetLinkDocument()
        try:
            transf = inputdoc.GetTotalTransform()
            transforms.append(transf.ToCoordinateSystem(1))
        except Exception as e:
            transforms.append(None)
            # Hata durumunda hatayı yazdırmak için
            print("Hata:", str(e))
    else:
        doclnk = doc

OUT = transforms
# ----------------------------------------

code_block_9 = CodeBlock(a=code_block_5, b=code_block_8) { [a,b][0]; }

# group: Input
code_block_10 = CodeBlock { "Côte Intérieur"; "Terminer"; }
code_block_11 = CodeBlock { "Choisir de ligne"; "Ligne"; }
categories_2 = Categories("OST_Lines")
selectmodelelements_data = Custom[SelectModelElements Data](InputName=code_block_11.out0, ButtonText=code_block_11.out1, CategoryFilter=categories_2)  # package Data-Shapes; Creates a Revit element selection input for UI.MultipleInputForm++ . Check out www.data-shapes.net for more infos!
inputgroup_data_3 = Custom[InputGroup Data](GroupTitle=code_block_10.out0, Inputs=selectmodelelements_data)
multipleinputform_3 = Custom[MultipleInputForm ++](Logo_optional=readFromFile, ButtonText_optional=code_block_10.out1, Inputs=inputgroup_data_3, Toggle=code_block_9)

# group: Input
code_block_12 = CodeBlock { "Côte Intérieur"; "Terminer"; }
code_block_13 = CodeBlock { "Choisir de ligne"; "Ligne"; }
categories_3 = Categories("OST_Lines")
selectmodelelements_data_2 = Custom[SelectModelElements Data](InputName=code_block_13.out0, ButtonText=code_block_13.out1, CategoryFilter=categories_3)
inputgroup_data_4 = Custom[InputGroup Data](GroupTitle=code_block_12.out0, Inputs=selectmodelelements_data_2)
not_ = Not(x=code_block_5)
multipleinputform_4 = Custom[MultipleInputForm ++](Logo_optional=readFromFile, ButtonText_optional=code_block_12.out1, Inputs=inputgroup_data_4, Toggle=not_)

IF_2 = Python(IN[0]=code_block_5, IN[1]=code_block_8, IN[2]=multipleinputform_4.User_Inputs)  # IronPython2; same code as IF
IF_3 = Python(IN[0]=code_block_5, IN[1]=multipleinputform_3.User_Inputs, IN[2]=IF_2)  # IronPython2; same code as IF
code_block_14 = CodeBlock(x=IF_3) { x[0]; }
curve = CurveElement.Curve(curveElement=code_block_14)

# group: Proccesing
flatten_2 = List.Flatten(list=IF)
getLocation = Element.GetLocation(element=IF)
transform = Geometry.Transform(geometry=getLocation, cs=python_script_2, lacing=Longest)
IF_4 = Python(IN[0]=code_block_5, IN[1]=transform, IN[2]=getLocation)  # IronPython2; same code as IF
flatten_3 = List.Flatten(list=IF_4)
code_block_15 = CodeBlock(cur=curve, x=python_script_2) { Autodesk.Geometry.Translate(cur,Vector.ZAxis(),DSCore.List.MinimumItem(CoordinateSystem.Origin(x).Z)); }
IF_5 = Python(IN[0]=code_block_5, IN[1]=code_block_15, IN[2]=curve)  # IronPython2; same code as IF
ZAxis = Vector.ZAxis()
code_block_16 = CodeBlock { 2500; }
extrude = Curve.Extrude(curve=IF_5, direction=ZAxis, distance=code_block_16)
distanceTo = Geometry.DistanceTo(geometry=extrude, other=flatten_3, lacing=CrossProduct)
flatten_4 = List.Flatten()  # unwired: list
map = List.Map(list=distanceTo, function=flatten_4)
code_block_17 = CodeBlock(x=map, a=code_block) { x<a? true:false; }
filterByBoolMask = List.FilterByBoolMask(list=flatten_3@L2, mask=code_block_17@L2, lacing=Longest)
indexOf = List.IndexOf(list=flatten_3, element=filterByBoolMask.in)
getItemAtIndex = List.GetItemAtIndex(list=flatten_2, index=indexOf)
flatten_5 = List.Flatten()  # unwired: list
map_2 = List.Map(list=getItemAtIndex, function=flatten_5)
element = Revit.LinkElement.Element(linkElement=map_2)

IF_6 = Python(IN[0]=code_block_5, IN[1]=element, IN[2]=map_2)  # IronPython2; same code as IF

# group: Processing
join = List.Join()  # unwired: list0, list1
wall_edges_references = Custom[Wall Edges References](wall=IF_6@L2)  # package Genius Loci; Get the vertical and horizontal edges and their references from the exterior and interior faces. Also works with linked walls.
combine = List.Combine(combineFunction=join, list0=wall_edges_references.Exterior_Side_Vertical_References, list1=wall_edges_references.Interior_Side_Vertical_References)
map_3 = List.Map(list=combine, function=flatten_5)
combine_2 = List.Combine(combineFunction=join, list0=wall_edges_references.Exterior_Side_Vertical_Edges, list1=wall_edges_references.Interior_Side_Vertical_Edges)
map_4 = List.Map(list=combine_2, function=flatten_5)
normal = Curve.Normal(curve=map_4)
normal_2 = Curve.Normal(curve=IF_5)
isParallel = Vector.IsParallel(vector=normal, otherVector=normal_2, lacing=Longest)
filterByBoolMask_2 = List.FilterByBoolMask(list=map_3, mask=isParallel)
convert_linked_reference = Custom[Convert Linked Reference](reference=filterByBoolMask_2.out, RevitLinkInstance=IF_2, lacing=Longest)  # package Genius Loci; Creates a usable reference from a reference from a linked document.
code_block_18 = CodeBlock { dimensionType: var[]..[] = null; }

code_block_19 = CodeBlock(ref=convert_linked_reference, cur=curve)
# ---------- code_block_19.designscript (3 lines) ----------
a=	DSCore.List.IsEmpty(ref@L2<1>);
b=	DSCore.List.FilterByBoolMask(ref,a)["out"];
c=	DSCore.List.FilterByBoolMask(cur,a)["out"];
# ----------------------------------------
IF_7 = Python(IN[0]=code_block_5, IN[1]=code_block_19.c, IN[2]=curve)  # IronPython2; same code as IF
IF_8 = Python(IN[0]=code_block_5, IN[1]=code_block_19.b, IN[2]=filterByBoolMask_2.out)  # IronPython2; same code as IF
dimensionWithReference = Python(IN[0]=ꟿ_document_activeview, IN[1]=IF_7, IN[2]=IF_8, IN[3]=code_block_18)  # IronPython2
# ---------- dimensionWithReference.python (51 lines) ----------
# Alban de Chasteigner 2019
# twitter : @geniusloci_bim
# geniusloci.bim@gmail.com

import clr
clr.AddReference('RevitAPI')
from Autodesk.Revit.DB import *

clr.AddReference('RevitNodes')
import Revit
clr.ImportExtensions(Revit.GeometryConversion)
clr.ImportExtensions(Revit.Elements)

clr.AddReference('RevitServices')
import RevitServices
from RevitServices.Persistence import DocumentManager
from RevitServices.Transactions import TransactionManager

doc = DocumentManager.Instance.CurrentDBDocument

def tolist(obj1):
    if hasattr(obj1, "__iter__"): return obj1
    else: return [obj1]

views = tolist(UnwrapElement(IN[0]))
lines = tolist(IN[1])
if any(isinstance(el, list) for el in IN[2]): referenceList = IN[2]
else: referenceList = [IN[2]]
dimensionType = tolist(UnwrapElement(IN[3]))[0]
listRef, dimList = [], []

# Thanks to Gavin Crump for the list structure improvement
for references in referenceList:
    elementsRef = ReferenceArray()
    for reference in references:
        elementsRef.Append(reference)
    listRef.append(elementsRef)

TransactionManager.Instance.EnsureInTransaction(doc)

try:
    for view in views:
        dims = []
        for line, refer in zip(lines, listRef):
            dims.append(doc.Create.NewDimension(view, line.ToRevitType(), refer).ToDSType(True))
        dimList.append(dims)
    TransactionManager.Instance.TransactionTaskDone()
    OUT = dimList
except Exception as e:
    TransactionManager.Instance.TransactionTaskDone()
    OUT = "Error: {}".format(str(e))
# ----------------------------------------
flatten_6 = List.Flatten(list=dimensionWithReference)
code_block_20 = CodeBlock(x=flatten_6) { a=	x==null ? true:false; b=	DSCore.List.FilterByBoolMask(x,a)["out"]; }

# group: Reorganiser du Value
end = Revit.Transaction.Transaction.End(input=code_block_20.b)
element_reference = Custom[Element Reference](element=end)  # package Genius Loci; Gets the reference of a geometric object or a dimension or a reference plane.
flatten_7 = List.Flatten()  # unwired: list
map_5 = List.Map(list=element_reference, function=flatten_7)
value = Dimension.Value(dimension=end)
map_6 = List.Map(list=value, function=flatten_7)
code_block_21 = CodeBlock(x=map_5, e=map_6) { a=	DSCore.List.Count(x@L2<1>); b=	DSCore.List.Chop(e,a); }
firstItem = List.FirstItem(list=code_block_21.b@L2)
addItemToFront = List.AddItemToFront(item=firstItem, list=code_block_21.b@L2, lacing=Shortest)
code_block_22 = CodeBlock(x=addItemToFront) { x==0 ? false:true; }
filterByBoolMask_3 = List.FilterByBoolMask(list=map_5, mask=code_block_22)

dimensionWithReference_2 = Python(IN[0]=ꟿ_document_activeview, IN[1]=IF_7, IN[2]=filterByBoolMask_3.in, IN[3]=code_block_18)  # IronPython2; same code as dimensionWithReference
code_block_23 = CodeBlock(a=end, b=dimensionWithReference_2) { [a,b][0]; }
delete = archilab.Revit.Elements.Elements.Delete(element=code_block_23)
code_block_24 = CodeBlock(a=boolean_2, b=code_block_4) { [a,b][0]; }
