# Dynamo graph AjouterLiens_script.dyn (Dynamo 2.19.3.6394)

python_script = Python()  # IronPython2
# ---------- python_script.python (139 lines) ----------
import sys
import clr
clr.AddReference('ProtoGeometry')
from Autodesk.DesignScript.Geometry import *

clr.AddReference('System.Drawing')
clr.AddReference('System.Windows.Forms')
import System.Drawing
import System.Windows.Forms

from System.Drawing import *
from System.Windows.Forms import *

clr.AddReference('System.Data')
from System.Data import *
from System import Array

class Form24(Form):
    def __init__(self):
        self._tableData = DataTable("BPA Architecture")
        self._tableData.Columns.Add("Lien", System.String)
        self._tableData.Columns.Add("Chemin", System.Object)
        self.out = []
        self.InitializeComponent()

    def InitializeComponent(self):
        self._button1 = System.Windows.Forms.Button()
        self._buttonFilePath = System.Windows.Forms.Button()
        self._dataGridView = System.Windows.Forms.DataGridView()
        self._buttonDeleteFile = System.Windows.Forms.Button()
        self._comboBoxPosition = DataGridViewComboBoxColumn()

        # Diğer kontrol elemanlarını ekle
        self._button1.Anchor = System.Windows.Forms.AnchorStyles.Bottom | System.Windows.Forms.AnchorStyles.Right
        self._button1.Location = System.Drawing.Point(422, 320)
        self._button1.Name = "button1"
        self._button1.Size = System.Drawing.Size(75, 27)
        self._button1.TabIndex = 2
        self._button1.Text = "Terminer"
        self._button1.UseVisualStyleBackColor = True
        self._button1.Click += self.Button1Click

        self._buttonFilePath.Anchor = System.Windows.Forms.AnchorStyles.Bottom | System.Windows.Forms.AnchorStyles.Left
        self._buttonFilePath.Location = System.Drawing.Point(12, 320)
        self._buttonFilePath.Name = "buttonFilePath"
        self._buttonFilePath.Size = System.Drawing.Size(104, 27)
        self._buttonFilePath.TabIndex = 4
        self._buttonFilePath.Text = "Chemin Depuis"
        self._buttonFilePath.UseVisualStyleBackColor = True
        self._buttonFilePath.Click += self.ButtonFilePathClick

        self._buttonDeleteFile.Anchor = System.Windows.Forms.AnchorStyles.Bottom | System.Windows.Forms.AnchorStyles.Left
        self._buttonDeleteFile.Location = System.Drawing.Point(122, 320)
        self._buttonDeleteFile.Name = "buttonDeleteFile"
        self._buttonDeleteFile.Size = System.Drawing.Size(104, 27)
        self._buttonDeleteFile.TabIndex = 5
        self._buttonDeleteFile.Text = "Supprimer"
        self._buttonDeleteFile.UseVisualStyleBackColor = True
        self._buttonDeleteFile.Click += self.ButtonDeleteFileClick


        self._dataGridView.Anchor = System.Windows.Forms.AnchorStyles.Top | System.Windows.Forms.AnchorStyles.Bottom | System.Windows.Forms.AnchorStyles.Left | System.Windows.Forms.AnchorStyles.Right
        self._dataGridView.ColumnHeadersHeightSizeMode = System.Windows.Forms.DataGridViewColumnHeadersHeightSizeMode.AutoSize
        self._dataGridView.Location = System.Drawing.Point(12, 30)
        self._dataGridView.Name = "dataGridView1"
        self._dataGridView.Size = System.Drawing.Size(480, 244)
        self._dataGridView.TabIndex = 6
        self._dataGridView.Columns.Add(self._comboBoxPosition) 
        self._comboBoxPosition.HeaderText = "Position"
        options = Array[object](["Point de Base du projet", "A l'émplacement partagé","Origin Interne"])
        self._comboBoxPosition.Items.AddRange(options)  
        self._comboBoxPosition.DisplayStyle = DataGridViewComboBoxDisplayStyle.ComboBox
        self._dataGridView.EditingControlShowing += self.DataGridViewEditingControlShowing 

        self.ClientSize = System.Drawing.Size(510, 360)
        self.Controls.Add(self._buttonDeleteFile)
        self.Controls.Add(self._dataGridView)
        self.Controls.Add(self._buttonFilePath)
        self.Controls.Add(self._button1)
        self.Name = "Durmus Bayryam"
        self.Text = "BPA Architecture"

    def Button1Click(self, sender, e):
        self.Close()

    def ButtonFilePathClick(self, sender, e):
        openFileDialog = System.Windows.Forms.OpenFileDialog()
        openFileDialog.Filter = "All Files|*.*"
        openFileDialog.Title = "Chemin Depuis"
        
        result = openFileDialog.ShowDialog()
        selected_file = openFileDialog.FileName
        self.AddFileToDataTable(selected_file)

    def AddFileToDataTable(self, file_path):
        new_row = self._tableData.NewRow()
        new_row["Lien"] = "Lien"
        new_row["Chemin"] = file_path
        self._tableData.Rows.Add(new_row)
        self.RefreshDataGridView()

    def RefreshDataGridView(self):
        self._dataGridView.DataSource = None
        self._dataGridView.DataSource = self._tableData

    def DataGridViewEditingControlShowing(self, sender, e):
        if isinstance(e.Control, ComboBox):
            comboBox = e.Control
            comboBox.DropDownStyle = ComboBoxStyle.DropDown
            comboBox.AutoCompleteMode = AutoCompleteMode.SuggestAppend
            comboBox.AutoCompleteSource = AutoCompleteSource.ListItems
            options = Array[object](["Point de Base du projet", "A l'émplacement partagé","Origin Interne"])
            comboBox.DataSource = options


    def ButtonDeleteFileClick(self, sender, e):
        selected_rows = self._dataGridView.SelectedRows
        if selected_rows.Count > 0:
            index = selected_rows[0].Index
            self._tableData.Rows.RemoveAt(index)
            self.RefreshDataGridView()
        else:
            MessageBox.Show("Sélectionnez le fichier que vous souhaitez supprimer.", "HEY!", MessageBoxButtons.OK, MessageBoxIcon.Warning)

objForm = Form24()
objForm.ShowDialog()

position = []
result = []
for row in objForm._tableData.Rows:
    chemin = row["Chemin"]
    result.append(chemin)
    
for rowIndex in range(objForm._dataGridView.Rows.Count):
    cell = objForm._dataGridView.Rows[rowIndex].Cells[""]
    if cell is not None and cell.Value is not None:
        position.append(cell.Value)

OUT = result, position
# ----------------------------------------
code_block = CodeBlock(x=python_script) { x[0]; x[1]; }
code_block_2 = CodeBlock(x=code_block.out1, k=code_block.out0)
# ---------- code_block_2.designscript (6 lines) ----------
a=
x=="Point de Base du projet" ? k:0;
e=
x=="A l'émplacement partagé" ? k:0;
o=
x=="Origin Interne"? k:0;
# ----------------------------------------
code_block_3 = CodeBlock()  # unwired: None
# ---------- code_block_3.designscript (3 lines) ----------
/*Input the worksets the links will be placed on.
If no workset is placed here, the links will be placed on current workset.*/
Worksets_optional: var[]..[] = None;
# ----------------------------------------
code_block_4 = CodeBlock()
# ---------- code_block_4.designscript (2 lines) ----------
/*Input 'true' if you want to pin the links in place.*/
PinLinks_optional: bool = false;
# ----------------------------------------
code_block_5 = CodeBlock()
# ---------- code_block_5.designscript (2 lines) ----------
/*Input a string of character (or a list of strings) contained in the name of the worksets to keep closed in links*/
ClosedWorksetNamesContain_optional: var[]..[] = null;
# ----------------------------------------
base_point = Python(IN[0]=code_block_2.a, IN[1]=code_block_3, IN[2]=code_block_4, IN[3]=code_block_5)  # IronPython2
# ---------- base_point.python (163 lines) ----------
# part of the code originally created by Nicklas Østertgaard  nvo@bimshark.com / nvo@shl.fk  and/or Augusto Goncalves (AEC Devblog)
# Workset management, loop, pin and site location settings by Jonathan ATGER (jonathan.atger@yahoo.fr)
#bug correction by eric stimmel

import clr

if IN[3] != None :
	clr.AddReference("System")
	from System.Collections.Generic import List

# Import ToDSType(bool) extension method
clr.AddReference("RevitNodes")
import Revit
clr.ImportExtensions(Revit.Elements)

# Import DocumentManager and TransactionManager
clr.AddReference("RevitServices")
import RevitServices
from RevitServices.Persistence import DocumentManager
from RevitServices.Transactions import TransactionManager
from System.Collections.Generic import *

# Import RevitAPI
clr.AddReference("RevitAPI")
import Autodesk
from Autodesk.Revit.DB import *

import sys
pyt_path = r'C:\Program Files (x86)\IronPython 2.7\Lib'
sys.path.append(pyt_path)
import System

doc = DocumentManager.Instance.CurrentDBDocument

# Start Transaction
TransactionManager.Instance.EnsureInTransaction(doc)

if isinstance(IN[0], list) : in_links = IN[0] 
else : in_links = [IN[0]]

if isinstance(IN[1], list) : in_ws = IN[1] 
else : in_ws = [IN[1]]

pinned = IN[2]

if IN[3] != None :
	if isinstance(IN[3], list) : closedwsnames = IN[3] 
	else : closedwsnames = [IN[3]]
else : closedwsnames = None

# number of elements
try : numlinks = len(in_links)
except : OUT = 'Input a filepath'
	
try : numworksets = len(in_ws)
except : numworksets = 0

#check list lengths
if numlinks == numworksets : listlength = True
else : listlength = False

def linkmodel (fpath, doc, pin) :
	# Create the Revit Link Type
	mpu = ModelPathUtils.ConvertUserVisiblePathToModelPath(fpath)
	
	if closedwsnames == None :
		lnkoptions = RevitLinkOptions("")
	
	else :
		#Workset configuration
		try :
			worksets = WorksharingUtils.GetUserWorksetInfo(mpu)
			ows = []
			
			for ws in worksets :
				name = ws.Name
				wsid = ws.Id
				closed = []	
				for wsn in closedwsnames :
					if wsn in name :
						closed.append(wsid)
				if wsid not in closed :
					ows.append(wsid)
				
			#The workset Ids collected put in an IList format			
			openwsids = List[WorksetId](ows)			
			
			#Directly creating the RevitLinkOptions raises an error, so I create it once, and then extract the Worksetconfiguration to modify it. Had some issues with the Close() method of the WorksetConfiguration, Open() worked instead
			wc = WorksetConfiguration(WorksetConfigurationOption.CloseAllWorksets)
			lnkoptions = RevitLinkOptions(False, wc)
			wc2 = lnkoptions.GetWorksetConfiguration()
			wc2.Open(openwsids)
			lnkoptions = RevitLinkOptions(False, wc2)
			
		except :
			lnkoptions = RevitLinkOptions("")
			
			
	#Create RevitLinkType
	loadedLnkType = RevitLinkType.Create(doc, mpu, lnkoptions)
	
	# Create the Revit Link Instance
	lnkInstance = RevitLinkInstance.Create(doc, loadedLnkType.ElementId)
	lnkInstance.MoveBasePointToHostBasePoint(True)
	
	#Pin link
	lnkInstance.Pinned = pin

	return lnkInstance

try:
	# Number of worksets input and filepaths input are different
	if IN[1] and listlength == False :
		OUT = "The number of worksets doesn't match the number of links"
		
		
	# Multiple Worksets input
	elif IN[1] and listlength == True  :
	
		#Get WorksetTable and current workset
		wstable = doc.GetWorksetTable()
		activewsid = wstable.GetActiveWorksetId()
		
		#Create list for output
		links = []
		
		for fpath, ws in zip(in_links, in_ws) :
		
			# Get WorksetId
			wssimpleid = ws.Id
			wsid = WorksetId(wssimpleid)
				
			# Set the workset
			WorksetTable.SetActiveWorksetId(wstable, wsid)
			
			# Create the Revit Link Type and Link Instance
			a = linkmodel(fpath, doc, pinned)
			
			#add created link to output
			links.append(a)
							
		#reset current workset	
		WorksetTable.SetActiveWorksetId(wstable, activewsid)
		
		#output
		OUT = links	

	# No worksets input
	else :
		links = []
		for fpath in in_links :
			a = linkmodel(fpath, doc, pinned)
			links.append(a)
		OUT=links
	
except:
    # if error accurs anywhere in the process catch it
    import traceback
    errorReport = traceback.format_exc()
    OUT = errorReport 

# End Transaction
TransactionManager.Instance.TransactionTaskDone()
# ----------------------------------------
shared = Python(IN[0]=code_block_2.e, IN[1]=code_block_3, IN[2]=code_block_4, IN[3]=code_block_5)  # IronPython2
# ---------- shared.python (162 lines) ----------
# part of the code originally created by Nicklas Østertgaard  nvo@bimshark.com / nvo@shl.fk  and/or Augusto Goncalves (AEC Devblog)
# Workset management, loop, pin and site location settings by Jonathan ATGER (jonathan.atger@yahoo.fr)
# bug correction by eric stimmel

import clr

if IN[3] != None :
	clr.AddReference("System")
	from System.Collections.Generic import List

# Import ToDSType(bool) extension method
clr.AddReference("RevitNodes")
import Revit
clr.ImportExtensions(Revit.Elements)

# Import DocumentManager and TransactionManager
clr.AddReference("RevitServices")
import RevitServices
from RevitServices.Persistence import DocumentManager
from RevitServices.Transactions import TransactionManager
from System.Collections.Generic import *

# Import RevitAPI
clr.AddReference("RevitAPI")
import Autodesk
from Autodesk.Revit.DB import *

import sys
pyt_path = r'C:\Program Files (x86)\IronPython 2.7\Lib'
sys.path.append(pyt_path)
import System

doc = DocumentManager.Instance.CurrentDBDocument

# Start Transaction
TransactionManager.Instance.EnsureInTransaction(doc)

if isinstance(IN[0], list) : in_links = IN[0] 
else : in_links = [IN[0]]

if isinstance(IN[1], list) : in_ws = IN[1] 
else : in_ws = [IN[1]]

pinned = IN[2]

if IN[3] != None :
	if isinstance(IN[3], list) : closedwsnames = IN[3] 
	else : closedwsnames = [IN[3]]
else : closedwsnames = None

# number of elements
try : numlinks = len(in_links)
except : OUT = 'Input a filepath'
	
try : numworksets = len(in_ws)
except : numworksets = 0

#check list lengths
if numlinks == numworksets : listlength = True
else : listlength = False

def linkmodel (fpath, doc, pin) :
	# Create the Revit Link Type
	mpu = ModelPathUtils.ConvertUserVisiblePathToModelPath(fpath)
	
	if closedwsnames == None :
		lnkoptions = RevitLinkOptions("")
	
	else :
		#Workset configuration
		try :
			worksets = WorksharingUtils.GetUserWorksetInfo(mpu)
			ows = []
			
			for ws in worksets :
				name = ws.Name
				wsid = ws.Id
				closed = []	
				for wsn in closedwsnames :
					if wsn in name :
						closed.append(wsid)
				if wsid not in closed :
					ows.append(wsid)
				
			#The workset Ids collected put in an IList format			
			openwsids = List[WorksetId](ows)			
			
			#Directly creating the RevitLinkOptions raises an error, so I create it once, and then extract the Worksetconfiguration to modify it. Had some issues with the Close() method of the WorksetConfiguration, Open() worked instead
			wc = WorksetConfiguration(WorksetConfigurationOption.CloseAllWorksets)
			lnkoptions = RevitLinkOptions(False, wc)
			wc2 = lnkoptions.GetWorksetConfiguration()
			wc2.Open(openwsids)
			lnkoptions = RevitLinkOptions(False, wc2)
			
		except :
			lnkoptions = RevitLinkOptions("")
			
			
	#Create RevitLinkType
	loadedLnkType = RevitLinkType.Create(doc, mpu, lnkoptions)
	
	# Create the Revit Link Instance
	lnkInstance = RevitLinkInstance.Create(doc, loadedLnkType.ElementId, ImportPlacement.Shared)
	
	#Pin link
	lnkInstance.Pinned = pin

	return lnkInstance

try:
	# Number of worksets input and filepaths input are different
	if IN[1] and listlength == False :
		OUT = "The number of worksets doesn't match the number of links"
		
		
	# Multiple Worksets input
	elif IN[1] and listlength == True  :
	
		#Get WorksetTable and current workset
		wstable = doc.GetWorksetTable()
		activewsid = wstable.GetActiveWorksetId()
		
		#Create list for output
		links = []
		
		for fpath, ws in zip(in_links, in_ws) :
		
			# Get WorksetId
			wssimpleid = ws.Id
			wsid = WorksetId(wssimpleid)
				
			# Set the workset
			WorksetTable.SetActiveWorksetId(wstable, wsid)
			
			# Create the Revit Link Type and Link Instance
			a = linkmodel(fpath, doc, pinned)
			
			#add created link to output
			links.append(a)
							
		#reset current workset	
		WorksetTable.SetActiveWorksetId(wstable, activewsid)
		
		#output
		OUT = links	

	# No worksets input
	else :
		links = []
		for fpath in in_links :
			a = linkmodel(fpath, doc, pinned)
			links.append(a)
		OUT=links
	
except:
    # if error accurs anywhere in the process catch it
    import traceback
    errorReport = traceback.format_exc()
    OUT = errorReport 

# End Transaction
TransactionManager.Instance.TransactionTaskDone()
# ----------------------------------------
origin_point = Python(IN[0]=code_block_2.o, IN[1]=code_block_3, IN[2]=code_block_4, IN[3]=code_block_5)  # IronPython2
# ---------- origin_point.python (163 lines) ----------
# part of the code originally created by Nicklas Østertgaard  nvo@bimshark.com / nvo@shl.fk  and/or Augusto Goncalves (AEC Devblog)
# Workset management, loop, pin and site location settings by Jonathan ATGER (jonathan.atger@yahoo.fr)
#bug correction by eric stimmel

import clr

if IN[3] != None :
	clr.AddReference("System")
	from System.Collections.Generic import List

# Import ToDSType(bool) extension method
clr.AddReference("RevitNodes")
import Revit
clr.ImportExtensions(Revit.Elements)

# Import DocumentManager and TransactionManager
clr.AddReference("RevitServices")
import RevitServices
from RevitServices.Persistence import DocumentManager
from RevitServices.Transactions import TransactionManager
from System.Collections.Generic import *

# Import RevitAPI
clr.AddReference("RevitAPI")
import Autodesk
from Autodesk.Revit.DB import *

import sys
pyt_path = r'C:\Program Files (x86)\IronPython 2.7\Lib'
sys.path.append(pyt_path)
import System

doc = DocumentManager.Instance.CurrentDBDocument

# Start Transaction
TransactionManager.Instance.EnsureInTransaction(doc)

if isinstance(IN[0], list) : in_links = IN[0] 
else : in_links = [IN[0]]

if isinstance(IN[1], list) : in_ws = IN[1] 
else : in_ws = [IN[1]]

pinned = IN[2]

if IN[3] != None :
	if isinstance(IN[3], list) : closedwsnames = IN[3] 
	else : closedwsnames = [IN[3]]
else : closedwsnames = None

# number of elements
try : numlinks = len(in_links)
except : OUT = 'Input a filepath'
	
try : numworksets = len(in_ws)
except : numworksets = 0

#check list lengths
if numlinks == numworksets : listlength = True
else : listlength = False

def linkmodel (fpath, doc, pin) :
	# Create the Revit Link Type
	mpu = ModelPathUtils.ConvertUserVisiblePathToModelPath(fpath)
	
	if closedwsnames == None :
		lnkoptions = RevitLinkOptions("")
	
	else :
		#Workset configuration
		try :
			worksets = WorksharingUtils.GetUserWorksetInfo(mpu)
			ows = []
			
			for ws in worksets :
				name = ws.Name
				wsid = ws.Id
				closed = []	
				for wsn in closedwsnames :
					if wsn in name :
						closed.append(wsid)
				if wsid not in closed :
					ows.append(wsid)
				
			#The workset Ids collected put in an IList format			
			openwsids = List[WorksetId](ows)			
			
			#Directly creating the RevitLinkOptions raises an error, so I create it once, and then extract the Worksetconfiguration to modify it. Had some issues with the Close() method of the WorksetConfiguration, Open() worked instead
			wc = WorksetConfiguration(WorksetConfigurationOption.CloseAllWorksets)
			lnkoptions = RevitLinkOptions(False, wc)
			wc2 = lnkoptions.GetWorksetConfiguration()
			wc2.Open(openwsids)
			lnkoptions = RevitLinkOptions(False, wc2)
			
		except :
			lnkoptions = RevitLinkOptions("")
			
			
	#Create RevitLinkType
	loadedLnkType = RevitLinkType.Create(doc, mpu, lnkoptions)
	
	# Create the Revit Link Instance
	lnkInstance = RevitLinkInstance.Create(doc, loadedLnkType.ElementId)
	lnkInstance.MoveOriginToHostOrigin(True)
	
	#Pin link
	lnkInstance.Pinned = pin

	return lnkInstance

try:
	# Number of worksets input and filepaths input are different
	if IN[1] and listlength == False :
		OUT = "The number of worksets doesn't match the number of links"
		
		
	# Multiple Worksets input
	elif IN[1] and listlength == True  :
	
		#Get WorksetTable and current workset
		wstable = doc.GetWorksetTable()
		activewsid = wstable.GetActiveWorksetId()
		
		#Create list for output
		links = []
		
		for fpath, ws in zip(in_links, in_ws) :
		
			# Get WorksetId
			wssimpleid = ws.Id
			wsid = WorksetId(wssimpleid)
				
			# Set the workset
			WorksetTable.SetActiveWorksetId(wstable, wsid)
			
			# Create the Revit Link Type and Link Instance
			a = linkmodel(fpath, doc, pinned)
			
			#add created link to output
			links.append(a)
							
		#reset current workset	
		WorksetTable.SetActiveWorksetId(wstable, activewsid)
		
		#output
		OUT = links	

	# No worksets input
	else :
		links = []
		for fpath in in_links :
			a = linkmodel(fpath, doc, pinned)
			links.append(a)
		OUT=links
	
except:
    # if error accurs anywhere in the process catch it
    import traceback
    errorReport = traceback.format_exc()
    OUT = errorReport 

# End Transaction
TransactionManager.Instance.TransactionTaskDone()
# ----------------------------------------
