# Dynamo graph RechargerDepuis_script.dyn (Dynamo 2.18.1.5096)
# packages: Genius Loci 2023.7.13, Data-Shapes 2023.2.111, archi-lab.net 2024.217.1024

# group: Input
file_path = Filename("..\..\..\..\..\BPA.png")
fromPath = FileObject(path=file_path)  # "File.FromPath"
readFromFile = Image.ReadFromFile(file=fromPath)
code_block = CodeBlock { "Manager Sous-Projet"; "Terminer"; "Recharger Depuis"; }
getDocuments = archilab.Revit.Selection.Select.GetDocuments()
filepath_data = Custom[FilePath Data](InputName=getDocuments.Link_Name, ButtonText=code_block.out2)  # package Data-Shapes; Create filepath input for UI.MultipleInputForm ++ . Check out www.data-shapes.net for more infos !
inputgroup_data = Custom[InputGroup Data](GroupTitle=code_block.out0, Inputs=filepath_data)  # package Data-Shapes; Creates a group of inputs for UI.MultipleInputForm ++ . Check out www.data-shapes.net for more infos !
boolean = BoolSelector(true)
multipleinputform = Custom[MultipleInputForm ++](Logo_optional=readFromFile, ButtonText_optional=code_block.out1, Inputs=inputgroup_data, Toggle=boolean)  # package Data-Shapes; Create a form with multiple inputs. see www.data-shapes.net for tutorials and infos!

code_block_2 = CodeBlock(x=multipleinputform.User_Inputs, e=getDocuments.Link_Instance)
# ---------- code_block_2.designscript (3 lines) ----------
a=	x=="FilePath" ? true:false;
b=	DSCore.List.FilterByBoolMask(e,a)["out"];
c=	DSCore.List.FilterByBoolMask(x,a)["out"];
# ----------------------------------------
repath_revitlinkinstance = Custom[Repath RevitLinkInstance](RevitLinkInstance=code_block_2.b, FilePath=code_block_2.c)  # package Genius Loci; Reloads the Revit link from the input path.
