# Dynamo graph Sous-projet_script.dyn (Dynamo 2.18.1.5096)
# packages: archi-lab.net 2024.217.1024, Data-Shapes 2023.2.111, Clockwork for Dynamo 2.x 2.6.0

# group: Input
file_path = Filename("..\..\..\..\..\BPA.png")
fromPath = FileObject(path=file_path)  # "File.FromPath"
readFromFile = Image.ReadFromFile(file=fromPath)
code_block = CodeBlock { "Manager Sous-Projet"; "Terminer"; "Nom du Sous-Projet"; }
getDocuments = archilab.Revit.Selection.Select.GetDocuments()
textbox_data = Custom[TextBox Data](InputName=getDocuments.Link_Name, DefaultText=code_block.out2)  # package Data-Shapes; Create Data for TextBox input in UI.MultipleInputForm ++ . Check out www.data-shapes.net for more informations
inputgroup_data = Custom[InputGroup Data](GroupTitle=code_block.out0, Inputs=textbox_data)  # package Data-Shapes; Creates a group of inputs for UI.MultipleInputForm ++ . Check out www.data-shapes.net for more infos !
boolean = BoolSelector(true)
multipleinputform = Custom[MultipleInputForm ++](Logo_optional=readFromFile, ButtonText_optional=code_block.out1, Inputs=inputgroup_data, Toggle=boolean)  # package Data-Shapes; Create a form with multiple inputs. see www.data-shapes.net for tutorials and infos!

byName = archilab.Revit.Elements.Workset.ByName(name=multipleinputform.User_Inputs)
code_block_2 = CodeBlock(x=byName, e=getDocuments.Link_Instance) { a=	x==null ? true:false; b=	DSCore.List.FilterByBoolMask(e,a)["out"]; c=	DSCore.List.FilterByBoolMask(x,a)["out"]; }
setWorkset = Custom[Element.SetWorkset](workset=code_block_2.c, element=code_block_2.b, lacing=Longest)  # package Clockwork for Dynamo 2.x; Sets the workset of a given element
