# Dynamo graph Duplicate Element_script.dyn (Dynamo 2.19.3.6394)
# packages: Clockwork for Dynamo 2.x 2.3.0, Rhythm 2021.7.3, Data-Shapes 2022.2.96, Data-Shapes 2023.2.111, Rhythm 2023.9.1, Data-Shapes 2024.2.113

# group: Input
file_path = Filename("..\..\..\..\..\BPA.png")
fromPath = FileObject(path=file_path)  # "File.FromPath"
readFromFile = Image.ReadFromFile(file=fromPath)
code_block = CodeBlock { "BPA ARCHITECTURE"; "Suivant"; }
code_block_2 = CodeBlock { cat=	"Categorie"; elem=	"Famille Pour Duplicate"; }
categories = Categories("OST_Doors")
categories_2 = Categories("OST_Windows")
list_create = List.Create(item0=categories, item1=categories_2)
code_block_3 = CodeBlock(e=list_create) { e.Name; }
dropdown_data = Custom[DropDown Data](InputName=code_block_2.cat, Keys=code_block_3, Values=list_create)  # package Data-Shapes; Create data for DropDown input in UI.MultiInputForm ++ . Check out www.data-shapes.net for more infos.
boolean = BoolSelector(true)
multipleinputform = Custom[MultipleInputForm ++](Logo_optional=readFromFile, ButtonText_optional=code_block.out1, Inputs=dropdown_data, Toggle=boolean)  # package Data-Shapes; Create a form with multiple inputs. see www.data-shapes.net for tutorials and infos!
all_family_types_of_category = Custom[All Family Types Of Category](category=multipleinputform.User_Inputs)  # package Clockwork for Dynamo 2.x; Gets all family types/symbols of a given category in the model.
flatten = List.Flatten(list=all_family_types_of_category)
code_block_4 = CodeBlock(e=flatten) { e.Name; false; 400; }
code_block_5 = CodeBlock(x=multipleinputform.User_Inputs) { String.FromObject(x); }
code_block_6 = CodeBlock { "Dimensions"; "Largeur Brute x Hauteur Brute"; "Largeur_Passage Libre x Hauteur Brute"; }
multilinetextbox_data = Custom[MultiLineTextBox Data](InputName=code_block_6.out0, InputName_2=code_block_6.out2)  # package Data-Shapes; Creates a multi line textbox input for UI.MultipleInputForm ++
multilinetextbox_data_2 = Custom[MultiLineTextBox Data](InputName=code_block_6.out0, InputName_2=code_block_6.out1)
code_block_7 = CodeBlock(x=code_block_5, a=multilinetextbox_data, b=multilinetextbox_data_2) { x=="Portes" ? a:b; }

family = FamilyType.Family(familyType=flatten)
code_block_8 = CodeBlock(n=family) { String.Remove(n.Name,0,7); }
code_block_9 = CodeBlock(n=code_block_4.out0, f=code_block_8) { n+" "+"\n"+"("+f+")"; }

# group (continued): Input
listview_data = Custom[Listview Data](InputName=code_block_2.elem, Keys=code_block_9, Values=flatten, Height_optionnal=code_block_4.out2, ShowId_optionnal=code_block_4.out1)  # package Data-Shapes; Create data for ListView input in UI.MultiInputForm ++ . Check out www.data-shapes.net for more infos.
code_block_10 = CodeBlock(a=boolean, b=listview_data) { [a,b][0]; }
multipleinputform_2 = Custom[MultipleInputForm ++](Logo_optional=readFromFile, ButtonText_optional=code_block.out1, Inputs=listview_data, Toggle=code_block_10)
code_block_11 = CodeBlock(a=boolean, b=multipleinputform_2.User_Inputs) { [a,b][0]; }
multipleinputform_3 = Custom[MultipleInputForm ++](Logo_optional=readFromFile, ButtonText_optional=code_block.out1, Inputs=code_block_7, Toggle=code_block_11)

# group: Fenêtre
code_block_12 = CodeBlock(x=multipleinputform_2.User_Inputs) { x[0]; }
code_block_13 = CodeBlock(n=multipleinputform_2.User_Inputs, l=multipleinputform_3.User_Inputs)
# ---------- code_block_13.designscript (5 lines) ----------
tg = DSCore.List.FirstItem(DSCore.String.Split(n[0][0].Name,"_"));
nm = DSCore.List.Flatten(DSCore.String.Split(l,"\n"));
//dimension
lar = DSCore.String.ToNumber(DSCore.List.FirstItem(DSCore.String.Split(nm,"x")@L2<1>));
hau = DSCore.String.ToNumber(DSCore.List.LastItem(DSCore.String.Split(nm,"x")@L2<1>));
# ----------------------------------------
code_block_14 = CodeBlock(n=code_block_13.tg, v=code_block_13.nm) { n+"_" + v; }
code_block_15 = CodeBlock(a=code_block_12, b=code_block_14) { [a,b][0]; }
duplicate = Custom[FamilyType.Duplicate](elementType=code_block_15, name=code_block_14, lacing=Longest)  # package Clockwork for Dynamo 2.x; Duplicates a family type
code_block_16 = CodeBlock { "Largeur brute"; "Largeur_Passage Libre"; "Hauteur brute"; }
code_block_17 = CodeBlock(x=code_block_5, lb=code_block_16.out1, lpb=code_block_16.out0) { largeur=	x=="Portes" ? lb:lpb; }
ʳʰʸᵗʰᵐ_elements = Rhythm.Revit.Elements.Elements.SetParameterByNameTypeOrInstance(element=duplicate, parameterName=code_block_17, value=code_block_13.lar, lacing=Longest)
ʳʰʸᵗʰᵐ_elements_2 = Rhythm.Revit.Elements.Elements.SetParameterByNameTypeOrInstance(element=ʳʰʸᵗʰᵐ_elements, parameterName=code_block_16.out2, value=code_block_13.hau, lacing=Longest)
