# Dynamo graph ETQ_Porte_script.dyn (Dynamo 2.18.1.5096)
# packages: Clockwork for Dynamo 2.x 2.3.0, Genius Loci 2020.7.10, spring nodes 203.2.0, spring nodes 204.1.0, Data-Shapes 2022.2.100, archi-lab.net 2022.212.2722, LunchBox for Dynamo 2018.7.7, Genius Loci 2022.3.9

# group: Run it!
reflesh = BoolSelector(true)  # graph input

# group: Input
file_path = Filename("..\..\..\..\..\BPA.png")
fromPath = FileObject(path=file_path)  # "File.FromPath"
readFromFile = Image.ReadFromFile(file=fromPath)
code_block = CodeBlock { "Terminer"; }
code_block_2 = CodeBlock { "Etiquette de Portes"; }
categories = Categories("OST_DoorTags")
all_family_types_of_category = Custom[All Family Types Of Category](category=categories)  # package Clockwork for Dynamo 2.x; Gets all family types/symbols of a given category in the model.
family = FamilyType.Family(familyType=all_family_types_of_category)
code_block_3 = CodeBlock(e=family) { e.Name; }
code_block_4 = CodeBlock(e=all_family_types_of_category) { e.Name; }
code_block_5 = CodeBlock(a=code_block_3, b=code_block_4) { a+"_"+b; }
code_block_6 = CodeBlock { false; }
listview_data = Custom[Listview Data](InputName=code_block_2, Keys=code_block_5, Values=all_family_types_of_category, ShowId_optionnal=code_block_6)  # package Data-Shapes; Create data for ListView input in UI.MultiInputForm ++ . Check out www.data-shapes.net for more infos.
code_block_7 = CodeBlock { "Type de Fichier"; ["Lien","Normal"]; }
dropdown_data = Custom[DropDown Data](InputName=code_block_7.out0, Keys=code_block_7.out1, Values=code_block_7.out1)  # package Data-Shapes; Create data for DropDown input in UI.MultiInputForm ++ . Check out www.data-shapes.net for more infos.
inputgroup_data = Custom[InputGroup Data](GroupTitle=code_block_7.out0, Inputs=dropdown_data)  # package Data-Shapes; Creates a group of inputs for UI.MultipleInputForm ++ . Check out www.data-shapes.net for more infos !
list_create = List.Create(item0=listview_data, item1=inputgroup_data)
code_block_8 = CodeBlock { 200; 500; }
multipleinputform = Custom[MultipleInputForm ++](Logo_optional=readFromFile, ButtonText_optional=code_block, Inputs=list_create, Toggle=reflesh, Width_optional=code_block_8.out1, LabelWidth_optional=code_block_8.out0)  # package Data-Shapes; Create a form with multiple inputs. see www.data-shapes.net for tutorials and infos!
code_block_9 = CodeBlock(x=multipleinputform.User_Inputs) { x[0]; x[1]; }

# group: Select Category
categories_2 = Categories("OST_Doors")

# group: Tag Lieu
etq_position_vantail = StringInput("15")  # graph input
toNumber = String.ToNumber(string=etq_position_vantail)

# group: Tag Offset
etq_décalage_vantail = StringInput("-20")  # graph input
toNumber_2 = String.ToNumber(string=etq_décalage_vantail)

# group: Processing
activeView = Custom[Springs.Doc.ActiveView](refresh=reflesh)  # package spring nodes; Selects the current document's active view. Supports more view types than the built-in option. Will be depreciated once the bult in node works with all plan types.
code_block_10 = CodeBlock(x=code_block_9.out1) { x =="Lien" ? true:false; }
code_block_11 = CodeBlock(views=activeView) { views: var[]; }
getDocuments = archilab.Revit.Selection.Select.GetDocuments()
code_block_12 = CodeBlock(LinkDoc=getDocuments.Link_Doc) { LinkDoc: var[]..[]; }
code_block_13 = CodeBlock(Categories_=categories_2) { Categories_: var[]..[]; }
python_script = Python(IN[0]=code_block_11, IN[1]=code_block_12, IN[2]=code_block_13, IN[3]=reflesh)  # IronPython2
# ---------- python_script.python (81 lines) ----------
import clr
clr.AddReference('RevitAPI')
from Autodesk.Revit.DB import*
clr.AddReference('RevitServices')
from RevitServices.Persistence import DocumentManager
doc = DocumentManager.Instance.CurrentDBDocument
import System
from System.Collections.Generic import *

clr.AddReference('ProtoGeometry')
from Autodesk.DesignScript.Geometry import*
doc = DocumentManager.Instance.CurrentDBDocument

#Inputs
if isinstance(IN[2],list):
	categories = IN[2]
else:
	categories = [UnwrapElement(IN[2])]
	
linkdocs = UnwrapElement(IN[1])

if isinstance(IN[0],list):
	views = UnwrapElement(IN[0])
else:
	views = [UnwrapElement(IN[0])]

collector = []

#getting project base point elevation
basepointfilter = ElementCategoryFilter(BuiltInCategory.OST_ProjectBasePoint)
basepoint = FilteredElementCollector(doc).WherePasses(basepointfilter).ToElements()
bpelevation = [b.ParametersMap.get_Item('Elév.').AsDouble() for b in basepoint]

#Category filter
catfilter = []
for i in categories:
	catfilter.append(ElementCategoryFilter(System.Enum.ToObject(BuiltInCategory, int(str(i.Id)))))

catfilterlist = List[ElementFilter](catfilter)
filter = LogicalOrFilter(catfilterlist)


level = []
for v in views:

	#creating a boundingbox for each view from it's crop box and view range
	bb = v.CropBox
	vr = v.GetViewRange()
	topclip = PlanViewPlane.TopClipPlane
	bottomclip = PlanViewPlane.BottomClipPlane
	cutclip = PlanViewPlane.CutPlane
	toplevel = (doc.GetElement(vr.GetLevelId(topclip)))
	topoffset = vr.GetOffset(topclip)
	cutlevel = (doc.GetElement(vr.GetLevelId(cutclip)))
	cutoffset = vr.GetOffset(cutclip)
	try:
		topZ = toplevel.Elevation + topoffset - bpelevation[0]
	except:
		topZ = cutlevel.Elevation + cutoffset - bpelevation[0]
	bottomlevel = (doc.GetElement(vr.GetLevelId(bottomclip)))
	bottomoffset = vr.GetOffset(bottomclip)
	try:
		bottomZ = bottomlevel.Elevation + bottomoffset - bpelevation[0]
	except :
		bottomZ = cutlevel.Elevation - bpelevation[0]
	min = bb.Min
	max = bb.Max
	newmin = XYZ(min.X,min.Y,bottomZ)
	newmax = XYZ(max.X,max.Y,topZ)
	ol = Outline(newmin,newmax)

	#combining boundingbox and category filters
	bbfilter = BoundingBoxIntersectsFilter(ol)
	andfilter = LogicalAndFilter(filter,bbfilter)

	#collecting elements
	for l in linkdocs:
	
		collector.append(FilteredElementCollector(l).WherePasses(andfilter).ToElements())

OUT = collector
# ----------------------------------------
flatten = List.Flatten(list=python_script)
code_block_14 = CodeBlock(n=flatten) { a=	DSCore.String.Contains(n.Name,"PO_",true); b=	DSCore.List.FilterByBoolMask(n,a)["in"]; }
all_elements_of_category = ElementsOfCategory(Category=categories_2)
IF = Python(IN[0]=code_block_10, IN[1]=code_block_14.b, IN[2]=all_elements_of_category)  # IronPython2
# ---------- IF.python (19 lines) ----------
import clr
clr.AddReference('ProtoGeometry')
from Autodesk.DesignScript.Geometry import *
#The inputs to this node will be stored as a list in the IN variables.

OUT = []

def tolist(obj):
	if hasattr(obj,"__iter__"):
		return obj
	else:
		return [obj]

if IN[0] == True:
	for x in tolist(IN[1]):
		OUT.append(x)
else:
	for x in tolist(IN[2]):
		OUT.append(x)
# ----------------------------------------
python_script_2 = Python(IN[0]=IF)  # IronPython2
# ---------- python_script_2.python (42 lines) ----------
import clr
clr.AddReference("RevitAPI")
import Autodesk
from Autodesk.Revit.DB import *

clr.AddReference("RevitNodes")
import Revit
clr.ImportExtensions(Revit.GeometryConversion)

clr.AddReference('RevitServices')
import RevitServices
from RevitServices.Persistence import DocumentManager
doc = DocumentManager.Instance.CurrentDBDocument

items = UnwrapElement(IN[0]) if isinstance(IN[0], list) else [UnwrapElement(IN[0])]
curveList, subCategories = [], []

opt = Options()
opt.IncludeNonVisibleObjects = False
opt.View = doc.ActiveView

for item in items:
    geoEle = item.get_Geometry(opt)
    if geoEle is not None:
        for geoInstance in geoEle:
            if isinstance(geoInstance, GeometryInstance):
                allCurves, subCategory = [], []
                for symbIns in geoInstance.GetInstanceGeometry():
                    try:
                        if isinstance(symbIns, Curve):
                            allCurves.append(symbIns.ToProtoType())
                            subCategory.append(doc.GetElement(symbIns.GraphicsStyleId).GraphicsStyleCategory.Name)
                    except:
                        pass
                
                curveList.append(allCurves)
                subCategories.append(subCategory)

if isinstance(IN[0], (list)):
    OUT = curveList, subCategories
else:
    OUT = curveList[0], subCategories[0]
# ----------------------------------------
code_block_15 = CodeBlock(x=python_script_2) { x[1]; }
code_block_16 = CodeBlock(x=code_block_15) { x; }
string_from_object = FromObject(object=code_block_16)
code_block_17 = CodeBlock(x=python_script_2) { x[0]; }
code_block_18 = CodeBlock(x=string_from_object, e=code_block_17)
# ---------- code_block_18.designscript (3 lines) ----------
a=	x=="Portes";
b=	DSCore.List.FilterByBoolMask(e,a)["in"];
c=	DSCore.List.FilterByBoolMask(b,DSCore.List.IsEmpty(b@L2<2>))["out"];
# ----------------------------------------
length = Curve.Length(curve=code_block_18.c)
ꟿ_list_maxindex = Custom[ꟿ List.MaxIndex](list=length)  # package spring nodes; Gets the maximum index of a list. Good for use with floating point values
getItemAtIndex = List.GetItemAtIndex(list=code_block_18.c, index=ꟿ_list_maxindex.idx, lacing=Shortest)
code_block_19 = CodeBlock { 0.5; }
pointAtParameter = Curve.PointAtParameter(curve=getItemAtIndex, param=code_block_19)
tangentAtParameter = Curve.TangentAtParameter(curve=getItemAtIndex, param=code_block_19)
translate = Geometry.Translate(geometry=pointAtParameter, direction=tangentAtParameter, distance=toNumber)
handOrientation = Custom[FamilyInstance.HandOrientation](familyInstance=IF)  # package Clockwork for Dynamo 2.x; Gets the hand orientation of a hosted object (e.g. a window or a door)
translate_2 = Geometry.Translate(geometry=translate, direction=handOrientation, distance=toNumber_2)
removeNulls = Lists.Manage.RemoveNulls(Data=translate_2)
element_tolinkinstance = Custom[Element ToLinkInstance](element=IF)  # package Genius Loci; Returns the RevitLinkInstance in which the linked Element resides.
code_block_20 = CodeBlock(x=getDocuments.Link_Doc, c=getDocuments.Link_Instance) { a=	x==null ? true:false; b=	DSCore.List.FilterByBoolMask(c,a)["out"]; }
code_block_21 = CodeBlock { null; }
IF_2 = Python(IN[0]=code_block_10, IN[1]=code_block_20.b, IN[2]=code_block_21)  # IronPython2; same code as IF

# group: ToRevit
create_independent_tag = Custom[Create Independent Tag](view=activeView, element=IF, TagLocation=removeNulls.Cleaned, TagType=code_block_9.out0, LinkInstance=element_tolinkinstance.RevitLinkInstance, RunIt=reflesh, lacing=Longest)  # package Genius Loci; Works only in Revit 2018 and later. Creates a tag at a given location, of given type and in a supplied view. The node also works with Linked Elements (except space and area), Multi Category tag and Material Tag. Based on an archilab node

# group: Tag Leader Line
code_block_22 = CodeBlock { "Ligne de repère"; 0; }
setParameterByName = Element.SetParameterByName(element=create_independent_tag, parameterName=code_block_22.out0, value=code_block_22.out1)

# group: Tag Leader_Angle
code_block_23 = CodeBlock { "Angle"; }
XAxis = Vector.XAxis()
ZAxis = Vector.ZAxis()
angleAboutAxis = Vector.AngleAboutAxis(vector=tangentAtParameter, otherVector=XAxis, rotationAxis=ZAxis)
round = Custom[Rounding.Round+](dbl=angleAboutAxis)  # package Clockwork for Dynamo 2.x; Rounds a number to a specified precision
code_block_24 = CodeBlock(x=round) { -x; }
setParameterByName_2 = Element.SetParameterByName(element=setParameterByName, parameterName=code_block_23, value=code_block_24)

count = List.Count(list=setParameterByName_2)
passthrough = Custom[Passthrough](passThrough=count, waitFor=setParameterByName_2)  # package Clockwork for Dynamo 2.x; Forces a sequential order of execution. The node wired into the output of the Passthrough node will be executed *after* the node wired into the waitFor input (e.g. important for some Revit operations). The value of the passThrough input will be passed on to the node wired into the output port of the Passthrough node.
progressDynamoı = Custom[ProgressDynamoı](Processing=passthrough)
