# Dynamo graph Ligne TN_script.dyn (Dynamo 2.18.1.5096)
# packages: spring nodes 204.1.0, Clockwork for Dynamo 2.x 2.3.0, Data-Shapes 2022.2.100, archi-lab.net 2022.212.2722, LunchBox for Dynamo 2018.7.7, Clockwork for Dynamo 2.x 2.6.0, spring nodes 210.1.1

boolean = BoolSelector(true)  # graph input
ꟿ_document_activeview = Custom[ꟿ Document.ActiveView](refresh=boolean)  # package spring nodes; Selects the current document's active view. Supports more view types than the built-in option. Will be depreciated once the bult in node works with all plan types.
plane = Custom[View.Plane](view=ꟿ_document_activeview)  # package Clockwork for Dynamo 2.x; Retrieves the plane of a given view
code_block = CodeBlock(plane=plane) { plane: Autodesk.DesignScript.Geometry.Plane; }

# group: Input
file_path = Filename("..\..\..\..\..\BPA.png")
fromPath = FileObject(path=file_path)  # "File.FromPath"
readFromFile = Image.ReadFromFile(file=fromPath)
code_block_2 = CodeBlock { "Terminer"; }
code_block_3 = CodeBlock { "Type de Ligne pour TN"; "Choisir de Topography"; }
get_all_line_styles = Custom[Get All Line Styles]()  # package archi-lab.net; This node will return all available line styles.
code_block_4 = CodeBlock(n=get_all_line_styles) { n.Name; }
dropdown_data = Custom[DropDown Data](InputName=code_block_3.out0, Keys=code_block_4, Values=get_all_line_styles)  # package Data-Shapes; Create data for DropDown input in UI.MultiInputForm ++ . Check out www.data-shapes.net for more infos.
categories = Categories("OST_Toposolid")
boolean_2 = BoolSelector(true)
selectmodelelements_data = Custom[SelectModelElements Data](ButtonText=code_block_3.out1, CategoryFilter=categories, SelectSingleElement=boolean_2)  # package Data-Shapes; Creates a Revit element selection input for UI.MultipleInputForm++ . Check out www.data-shapes.net for more infos!
list_create = List.Create(item0=dropdown_data, item1=selectmodelelements_data)
multipleinputform = Custom[MultipleInputForm ++](Logo_optional=readFromFile, ButtonText_optional=code_block_2, Inputs=list_create, Toggle=boolean_2)  # package Data-Shapes; Create a form with multiple inputs. see www.data-shapes.net for tutorials and infos!
code_block_5 = CodeBlock(x=multipleinputform.User_Inputs) { x[0]; x[1]; }

ꟿ_element_meshgeometry = Custom[ꟿ Element.MeshGeometry](element=code_block_5.out1)  # package spring nodes; Reads an element's geometry and converts it to either a Dynamo mesh or a toolkit mesh representation. The node will return Dynamo meshes by default. The LOD input represents the triangulation factor. Its range is from 0 to 1. 0 is the lowest level of detail and 1 is the highest. It's set to 0 by default.
intersectWithPlane = Custom[Mesh.IntersectWithPlane](plane=code_block, mesh=ꟿ_element_meshgeometry)  # package Clockwork for Dynamo 2.x; Calculates the intersection of a mesh and a plane
removeNulls = Lists.Manage.RemoveNulls(Data=intersectWithPlane.polyCurve)
byJoinedCurves = PolyCurve.ByJoinedCurves(curves=removeNulls.Cleaned)
curves = PolyCurve.Curves(polyCurve=byJoinedCurves)
byCurve = Custom[DetailCurve.ByCurve+](curve=curves, view=ꟿ_document_activeview)  # package Clockwork for Dynamo 2.x; Creates a detail line based on a given curve. Unlike the OOTB node it can also draw circles.
code_block_6 = CodeBlock(e=byCurve, x=code_block_5.out0) { Revit.Elements.Element.SetParameterByName(e,"Style de ligne",x); }
