# Dynamo graph SHAB_script.dyn (Dynamo 2.19.3.6394)
# packages: Data-Shapes 2022.2.100, Clockwork for Dynamo 2.x 2.3.0

categories = Categories("OST_Rooms")  # graph input
all_elements_of_category = ElementsOfCategory(Category=categories)
clear = CodeBlock(x=all_elements_of_category) { x; }
code_block = CodeBlock { "N° Logement / N° Local"; }
parameterByName = Parameter.ParameterByName(element=clear, name=code_block)
isNull = Object.IsNull(object=parameterByName)
not_ = Not(x=isNull)
code_block_2 = CodeBlock(x=not_) { x[0]; }

# group: ANCIEN
ancien = CodeBlock(e=clear) { Revit.Elements.Element.GetParameterValueByName(e,"N° Logement / N° Local"); }

# group: NEUF
x = CodeBlock(e=clear) { Revit.Elements.Element.GetParameterValueByName(e,"Surface Extérieure"); }
code_block_3 = CodeBlock(x=x, e=clear) { a=	x==0 ? true:false; b=	DSCore.List.FilterByBoolMask(e,a)["in"]; }
IF = Python(IN[0]=code_block_2, IN[1]=clear, IN[2]=code_block_3.b)  # IronPython2
# ---------- IF.python (19 lines) ----------
import clr
clr.AddReference('ProtoGeometry')
from Autodesk.DesignScript.Geometry import *
#The inputs to this node will be stored as a list in the IN variables.

OUT = []

def tolist(obj):
	if hasattr(obj,"__iter__"):
		return obj
	else:
		return [obj]

if IN[0] == True:
	for x in tolist(IN[1]):
		OUT.append(x)
else:
	for x in tolist(IN[2]):
		OUT.append(x)
# ----------------------------------------
code_block_4 = CodeBlock(e=code_block_3.b) { Revit.Elements.Element.GetParameterValueByName(e,"N° Local"); }
IF_2 = Python(IN[0]=code_block_2, IN[1]=ancien, IN[2]=code_block_4)  # IronPython2; same code as IF
groupByKey = List.GroupByKey(list=IF, keys=IF_2)
code_block_5 = CodeBlock(x=groupByKey.groups) { a=	x.Name=="Terrasse" ? true:false; b=	DSCore.List.FilterByBoolMask(x,a)["out"]; }
code_block_6 = CodeBlock(n=code_block_5.b) { n.Name; }
code_block_7 = CodeBlock { "Séjour"; }
contains = String.Contains(string=code_block_6, searchFor=code_block_7)
filterByBoolMask = List.FilterByBoolMask(list=code_block_5.b, mask=contains)
area = Room.Area(room=code_block_5.b)
code_block_8 = CodeBlock { 0.1; }
code_block_9 = CodeBlock { 1; }
code_block_10 = CodeBlock(n=code_block_5.b) { n.Name; }

round = Custom[Rounding.Round+](dbl=area, precision=code_block_8)  # package Clockwork for Dynamo 2.x; Rounds a number to a specified precision

# group (continued): NEUF
round_2 = Custom[Rounding.Round+](dbl=round, precision=code_block_8)
sum = Math.Sum(values=round_2)
chop = List.Chop(list=sum, lengths=code_block_9)
code_block_11 = CodeBlock(e=filterByBoolMask.in, x=chop) { Revit.Elements.Element.SetParameterByName(e,"SHAB Appartement",x); }

python_script = Python()  # IronPython2; unwired: IN[0]
# ---------- python_script.python (39 lines) ----------
#Copyright(c) 2015, Konrad Sobon
# @arch_laboratory, http://archi-lab.net

import clr
clr.AddReference('ProtoGeometry')
from Autodesk.DesignScript.Geometry import *

# Import ToDSType(bool) extension method
clr.AddReference("RevitNodes")
import Revit
clr.ImportExtensions(Revit.Elements)

# Import DocumentManager and TransactionManager
clr.AddReference("RevitServices")
import RevitServices
from RevitServices.Persistence import DocumentManager
from RevitServices.Transactions import TransactionManager

from System.Collections.Generic import *

# Import RevitAPI
clr.AddReference("RevitAPI")
import Autodesk
from Autodesk.Revit.DB import *

doc = DocumentManager.Instance.CurrentDBDocument
uiapp = DocumentManager.Instance.CurrentUIApplication
app = uiapp.Application

#The inputs to this node will be stored as a list in the IN variable.
dataEnteringNode = IN

#get all design options in the model
designOp = FilteredElementCollector(doc).OfClass(DesignOption).ToElements()
designOpNames = []
for i in designOp:
	designOpNames.append(i.Name.ToString())
#Assign your output to the OUT variable
OUT = designOp, designOpNames
# ----------------------------------------
number = DoubleInput(1)  # graph input
getItemAtIndex = List.GetItemAtIndex(list=python_script, index=number)
code_block_12 = CodeBlock(names=getItemAtIndex) { _names; }
number_2 = DoubleInput(0)  # graph input
getItemAtIndex_2 = List.GetItemAtIndex(list=python_script, index=number_2)
code_block_13 = CodeBlock(designOptions=getItemAtIndex_2) { _designOptions; }
code_block_14 = CodeBlock { false; }

# group: Input
file_path = Filename("..\..\..\..\..\BPA.png")
fromPath = FileObject(path=file_path)  # "File.FromPath"
readFromFile = Image.ReadFromFile(file=fromPath)
code_block_15 = CodeBlock { "BPA ARCHITECTURE"; "Terminer"; }
code_block_16 = CodeBlock { "Variantes"; }
listview_data = Custom[Listview Data](InputName=code_block_16, Keys=code_block_12, Values=code_block_13, ShowId_optionnal=code_block_14)  # package Data-Shapes; Create data for ListView input in UI.MultiInputForm ++ . Check out www.data-shapes.net for more infos.
boolean = BoolSelector(true)
code_block_17 = CodeBlock { 150; 500; }
multipleinputform = Custom[MultipleInputForm ++](Logo_optional=readFromFile, ButtonText_optional=code_block_15.out1, Inputs=listview_data, Toggle=boolean, Width_optional=code_block_17.out1, LabelWidth_optional=code_block_17.out0)  # package Data-Shapes; Create a form with multiple inputs. see www.data-shapes.net for tutorials and infos!

code_block_18 = CodeBlock(x=multipleinputform.User_Inputs) { x[0]; }
isEmpty = List.IsEmpty(list=code_block_18)
python_script_2 = Python(IN[0]=isEmpty)  # IronPython2
# ---------- python_script_2.python (35 lines) ----------
import clr

#reference loaded dynamo revit module
clr.AddReference('DynamoRevitDS')
import Dynamo 

#reference dynamo core to update node values
clr.AddReference('DynamoCore')

#access to the current Dynamo instance and workspace
dynamoRevit = Dynamo.Applications.DynamoRevit()
currentWorkspace = dynamoRevit.RevitDynamoModel.CurrentWorkspace

branch1 = None
branch2 = None

#find the branch nodes
for i in currentWorkspace.Nodes:
	if i.Name.Equals("Clear"):
		branch1 = i
	elif i.Name.Equals("Variantes"):
		branch2 = i	
	
#freeze/unfreeze branch nodes
if IN[0]:
	branch1.IsFrozen = False
	branch2.IsFrozen = True
	out = "Running Branch 1."
else:
	branch1.IsFrozen = True
	branch2.IsFrozen = False
	out = "Running Branch 2."

#return confirmation
OUT = out
# ----------------------------------------
code_block_19 = CodeBlock { "N° Logement / N° Local"; }
parameterByName_2 = Parameter.ParameterByName(element=clear, name=code_block_19)
isNull_2 = Object.IsNull(object=parameterByName_2)
not_2 = Not(x=isNull_2)
code_block_20 = CodeBlock(x=not_2) { x[0]; }
variantes = CodeBlock(e=all_elements_of_category) { Revit.Elements.Element.GetParameterValueByName(e,"Variantes"); }
indexOf = List.IndexOf(list=variantes, element=multipleinputform.User_Inputs, lacing=Longest)
code_block_21 = CodeBlock(a=indexOf) { a==0 ? true:false; }
flatten = List.Flatten(list=code_block_21)
filterByBoolMask_2 = List.FilterByBoolMask(list=all_elements_of_category, mask=flatten)

# group: NEUF
x_2 = CodeBlock(e=filterByBoolMask_2.in) { Revit.Elements.Element.GetParameterValueByName(e,"Surface Extérieure"); }
code_block_22 = CodeBlock(x=x_2, e=filterByBoolMask_2.in) { a=	x==0 ? true:false; b=	DSCore.List.FilterByBoolMask(e,a)["in"]; }
code_block_23 = CodeBlock(e=code_block_22.b) { Revit.Elements.Element.GetParameterValueByName(e,"N° Local"); }
code_block_24 = CodeBlock { "Séjour"; }
code_block_25 = CodeBlock { 1; }

IF_3 = Python(IN[0]=code_block_20, IN[1]=filterByBoolMask_2.in, IN[2]=code_block_22.b)  # IronPython2; same code as IF

# group: ANCIEN
ancien_2 = CodeBlock(e=filterByBoolMask_2.in) { Revit.Elements.Element.GetParameterValueByName(e,"N° Logement / N° Local"); }

IF_4 = Python(IN[0]=code_block_20, IN[1]=ancien_2, IN[2]=code_block_23)  # IronPython2; same code as IF

# group (continued): NEUF
groupByKey_2 = List.GroupByKey(list=IF_3, keys=IF_4)
code_block_26 = CodeBlock(x=groupByKey_2.groups) { a=	x.Name=="Terrasse" ? true:false; b=	DSCore.List.FilterByBoolMask(x,a)["out"]; }
code_block_27 = CodeBlock(n=code_block_26.b) { n.Name; }
code_block_28 = CodeBlock(n=code_block_26.b) { n.Name; }
contains_2 = String.Contains(string=code_block_28, searchFor=code_block_24)
filterByBoolMask_3 = List.FilterByBoolMask(list=code_block_26.b, mask=contains_2)
area_2 = Room.Area(room=code_block_26.b)

code_block_29 = CodeBlock { 0.1; }
round_3 = Custom[Rounding.Round+](dbl=area_2, precision=code_block_29)
round_4 = Custom[Rounding.Round+](dbl=round_3, precision=code_block_29)

# group (continued): NEUF
chop_2 = List.Chop(list=round_4, lengths=code_block_25)
code_block_30 = CodeBlock(e=filterByBoolMask_3.in, x=chop_2) { Revit.Elements.Element.SetParameterByName(e,"SHAB Appartement",x); }
