# Dynamo graph Viewport_script.dyn (Dynamo 2.18.1.5096)
# packages: archi-lab.net 2022.212.2722, Clockwork for Dynamo 2.x 2.3.0

YAxis = Vector.YAxis()
python_script = Python(IN[0]=YAxis)  # IronPython2
# ---------- python_script.python (69 lines) ----------
#@Durmus Bayryam

import sys
import os

localapp = os.getenv(r'LOCALAPPDATA')

sys.path.append(os.path.join(localapp, r'python-3.8.3-embed-amd64\Lib\site-packages'))

import clr
clr.AddReference('RevitAPI')
import Autodesk
from Autodesk.Revit.DB import *

clr.AddReference("RevitServices")
import RevitServices
from RevitServices.Persistence import DocumentManager
from RevitServices.Transactions import TransactionManager

clr.AddReference("RevitAPIUI")
from  Autodesk.Revit.UI import *

clr.AddReference('ProtoGeometry')
from Autodesk.DesignScript.Geometry import *

clr.AddReference('DSCoreNodes') 
import DSCore
from DSCore import *

clr.AddReference("RevitNodes")
import Revit
clr.ImportExtensions(Revit.GeometryConversion)
clr.ImportExtensions(Revit.Elements)

# Current doc/app/ui
doc = DocumentManager.Instance.CurrentDBDocument
uiapp = DocumentManager.Instance.CurrentUIApplication 
app = uiapp.Application 
uidoc = uiapp.ActiveUIDocument
ac = doc.ActiveView.ToDSType(True)

# Inputs and variables
uisel  = uidoc.Selection



msg    = 'Appuyer "Fermer" et dessiner une rectangle'
TaskDialog.Show("BPA-Viewport", msg)

pb = Autodesk.Revit.UI.Selection.PickBoxStyle.Crossing
box= uisel.PickBox(pb,"Desinner Rectangle")

minP = box.Min
maxP = box.Max

p1 = Point.ByCoordinates(minP.X*30.4,minP.Y*30.4,minP.Z*30.4)
p2 = Point.ByCoordinates(maxP.X*30.4,maxP.Y*30.4,maxP.Z*30.4)




l1 = Line.ByStartPointEndPoint(p1,p2)
l1p = Curve.PointAtParameter(l1,0.5)
a= Geometry.Rotate(l1,l1p,IN[0],180)
l2s = Curve.PointAtParameter(a,0)
l2e = Curve.PointAtParameter(a,1)
rec = Rectangle.ByCornerPoints(p1,l2s,p2,l2e)

OUT = ac,rec
# ----------------------------------------
code_block = CodeBlock(x=python_script) { x[0]; x[1]; }
now = DateTime.Now()
string_from_object = FromObject(object=now)
code_block_2 = CodeBlock { " "; }
split = String.Split(string=string_from_object, separator0=code_block_2)
code_block_3 = CodeBlock(x=split) { x[1]; }
code_block_4 = CodeBlock { ":"; ""; }
replace = String.Replace(string=code_block_3, searchFor=code_block_4.out0, replaceWith=code_block_4.out1)
code_block_5 = CodeBlock(x=replace) { "Test"+x; }
duplicateAsDependent = Custom[View.DuplicateAsDependent](view=code_block.out0, name=code_block_5)  # package Clockwork for Dynamo 2.x; Duplicates a given view as a dependent view
explode = Geometry.Explode(geometry=code_block.out1)
setCropBoxByCurves = archilab.Revit.Views.Views.SetCropBoxByCurves(view=duplicateAsDependent, curves=explode)
