# Dynamo graph PDV-Prépare_script.dyn (Dynamo 2.19.3.6394)
# packages: archi-lab.net 2022.210.2522, Orchid 206.3.0.7900, Clockwork for Dynamo 2.x 2.3.0, archi-lab.net 2022.212.2722, Rhythm 2022.1.5, Genius Loci 2022.3.9, spring nodes 204.1.0, LunchBox for Dynamo 2018.7.7, archi-lab.net 2024.217.1024, spring nodes 210.1.1, Data-Shapes 2024.2.113, Clockwork for Dynamo 2.x 2.6.0, bimorphNodes 5.1.3

actulaise = BoolSelector(false)  # graph input
python_script = Python(IN[0]=actulaise)  # IronPython2
# ---------- python_script.python (12 lines) ----------
# @ Copyright - Designed by André Abotnes andre.abotnes@norconsult.com
import clr
# Import DocumentManager and TransactionManager
clr.AddReference('RevitServices')
import RevitServices
from RevitServices.Persistence import DocumentManager

if IN[0]:
	pass
doc = DocumentManager.Instance.CurrentDBDocument

OUT = doc.ActiveView
# ----------------------------------------

# group: Input
file_path = Filename("..\..\..\..\..\BPA.png")
fromPath = FileObject(path=file_path)  # "File.FromPath"
readFromFile = Image.ReadFromFile(file=fromPath)
code_block = CodeBlock { "PDV-Prépare"; "Suivant"; "Terminer"; }
code_block_2 = CodeBlock { "Cartouche"; "Type de Gabarit"; "Nouvelle"; "Vielle"; "Type de Zone Remplisage"; "Choisir de Niveau"; }
list_create = List.Create(item0=code_block_2.out2, item1=code_block_2.out3)
dropdown_data = Custom[DropDown Data](InputName=code_block_2.out1, Keys=list_create, Values=list_create)  # package Data-Shapes; Create data for DropDown input in UI.MultiInputForm ++ . Check out www.data-shapes.net for more infos.
element_types = ElementTypes("FilledRegionType")
all_elements_of_type = ElementsOfType(element_class=element_types)
code_block_3 = CodeBlock(n=all_elements_of_type) { n.Name; }
dropdown_data_2 = Custom[DropDown Data](InputName=code_block_2.out4, Keys=code_block_3, Values=all_elements_of_type)
list_create_2 = List.Create(item0=dropdown_data, item1=dropdown_data_2)
inputgroup_data = Custom[InputGroup Data](GroupTitle=code_block.out0, Inputs=list_create_2)  # package Data-Shapes; Creates a group of inputs for UI.MultipleInputForm ++ . Check out www.data-shapes.net for more infos !
boolean = BoolSelector(false)
multipleinputform = Custom[MultipleInputForm ++](Logo_optional=readFromFile, ButtonText_optional=code_block.out1, Inputs=inputgroup_data, Toggle=boolean)  # package Data-Shapes; Create a form with multiple inputs. see www.data-shapes.net for tutorials and infos!
code_block_4 = CodeBlock(x=multipleinputform.User_Inputs) { x[0]; }
code_block_5 = CodeBlock(x=multipleinputform.User_Inputs) { x[1]; }

# group: Input
code_block_6 = CodeBlock { "Choisir Fichier"; }
getDocuments = archilab.Revit.Selection.Select.GetDocuments()
dropdown_data_3 = Custom[DropDown Data](InputName=code_block_6, Keys=getDocuments.Link_Name, Values=getDocuments.Link_Instance)
inputgroup_data_2 = Custom[InputGroup Data](GroupTitle=code_block.out0, Inputs=dropdown_data_3)

passthrough = Custom[Passthrough](passThrough=inputgroup_data_2, waitFor=multipleinputform.User_Inputs)  # package Clockwork for Dynamo 2.x; Forces a sequential order of execution. The node wired into the output of the Passthrough node will be executed *after* the node wired into the waitFor input (e.g. important for some Revit operations). The value of the passThrough input will be passed on to the node wired into the output port of the Passthrough node.

# group (continued): Input
multipleinputform_2 = Custom[MultipleInputForm ++](Logo_optional=readFromFile, ButtonText_optional=code_block.out1, Inputs=passthrough, Toggle=boolean)

# group: Input
code_block_7 = CodeBlock { "Choisir Niveau"; }
categories = Categories("OST_Levels")
ofCategory = Revit.LinkElement.OfCategory(linkInstance=multipleinputform_2.User_Inputs, category=categories)
code_block_8 = CodeBlock(n=ofCategory) { n.Name; }
dropdown_data_4 = Custom[DropDown Data](InputName=code_block_7, Keys=code_block_8, Values=ofCategory)
inputgroup_data_3 = Custom[InputGroup Data](GroupTitle=code_block.out0, Inputs=dropdown_data_4)

passthrough_2 = Custom[Passthrough](passThrough=inputgroup_data_3, waitFor=multipleinputform_2.User_Inputs)

# group (continued): Input
multipleinputform_3 = Custom[MultipleInputForm ++](Logo_optional=readFromFile, ButtonText_optional=code_block.out2, Inputs=passthrough_2, Toggle=boolean)

code_block_9 = CodeBlock(x=multipleinputform_3.User_Inputs) { x[0]; }
code_block_10 = CodeBlock(n=code_block_9) { n.Name; }
string_from_object = FromObject(object=code_block_4)
code_block_11 = CodeBlock(x=string_from_object) { x=="Vielle" ? true:false; }
categories_2 = Categories("OST_Rooms")
code_block_12 = CodeBlock(x=multipleinputform_2.User_Inputs) { x[0]; }
all_elements_of_category = Custom[All Elements Of Category+](category=categories_2, docOrRevitLinkInstance=code_block_12)  # package Clockwork for Dynamo 2.x; Gets all placed elements of a given category in the model. Unlike the OOTB node it also supports linked models and a few more special categories (e.g. Legend Components).
flatten = List.Flatten(list=all_elements_of_category)
code_block_13 = CodeBlock(e=all_elements_of_category) { Revit.Elements.Element.GetParameterValueByName(e,"Niveau"); }
flatten_2 = List.Flatten(list=code_block_13)
groupByKey = List.GroupByKey(list=flatten, keys=flatten_2)
# note: Ancien Gabarit
code_block_14 = CodeBlock(tniv=groupByKey.uniqueKeys, niv=code_block_9, tpic=groupByKey.groups)
# ---------- code_block_14.designscript (9 lines) ----------
a=		DSCore.String.Contains(tniv,niv.Name,true);
Niveau=	DSCore.List.FilterByBoolMask(tniv,a)["in"];

Pièces=	DSCore.List.Flatten(DSCore.List.FilterByBoolMask(tpic,a)["in"]);

Nom=	Revit.Elements.Element.GetParameterValueByName(Pièces,"N° Logement / N° Local");
b=		Nom=="" ? false:true;
filtnom=	DSCore.List.FilterByBoolMask(Nom,b)["in"];
filtpic=	DSCore.List.FilterByBoolMask(Pièces,b)["in"];
# ----------------------------------------
groupByKey_2 = List.GroupByKey(list=code_block_14.filtpic@L2, keys=code_block_14.filtnom@L2)

# group: Pièces
code_block_15 = CodeBlock(x=groupByKey_2.groups, rom=groupByKey_2.groups, nom=groupByKey_2.groups)
# ---------- code_block_15.designscript (3 lines) ----------
fil=	DSCore.List.Count(x@L2<1>)>1 ? true:false;
room=	DSCore.List.FilterByBoolMask(rom@L3<1>,fil)["in"];
num=	Revit.Elements.Element.GetParameterValueByName(DSCore.List.FilterByBoolMask(nom@L3<1>,fil)["in"],"N° Logement / N° Local");
# ----------------------------------------

uniqueItems = List.UniqueItems(list=code_block_15.num@L2)
# note: Nouvelle Gabarit
code_block_16 = CodeBlock(tniv=groupByKey.uniqueKeys, niv=code_block_9, tpic=groupByKey.groups)
# ---------- code_block_16.designscript (9 lines) ----------
a=		DSCore.String.Contains(tniv,niv.Name,true);
Niveau=	DSCore.List.FilterByBoolMask(tniv,a)["in"];

Pièces=	DSCore.List.Flatten(DSCore.List.FilterByBoolMask(tpic,a)["in"]);

Nom=	Revit.Elements.Element.GetParameterValueByName(Pièces,"N° Local");
b=		Nom=="" ? false:true;
filtnom=	DSCore.List.FilterByBoolMask(Nom,b)["in"];
filtpic=	DSCore.List.FilterByBoolMask(Pièces,b)["in"];
# ----------------------------------------
groupByKey_3 = List.GroupByKey(list=code_block_16.filtpic@L2, keys=code_block_16.filtnom@L2)

# group: Pièces
code_block_17 = CodeBlock(x=groupByKey_3.groups, rom=groupByKey_3.groups, nom=groupByKey_3.groups)
# ---------- code_block_17.designscript (3 lines) ----------
fil=	DSCore.List.Count(x@L2<1>)>1 ? true:false;
room=	DSCore.List.FilterByBoolMask(rom@L3<1>,fil)["in"];
num=	Revit.Elements.Element.GetParameterValueByName(DSCore.List.FilterByBoolMask(nom@L3<1>,fil)["in"],"N° Local");
# ----------------------------------------

uniqueItems_2 = List.UniqueItems(list=code_block_17.num@L2)
IF = Python(IN[0]=code_block_11, IN[1]=uniqueItems, IN[2]=uniqueItems_2)  # IronPython2
# ---------- IF.python (19 lines) ----------
import clr
clr.AddReference('ProtoGeometry')
from Autodesk.DesignScript.Geometry import *
#The inputs to this node will be stored as a list in the IN variables.

OUT = []

def tolist(obj):
	if hasattr(obj,"__iter__"):
		return obj
	else:
		return [obj]

if IN[0] == True:
	for x in tolist(IN[1]):
		OUT.append(x)
else:
	for x in tolist(IN[2]):
		OUT.append(x)
# ----------------------------------------
code_block_18 = CodeBlock(x=IF) { DSCore.List.Flatten(x); }
code_block_19 = CodeBlock(Niveau=code_block_10, APT=code_block_18) { "PDV-Localisation" + "_"+ Niveau +"-"+ APT; }
string_from_object_2 = FromObject(obj=code_block_19)
duplicate_options = DuplicateOptionsUi("Duplicate")

# group: Duplique plan Localisation
duplicate = archilab.Revit.Views.Views.Duplicate(view=python_script, name=string_from_object_2, options=duplicate_options)

# group: Localisation
code_block_20 = CodeBlock(e=duplicate) { Revit.Elements.Element.SetParameterByName(e,"Classement","PDV_Localisation"); }

code_block_21 = CodeBlock(n=code_block_9) { n.Name; }
code_block_22 = CodeBlock(Niveau=code_block_21) { "PDV-SYN" + "_"+ Niveau; }
string_from_object_3 = FromObject(obj=code_block_22)
duplicate_options_2 = DuplicateOptionsUi("Duplicate")

# group: Duplique plan Synoptique
duplicate_2 = archilab.Revit.Views.Views.Duplicate(view=python_script, name=string_from_object_3, options=duplicate_options_2)

# group: Synoptique
code_block_23 = CodeBlock(e=duplicate_2) { Revit.Elements.Element.SetParameterByName(e,"Classement","PDV_Synoptique"); }

code_block_24 = CodeBlock(n=code_block_9) { n.Name; }
code_block_25 = CodeBlock(x=IF) { DSCore.List.Flatten(x); }
code_block_26 = CodeBlock(Niveau=code_block_24, APT=code_block_25) { "PDV" + "_"+ Niveau +"-"+ APT+"_"; }
string_from_object_4 = FromObject(obj=code_block_26)
duplicate_options_3 = DuplicateOptionsUi("Duplicate")

# group: Duplique de la Vue
duplicate_3 = archilab.Revit.Views.Views.Duplicate(view=python_script, name=string_from_object_4, options=duplicate_options_3)

ʳʰʸᵗʰᵐ_view_getcropregionelement = Rhythm.Revit.Views.View.GetCropRegionElement(view=duplicate_3)  # frozen
start = Revit.Transaction.Transaction.Start(input=ʳʰʸᵗʰᵐ_view_getcropregionelement)
categories_3 = Categories("OST_Doors")  # frozen
all_elements_of_category_2 = Custom[All Elements Of Category+](category=categories_3, toggle=actulaise, docOrRevitLinkInstance=code_block_12)
type = archilab.Revit.Elements.Elements.Type(element=all_elements_of_category_2)
code_block_27 = CodeBlock(x=type, e=all_elements_of_category_2)
# ---------- code_block_27.designscript (5 lines) ----------
a=	"ARC_PO_MIN_1O-Palière";

b=	DSCore.String.Contains(DSCore.String.FromObject(x),a,true);
c=	DSCore.List.FilterByBoolMask(e,b)["in"];
d=	Revit.Elements.Element.GetParameterValueByName(c,"N° Local");
# ----------------------------------------
indexOf = List.IndexOf(list=code_block_27.d, element=code_block_18)
getItemAtIndex = List.GetItemAtIndex(list=code_block_27.c, index=indexOf)
handOrientation = Custom[FamilyInstance.HandOrientation](familyInstance=getItemAtIndex)  # package Clockwork for Dynamo 2.x; Gets the hand orientation of a hosted object (e.g. a window or a door)
ZAxis = Vector.ZAxis()
code_block_28 = CodeBlock { -90; }
rotate = Vector.Rotate(vector=handOrientation, axis=ZAxis, degrees=code_block_28)
YAxis = Vector.YAxis()
angleAboutAxis = Vector.AngleAboutAxis(vector=rotate, otherVector=YAxis, rotationAxis=ZAxis)
passThrough = Custom[PassThrough](passThrough=angleAboutAxis, waitFor=start)  # package archi-lab.net; Ripped this off from Clockwork. Sorry Andy.
element_setrotation = Custom[Element SetRotation](element=start, degree=passThrough)  # package Genius Loci; Set the angle of the element around its local Z-axis. (Same as the Rotate command in Revit)
passThrough_2 = Custom[PassThrough](passThrough=duplicate_3, waitFor=element_setrotation)
IF_2 = Python(IN[0]=code_block_11, IN[1]=code_block_15.room, IN[2]=code_block_17.room)  # IronPython2; same code as IF

# group: Filtre and Collector_ Curve
centerBoundary = Room.CenterBoundary(room=IF_2@L2)
byJoinedCurves = PolyCurve.ByJoinedCurves(curves=centerBoundary)
flatten_3 = List.Flatten()  # unwired: list
map = List.Map(list=byJoinedCurves, f_x=flatten_3)
code_block_29 = CodeBlock { 1000; }
offsetMany = Curve.OffsetMany(curve=map, signedDistance=code_block_29)
code_block_30 = CodeBlock(x=code_block_29) { -x; }
offsetMany_2 = Curve.OffsetMany(curve=offsetMany, signedDistance=code_block_30)
code_block_31 = CodeBlock { 9; }
offsetMany_3 = Curve.OffsetMany(curve=offsetMany_2, signedDistance=code_block_31)
ZAxis_2 = Vector.ZAxis()
code_block_32 = CodeBlock { 10; }
extrudeAsSolid = Curve.ExtrudeAsSolid(curve=offsetMany_3, direction=ZAxis_2, distance=code_block_32)
removeNulls = Lists.Manage.RemoveNulls(Data=extrudeAsSolid)
byUnion = Solid.ByUnion(solids=removeNulls.Cleaned)
centroid = Solid.Centroid(solid=byUnion)
byOriginNormal = Plane.ByOriginNormal(origin=centroid)
intersect = Geometry.Intersect(geometry=byUnion, other=byOriginNormal)
outerPerimeterCurves = AnalyticalAutomation.Geometry.Surface.OuterPerimeterCurves(surface=intersect)
map_2 = List.Map(list=outerPerimeterCurves, function=flatten_3)
offsetMany_4 = Curve.OffsetMany(curve=map_2, signedDistance=code_block_29)
offsetMany_5 = Curve.OffsetMany(curve=offsetMany_4, signedDistance=code_block_30)
offsetMany_6 = Curve.OffsetMany(curve=offsetMany_5, signedDistance=code_block_31)
explode = Geometry.Explode(geometry=offsetMany_6)
map_3 = List.Map(list=explode, function=flatten_3)
ꟿ_curveloop_simplify = Custom[ꟿ CurveLoop.Simplify](curveLoop=map_3)  # package spring nodes; Attempts to simplify an open or a closed curve loop by connecting straight separate line segments into a single line.
removeNulls_2 = Lists.Manage.RemoveNulls(Data=ꟿ_curveloop_simplify)
byJoinedCurves_2 = PolyCurve.ByJoinedCurves(curves=removeNulls_2.Cleaned)
closeWithLine = PolyCurve.CloseWithLine(polyCurve=byJoinedCurves_2)
explode_2 = Geometry.Explode(geometry=closeWithLine)

# group: Contour de la Vue
setCropBox = Orchid.RevitProject.Views.View.SetCropBox(view=passThrough_2, curve=explode_2)

removeNulls_3 = Lists.Manage.RemoveNulls(Data=setCropBox)

# group: Plan
code_block_33 = CodeBlock(e=removeNulls_3.Cleaned) { Revit.Elements.Element.SetParameterByName(e,"Classement","PDV_Plans"); }

# group: Zone de Remplisage
byCurves = FilledRegion.ByCurves(view=duplicate, boundary=explode_2, regionType=code_block_5)

code_block_34 = CodeBlock(pdv=duplicate_3) { DSCore.List.Flatten(pdv); }
code_block_35 = CodeBlock(n=code_block_34)
# ---------- code_block_35.designscript (11 lines) ----------
// Filter Vue
a=		DSCore.String.Contains(n.Name,"PDV_",true);
PDV=	DSCore.List.FilterByBoolMask(n,a)["in"];

//Processing sheets
number= "PDV_" + (1..DSCore.List.Count(name));
name=	DSCore.String.Replace(PDV.Name,"PDV_","");

log=	DSCore.String.Replace(DSCore.List.LastItem(DSCore.String.Split(name,"-")@L2<1>),"_","");

vle=	DSCore.List.Chop(log,1);
# ----------------------------------------
string_from_object_5 = FromObject(object=code_block_4)
code_block_36 = CodeBlock(x=string_from_object_5) { x=="Vielle" ? true:false; }
code_block_37 = CodeBlock { ["Nom","Surface","N° Logement / N° Local","Nom Bâtiment"]; }
code_block_38 = CodeBlock { ["Nom","Surface","N° Local","Surface Extérieure"]; }
IF_3 = Python(IN[0]=code_block_36, IN[1]=code_block_37, IN[2]=code_block_38)  # IronPython2; same code as IF

# group: Crée_Nomenclatures
categories_4 = Categories("OST_Rooms")
schedule_type = ScheduleTypes("RegularSchedule")
createSchedule = ScheduleView.CreateSchedule(category=categories_4, name=code_block_35.log, scheduleType=schedule_type)
schedulableFields = ScheduleView.SchedulableFields(scheduleView=createSchedule)
code_block_39 = CodeBlock(n=schedulableFields) { n.Name; }
ꟿ_list_nullindexof = Custom[ꟿ List.NullIndexOf](list=code_block_39@L2, element=IF_3)  # package spring nodes; Similar to the bult-in node but provides a null value instead of -1 of failure. Part of the SmartCopyMonitor workflow.
getItemAtIndex_2 = List.GetItemAtIndex(list=schedulableFields, index=ꟿ_list_nullindexof, lacing=Shortest)
addFields = ScheduleView.AddFields(scheduleView=createSchedule, fields=getItemAtIndex_2)

python_script_2 = Python(IN[0]=addFields)  # IronPython2
# ---------- python_script_2.python (34 lines) ----------
import clr
clr.AddReference('ProtoGeometry')
from Autodesk.DesignScript.Geometry import *

clr.AddReference("RevitServices")
import RevitServices
from RevitServices.Persistence import DocumentManager
from RevitServices.Transactions import TransactionManager

clr.AddReference("RevitAPI")
import Autodesk
from Autodesk.Revit.DB import *

doc = DocumentManager.Instance.CurrentDBDocument
uiapp = DocumentManager.Instance.CurrentUIApplication
app = uiapp.Application

from System.Collections.Generic import *

clr.AddReference("RevitNodes")
import Revit
clr.ImportExtensions(Revit.Elements)


TransactionManager.Instance.EnsureInTransaction(doc)
vulist= []
unwrappeds = UnwrapElement(IN[0])

for unwrapped in unwrappeds :
	unwrapped.Definition.IncludeLinkedFiles = True
out = unwrappeds
TransactionManager.Instance.TransactionTaskDone()

OUT = out
# ----------------------------------------

# group: Crée_Filtre-Nomenclature
fields = ScheduleView.Fields(scheduleView=python_script_2)
code_block_40 = CodeBlock { 2; }
getItemAtIndex_3 = List.GetItemAtIndex(list=fields@L2, index=code_block_40@L2, lacing=Longest)
schedule_filter_type = ScheduleFilterType("Contains")
byFieldTypeAndValue = Revit.Schedules.ScheduleFilter.ByFieldTypeAndValue(field=getItemAtIndex_3, filterType=schedule_filter_type, value=code_block_35.vle)
addFilters = ScheduleView.AddFilters(scheduleView=python_script_2, scheduleFilters=byFieldTypeAndValue)

# group: Crée_Group
code_block_41 = CodeBlock(e=addFilters) { a=	Revit.Elements.Element.SetParameterByName(e,"Classement","PDV-Logement"); }
code_block_42 = CodeBlock { "TOTAL"; }
python_script_3 = Python(IN[0]=code_block_41, IN[1]=code_block_42)  # IronPython2
# ---------- python_script_3.python (37 lines) ----------
import clr
clr.AddReference('ProtoGeometry')
from Autodesk.DesignScript.Geometry import *

clr.AddReference("RevitServices")
import RevitServices
from RevitServices.Persistence import DocumentManager
from RevitServices.Transactions import TransactionManager

clr.AddReference("RevitAPI")
import Autodesk
from Autodesk.Revit.DB import *

doc = DocumentManager.Instance.CurrentDBDocument
uiapp = DocumentManager.Instance.CurrentUIApplication
app = uiapp.Application

from System.Collections.Generic import *

clr.AddReference("RevitNodes")
import Revit
clr.ImportExtensions(Revit.Elements)


TransactionManager.Instance.EnsureInTransaction(doc)
vulist= []
unwrappeds = UnwrapElement(IN[0])

for unwrapped in unwrappeds :
	unwrapped.Definition.ShowGrandTotal = True
	unwrapped.Definition.ShowGrandTotalCount = False
	unwrapped.Definition.ShowGrandTotalTitle = True
	unwrapped.Definition.GrandTotalTitle = IN[1]
out = unwrappeds
TransactionManager.Instance.TransactionTaskDone()

OUT = out
# ----------------------------------------
code_block_43 = CodeBlock { 3; }
getItemAtIndex_4 = List.GetItemAtIndex(list=fields@L2, index=code_block_43@L2, lacing=Longest)
code_block_44 = CodeBlock(n=getItemAtIndex_4) { DSCore.List.Flatten(n.Name); }
boolean_2 = BoolSelector(true)
boolean_3 = BoolSelector(false)
schedule_sort_order = ScheduleSortOrderUi("Ascending")
schedule_sorting_grouping = Custom[Schedule Sorting Grouping](schedule=code_block_41, parameterName=code_block_44, blankLine=boolean_2, footerCount=boolean_3, footerTitle=boolean_3, header=boolean_3, sortOrder=schedule_sort_order, lacing=Longest)  # package archi-lab.net; This node will allow you to specify sorting/grouping parameters in schedule as well parameters like sorting order, whether its a footer or header. Visit archi-lab.net for more information.

end = Revit.Transaction.Transaction.End(input=duplicate_2)

# group: Zone de Remplisage
byCurves_2 = FilledRegion.ByCurves(view=end, boundary=explode_2, regionType=code_block_5)

flatten_4 = List.Flatten(list=groupByKey_2.uniqueKeys)
firstItem = List.FirstItem(list=groupByKey_2.groups@L2)
code_block_45 = CodeBlock(e=firstItem) { Revit.Elements.Element.GetParameterValueByName(e,"Type de Logement"); }
flatten_5 = List.Flatten(list=code_block_45)
code_block_46 = CodeBlock(e=byCurves_2, num=flatten_4, t=flatten_5)
# ---------- code_block_46.designscript (2 lines) ----------
a=	Revit.Elements.Element.SetParameterByName(e,"Identifiant",num);
b=	Revit.Elements.Element.SetParameterByName(a,"Commentaires",t);
# ----------------------------------------
default = TextNoteType.Default()
byViewPointAndType = Custom[TextNote.ByViewPointAndType](view=end, point=centroid, text=flatten_4, textNoteType=default, runIt=actulaise, lacing=Longest)  # package archi-lab.net; This node creates a unwrapped (single line) text note in a given view, at a given location with a given text note type style assigned.
