# Dynamo graph Typlolgie de murs_script.dyn (Dynamo 2.18.1.5096)
# packages: spring nodes 204.1.0, LunchBox for Dynamo 2018.7.7, Data-Shapes 2022.2.100, Clockwork for Dynamo 2.x 2.3.0, archi-lab.net 2022.212.2722, Genius Loci 2022.3.9, Genius Loci 2023.7.13, bimorphNodes 5.1.3, archi-lab.net 2024.217.1024, Data-Shapes 2023.2.111

# group: Input
boolean = BoolSelector(true)
ꟿ_document_activeview = Custom[ꟿ Document.ActiveView](refresh=boolean)  # package spring nodes; Selects the current document's active view. Supports more view types than the built-in option. Will be depreciated once the bult in node works with all plan types.
categories = Categories("OST_Walls")
python_script = Python()  # IronPython2; graph input
# ---------- python_script.python (32 lines) ----------
#Copyright(c) 2015, Konrad K Sobon
# @arch_laboratory, http://archi-lab.net

import clr
clr.AddReference('ProtoGeometry')
from Autodesk.DesignScript.Geometry import *

# Import RevitAPI
clr.AddReference("RevitAPI")
import Autodesk
from Autodesk.Revit.DB import *
from Autodesk.Revit.DB.Analysis import *

# Import DocumentManager and TransactionManager
clr.AddReference("RevitServices")
import RevitServices
from RevitServices.Persistence import DocumentManager
from RevitServices.Transactions import TransactionManager

doc = DocumentManager.Instance.CurrentDBDocument

# Import ToDSType(bool) extension method
clr.AddReference("RevitNodes")
import Revit
clr.ImportExtensions(Revit.Elements)
clr.ImportExtensions(Revit.GeometryConversion)

#The inputs to this node will be stored as a list in the IN variable.
inProject = FilteredElementCollector(doc).OfClass(FilledRegion)

#Assign your output to the OUT variable
OUT = [j.ToDSType(True) for j in inProject]
# ----------------------------------------

# group: Input
file_path = Filename("..\..\..\..\..\BPA.png")
fromPath = FileObject(path=file_path)  # "File.FromPath"
readFromFile = Image.ReadFromFile(file=fromPath)
code_block = CodeBlock { "Type de Fichier"; ["Lien","Normal"]; "Suivant"; }
dropdown_data = Custom[DropDown Data](InputName=code_block.out0, Keys=code_block.out1, Values=code_block.out1)  # package Data-Shapes; Create data for DropDown input in UI.MultiInputForm ++ . Check out www.data-shapes.net for more infos.

# group: Input
code_block_2 = CodeBlock { "Typologie de Murs"; "Suivant"; }
code_block_3 = CodeBlock { "Choisir Fichier"; }
getDocuments = archilab.Revit.Selection.Select.GetDocuments()
dropdown_data_2 = Custom[DropDown Data](InputName=code_block_3, Keys=getDocuments.Link_Name, Values=getDocuments.Link_Instance)
inputgroup_data = Custom[InputGroup Data](GroupTitle=code_block_2.out0, Inputs=dropdown_data_2)  # package Data-Shapes; Creates a group of inputs for UI.MultipleInputForm ++ . Check out www.data-shapes.net for more infos !

inputgroup_data_2 = Custom[InputGroup Data](GroupTitle=code_block_2.out0, Inputs=dropdown_data)

# group (continued): Input
multipleinputform = Custom[MultipleInputForm ++](Logo_optional=readFromFile, ButtonText_optional=code_block.out2, Inputs=inputgroup_data_2, Toggle=boolean)  # package Data-Shapes; Create a form with multiple inputs. see www.data-shapes.net for tutorials and infos!

code_block_4 = CodeBlock(x=multipleinputform.User_Inputs) { x[0]; }
code_block_5 = CodeBlock(x=code_block_4) { x =="Lien" ? true:false; }
code_block_6 = CodeBlock(a=boolean, b=code_block_4) { [a,b][0]; }

# group (continued): Input
multipleinputform_2 = Custom[MultipleInputForm ++](Logo_optional=readFromFile, ButtonText_optional=code_block_2.out1, Inputs=inputgroup_data, Toggle=code_block_6)

code_block_7 = CodeBlock { ""; }
IF = Python(IN[0]=code_block_5, IN[1]=multipleinputform_2.User_Inputs, IN[2]=code_block_7)  # IronPython2
# ---------- IF.python (19 lines) ----------
import clr
clr.AddReference('ProtoGeometry')
from Autodesk.DesignScript.Geometry import *
#The inputs to this node will be stored as a list in the IN variables.

OUT = []

def tolist(obj):
	if hasattr(obj,"__iter__"):
		return obj
	else:
		return [obj]

if IN[0] == True:
	for x in tolist(IN[1]):
		OUT.append(x)
else:
	for x in tolist(IN[2]):
		OUT.append(x)
# ----------------------------------------

# group: Processing
planview_toboundingbox = Custom[PlanView ToBoundingBox](PlanView=ꟿ_document_activeview)  # package Genius Loci; Create boundingBox from plan view based on the view range settings. (Z is calculed from ProjectElevation)
ofCategory = Revit.LinkElement.OfCategory(linkInstance=IF, category=categories)
getElementsIntersect = Revit.BoundingBox.GetElementsIntersect(boundingBox=planview_toboundingbox, elements=ofCategory)
byCategoryAndView = archilab.Revit.Selection.Select.ByCategoryAndView(category=categories, view=ꟿ_document_activeview)
IF_2 = Python(IN[0]=code_block_5, IN[1]=getElementsIntersect, IN[2]=byCategoryAndView)  # IronPython2; same code as IF
flatten = List.Flatten(list=IF_2)
element_locationcurve = Custom[Element LocationCurve](element=flatten)  # package Genius Loci; Gets the curve geometry from the element.
code_block_8 = CodeBlock(n=flatten) { n.Name; }
groupByKey = List.GroupByKey(list=element_locationcurve, keys=code_block_8)
python_script_2 = Python(IN[0]=IF)  # IronPython2
# ---------- python_script_2.python (42 lines) ----------
import clr
clr.AddReference('RevitAPI')
from Autodesk.Revit.DB import *
clr.AddReference('RevitServices')
from RevitServices.Persistence import DocumentManager
doc = DocumentManager.Instance.CurrentDBDocument
import System
from System.Collections.Generic import List

clr.AddReference('RevitNodes')
import Revit
clr.ImportExtensions(Revit.GeometryConversion)

clr.AddReference('ProtoGeometry')
from Autodesk.DesignScript.Geometry import *

def tolist(x):
    if hasattr(x, '__iter__'): return x
    else: return [x]

inputdocs = tolist(UnwrapElement(IN[0]))

transforms = []

for inputdoc in inputdocs:
    if inputdoc is None:
        doclnk = doc
    elif isinstance(inputdoc, Document):
        doclnk = inputdoc
    elif isinstance(inputdoc, RevitLinkInstance):
        doclnk = inputdoc.GetLinkDocument()
        try:
            transf = inputdoc.GetTotalTransform()
            transforms.append(transf.ToCoordinateSystem(1))
        except Exception as e:
            transforms.append(None)
            # Hata durumunda hatayı yazdırmak için
            print("Hata:", str(e))
    else:
        doclnk = doc

OUT = transforms
# ----------------------------------------
transform = Geometry.Transform(geometry=groupByKey.groups, cs=python_script_2, lacing=Longest)
IF_3 = Python(IN[0]=code_block_5, IN[1]=transform, IN[2]=groupByKey.groups)  # IronPython2; same code as IF
byCurve = DetailCurve.ByCurve(view=ꟿ_document_activeview, curve=IF_3)
code_block_9 = CodeBlock(x=groupByKey.uniqueKeys) { x; }
code_block_10 = CodeBlock(e=ꟿ_document_activeview) { Revit.Elements.Element.GetParameterValueByName(e,"Echelle de la vue"); }
code_block_11 = CodeBlock(x=python_script) { x[0]; }
type = archilab.Revit.Elements.Elements.Type(element=code_block_11)

# group: Input
code_block_12 = CodeBlock { "Répérage de Murs"; "Terminer"; }
code_block_13 = CodeBlock { "Choisir de Couleur"; }
colorinput_data = Custom[ColorInput Data](InputName=code_block_9, ButtonText=code_block_13, lacing=Longest)  # package Data-Shapes; Create a color selection input for UI.MultiInputForm++ . Check out www.data-shapes.net for more infos! Warning : Only works with Revit 2017
inputgroup_data_3 = Custom[InputGroup Data](GroupTitle=code_block_12.out0, Inputs=colorinput_data)
multipleinputform_3 = Custom[MultipleInputForm ++](Logo_optional=readFromFile, ButtonText_optional=code_block_12.out1, Inputs=inputgroup_data_3, Toggle=boolean)

# group: Filter
createDictionary = Lists.Dictionary.CreateDictionary(Keys=code_block_9, Values=multipleinputform_3.User_Inputs)
getDictionaryKeysValues = Lists.Dictionary.GetDictionaryKeysValues(dictionary=createDictionary)
toDynamoColor = Custom[Color.ToDynamoColor](RevitColor=getDictionaryKeysValues.Values)  # package Clockwork for Dynamo 2.x; Converts Revit colors into Dynamo colors
passthrough = Custom[Passthrough](passThrough=byCurve, waitFor=toDynamoColor)  # package Clockwork for Dynamo 2.x; Forces a sequential order of execution. The node wired into the output of the Passthrough node will be executed *after* the node wired into the waitFor input (e.g. important for some Revit operations). The value of the passThrough input will be passed on to the node wired into the output port of the Passthrough node.
code_block_14 = CodeBlock { 8; }
byProperties = Revit.Filter.OverrideGraphicSettings.ByProperties(projectionLineColor=toDynamoColor, projectionLineWeight=code_block_14)
overrideInView = Element.OverrideInView(element=passthrough@L2, overrides=byProperties, lacing=Longest)

# group: Légende
list_all_views = Python()  # IronPython2; unwired: IN[0]
# ---------- list_all_views.python (34 lines) ----------
import clr
# Import DocumentManager and TransactionManager
clr.AddReference("RevitServices")
import RevitServices
from RevitServices.Persistence import DocumentManager
doc = DocumentManager.Instance.CurrentDBDocument
# Import RevitAPI
clr.AddReference("RevitAPI")
import Autodesk
from Autodesk.Revit.DB import *

# Import ToDSType(bool) extension method
clr.AddReference("RevitNodes")
import Revit
clr.ImportExtensions(Revit.Elements)

#Part of script from Clockwork
inputdoc = UnwrapElement(IN[0])
if inputdoc == None:
	doc = DocumentManager.Instance.CurrentDBDocument
else: doc = None

views = FilteredElementCollector(doc).OfClass(View).ToElements()

legends = []

for i in views:
	if not i.IsTemplate:
		if  i.ViewType == ViewType.Legend:
			legends.append(i.ToDSType(True))
		else:
			continue

OUT = legends
# ----------------------------------------
code_block_15 = CodeBlock(x=list_all_views) { a=	x.Name == "NE PAS SUPRIMER" ? true:false; b=	DSCore.List.FilterByBoolMask(x,a)["in"]; }
code_block_16 = CodeBlock(niv=ꟿ_document_activeview) { "Reperage des Murs"+"-" + niv.Name; }
view_duplicate_options = ViewDuplicateOptions("Duplicate")
duplicate = archilab.Revit.Views.Views.Duplicate(view=code_block_15.b, name=code_block_16, options=view_duplicate_options)
code_block_17 = CodeBlock(e=duplicate, ech=code_block_10) { Revit.Elements.Element.SetParameterByName(e,"Echelle de la vue",ech); }
python_script_3 = Python(IN[0]=duplicate)  # IronPython2
# ---------- python_script_3.python (24 lines) ----------
import clr
clr.AddReference('RevitAPI')
from Autodesk.Revit.DB import *

clr.AddReference("RevitNodes")
import Revit
clr.ImportExtensions(Revit.GeometryConversion)

clr.AddReference('ProtoGeometry')
from Autodesk.DesignScript.Geometry import *

def ViewPlane(view):
	if hasattr(view, "ViewDirection") and hasattr(view, "Origin"):
		o = view.Origin
		n = view.ViewDirection
		if o and n: return Plane.ByOriginNormal(o.ToPoint(), n.ToVector())
		else: return None
	else: return None

views = UnwrapElement(IN[0])
origin = []

if isinstance(IN[0], list): OUT = [ViewPlane(x) for x in views]
else: OUT = ViewPlane(views)
# ----------------------------------------
code_block_18 = CodeBlock(p=python_script_3) { p.Origin; }
YAxis = Vector.YAxis()
code_block_19 = CodeBlock(x=code_block_10)
# ---------- code_block_19.designscript (3 lines) ----------
x<=50 			? 1:
x>51 && x<=100	? 2:
x>101 && x<=201	? 4:1;
# ----------------------------------------
code_block_20 = CodeBlock(k=code_block_19) { k*200; }
byStartPointDirectionLength = Line.ByStartPointDirectionLength(startPoint=code_block_18, direction=YAxis, length=code_block_20)
code_block_21 = CodeBlock(k=code_block_19) { k*10; k*20; }
byWidthLength = Rectangle.ByWidthLength(plane=python_script_3, width=code_block_21.out1, length=code_block_21.out0)

# group: Type de Murs
code_block_22 = CodeBlock(c=byStartPointDirectionLength, x=toDynamoColor, g=byWidthLength)
# ---------- code_block_22.designscript (5 lines) ----------
a=	DSCore.List.Flatten(Autodesk.Curve.PointAtParameter(c<1L>,(0..1..#DSCore.List.Count(x))<1L>));
b=	Autodesk.CoordinateSystem.ByOrigin(a.X,a.Y,a.Z);
b1=	DSCore.List.Flatten(Autodesk.Geometry.Transform(g<2>,b));

b2=	Autodesk.Geometry.Explode(b1);
# ----------------------------------------
code_block_23 = CodeBlock(x=code_block_22.a, k=code_block_21.out1) { Autodesk.Geometry.Translate(x,k+5,(k/2)-10,0); }
code_block_24 = CodeBlock { "Left"; }
ꟿ_textnote_bypoint = Custom[ꟿ TextNote.ByPoint](view=duplicate, point=code_block_23, content=getDictionaryKeysValues.Keys, horAlign=code_block_24)  # package spring nodes; Places a text note at a given point in the view. View, text type and content can either be a single item for all points or the same length as the number of points. Set track to false if you'd like to place notes on every run.
code_block_25 = CodeBlock(x=code_block_22.b2) { x; }
byCurves = FilledRegion.ByCurves(view=duplicate, boundary=code_block_25, regionType=type, lacing=Longest)
fill_patterns = FillPatterns("<Remplissage de solide>")
create_overridegraphicsettings = Custom[Create OverrideGraphicSettings](SurfaceForegroundPattern=fill_patterns, SurfaceForegroundPatternColor=toDynamoColor)  # package Genius Loci; Create a OverrideGraphicSettings (All graphic inputs are optional). Unlike the OOTB OverrideGraphicSettings.ByProperties node, the Foreground and background patterns are available. Note : Prior to Revit 2019, the materials have only one surface pattern and one cut pattern.
view_setelementoverrides = Custom[View SetElementOverrides](view=duplicate, elements=byCurves, overrides=create_overridegraphicsettings, lacing=Longest)  # package Genius Loci; Overrides element graphics settings in the given view. For use with the Create OverrideGraphicSettings node. Can also be used to hide or unhide elements.
code_block_26 = CodeBlock(x=code_block_22.b) { x; }

python_script_4 = Python()  # IronPython2; frozen; unwired: IN[0]; same code as python_script_2
