# Dynamo graph Charte Plug-in_script.dyn (Dynamo 2.19.3.6394)

file_path = Filename("..\..\..\..\..\..\..\08-STANDARD\BPA-BPA Plug-in_Guide.docx")
python_script = Python(IN[0]=file_path)  # IronPython2
# ---------- python_script.python (26 lines) ----------
import sys
import clr
import System

clr.AddReference("Microsoft.Office.Interop.Word")
import Microsoft.Office.Interop.Word as Word

clr.AddReference("System.Runtime.InteropServices")
import System.Runtime.InteropServices


filePath = IN[0]

def openfile(source_filename):
    word_application = Word.ApplicationClass()
    word_application.visible = True
    document = word_application.Documents.Open(source_filename)
    return document

word_application = Word.ApplicationClass()
word_application.Quit()
word_application = None

newDoc = openfile(filePath)

OUT = newDoc
# ----------------------------------------
